# Grasshopper definition Cubbyhouse GH Example - Case 1.gh (Grasshopper 1.0.8)
# plug-ins: jSwan, eleFront

# ----
# Structure
length = Slider(5, range=2..5)
width = Slider(2.3, range=2..4)
length_mm = Number(expr("x*1000", length))
width_mm = Number(expr("x*1000", width))

# ----
# Decking
list = ValueList({"300", "450", "600"}, selected="450")
list_2 = ValueList({"single", "continuous"}, selected="continuous")
deckingparams = Python3Script(design_span=list, span_type=list_2)  # -> design_parameters; inputs design_span: Int32, span_type: String
# ---------- deckingparams: Python ----------
from cubbyhouse.building import DeckingParams

design_parameters = DeckingParams(
        design_span=design_span, span_type=span_type
)
# ---------- end deckingparams ----------
framinggroup = Python3Script(
    framing_group_id="F1",
    length=length_mm,
    width=width_mm,
    design_parameters=deckingparams,
    max_parts_per_length=Slider(3, range=1..3))  # -> framing_group; inputs framing_group_id: String, length: Int32, width: Int32, max_parts_per_length: Int32
# ---------- framinggroup: Python ----------
from cubbyhouse.building import FramingGroup

#create framing groups
framing_group = FramingGroup(
    framing_group_id,
    length=length,
    width=width,
    design_parameters=design_parameters,
    max_parts_per_length=max_parts_per_length
)
framing_group.update_framing_group_joints(joints_from="design_span")
# ---------- end framinggroup ----------

# ----
# Deck Joists
panel = Panel("F2")
list_3 = ValueList({"450", "600", "900", "1200"}, selected="1200")
list_4 = ValueList({"single", "continuous"}, selected="continuous")
deckjoistparams = Python3Script(design_span=list_3, span_type=list_4, joist_spacing=list)  # -> design_parameters; inputs design_span: Int32, span_type: String, joist_spacing: Double
# ---------- deckjoistparams: Python ----------
from cubbyhouse.building import DeckJoistParams

design_parameters = DeckJoistParams(
    design_span=design_span,
    span_type=span_type,
    joist_spacing=joist_spacing, #~floor load width
)
# ---------- end deckjoistparams ----------
framinggroup_2 = Python3Script(
    framing_group_id=panel,
    length=width_mm,
    width=length_mm,
    design_parameters=deckjoistparams,
    max_parts_per_length=Slider(1, range=1..4))  # -> framing_group; inputs framing_group_id: String, length: Int32, width: Int32, max_parts_per_length: Int32; same code as framinggroup

# ----
# Bearer
panel_2 = Panel("F3")
list_5 = ValueList({"1600", "1800", "2400", "3600"}, selected="1600")
list_6 = ValueList({"single", "continuous"}, selected="single")
transverse_laminations = Slider(2, range=1..2)
floorbearerparams = Python3Script(design_span=list_5, span_type=list_6, floor_load_width=list_3)  # -> design_parameters; inputs design_span: Int32, span_type: String, floor_load_width: Double
# ---------- floorbearerparams: Python ----------
from cubbyhouse.building import FloorBearerParams

design_parameters = FloorBearerParams(
    design_span=design_span,
    span_type=span_type,
    floor_load_width=floor_load_width,
)
# ---------- end floorbearerparams ----------
framinggroup_3 = Python3Script(
    framing_group_id=panel_2,
    length=length_mm,
    width=width_mm,
    design_parameters=floorbearerparams,
    max_parts_per_length=Slider(3, range=1..3),
    transverse_laminations=transverse_laminations)  # -> framing_group; inputs framing_group_id: String, length: Int32, width: Int32, max_parts_per_length: Int32, transverse_laminations: Int32
# ---------- framinggroup_3: Python ----------
from cubbyhouse.building import FramingGroup

#create framing groups
framing_group = FramingGroup(
    framing_group_id,
    length=length,
    width=width,
    design_parameters=design_parameters,
    max_parts_per_length=max_parts_per_length
)
framing_group.update_framing_group_joints(joints_from="design_span")
framing_group.update_transverse_laminations(transverse_laminations)
# ---------- end framinggroup_3 ----------

# ----
# Dispatch
surplus_factor = Slider(1.1, range=1..2)
list_7 = ValueList({"STAGE0_ALL": 0, "STAGE1_STRUCT": 1, "STAGE2_MIN_SIZE": 2, "STAGE3_FINAL_ALLOCATION": 3}, selected="STAGE3_FINAL_ALLOCATION")

# ----
# Examples
list_8 = ValueList({"Case 1": "case_1", "Case 2": "case_2"}, selected="Case 1")

# ----
# Target Planes - Case 1
z_offs = Slider(-561, range=-1000..0)
panel_3 = Panel("""False
True
False""")
panel_4 = Panel("""True
False
False""")
pt = Point(Point(8026.454116, 6926.423427, 0))
rotate_section = Boolean(panel_4)
cluster = Cluster_2(corner_pt=pt, z_spread=z_offs, flip_xy=panel_3)

# ----
# Graph Attributes - Case 1
list_9 = ValueList({"Engrave", "Millimeter Architectural", "Millimeter Large", "Millimeter Small", "Millimeter Small -graph"}, selected="Millimeter Small -graph")
graph_spread = Slider(4.8, range=0..10)
width_scale_factor = Slider(177.25, range=0.01..200)
length_scale_factor = Slider(0.011, range=0..0.4)
text_y_shift = Slider(20, range=0..20)
graphattributes = Python3Script(
    graph_text=list_9,
    graph_spread=graph_spread,
    length_scale_factor=length_scale_factor,
    width_scale_factor=width_scale_factor,
    text_y_shift=text_y_shift)  # -> out, graph_attributes; inputs graph_spread: Double, length_scale_factor: Double, width_scale_factor: Double
# ---------- graphattributes: Python ----------
"""Grasshopper Script"""

from dataclasses import  dataclass

@dataclass
class GraphAttributes():
    graph_text: str
    graph_spread: float
    length_scale_factor: float
    width_scale_factor: float
    text_y_shift: float


graph_attributes=GraphAttributes(
    graph_text=graph_text, 
    graph_spread=graph_spread, 
    length_scale_factor=length_scale_factor,
    width_scale_factor=width_scale_factor,
    text_y_shift=text_y_shift)
print(graph_attributes)
# ---------- end graphattributes ----------
graph_attributes = Data(graphattributes.graph_attributes)

# ----
# Structure - Import from File
structurefromfile = Python3Script(case=list_8)  # -> structure, framing_group_ids; inputs case: String; disabled
# ---------- structurefromfile: Python ----------
from cubbyhouse.utils import get_structure_from_case_id

####################################
# CREATE STRUCTURE, STOCK, MEDIATOR
####################################

structure = get_structure_from_case_id(case)
framing_group_ids = list(structure.framing_groups.keys())
# ---------- end structurefromfile ----------

# ----
# Stock - Import from File
stockfromfile = Python3Script(case=list_8)  # -> board_stock, section_group_ids; inputs case: String
# ---------- stockfromfile: Python ----------
from cubbyhouse.utils import get_stock_file_from_case_id
from cubbyhouse.boardstock import BoardStock

####################################
# CREATE STRUCTURE, STOCK, MEDIATOR
####################################
board_stock = BoardStock.from_element_group_csv(get_stock_file_from_case_id(case))

print("\n Element Groups:")
print(board_stock.element_group_df)
print("\n Section Groups:")
print(board_stock.section_group_df)

section_group_ids = list(board_stock.section_group_df.index)
# ---------- end stockfromfile ----------
panel_5 = Panel(stockfromfile.board_stock)

merge = Merge(Data1=framinggroup, Data2=framinggroup_2, Data3=framinggroup_3)
structure = Python3Script(framing_groups=merge)  # -> structure, framing_group_ids; inputs framing_groups: list
# ---------- structure: Python ----------
from cubbyhouse.building import TimberFramedStructure
structure = TimberFramedStructure.from_list(framing_groups)

framing_group_ids = list(structure.framing_groups.keys())
# ---------- end structure ----------

# ----
# Mediator
cubbyhousemediator = Python3Script(structure=structure.structure, board_stock=stockfromfile.board_stock)  # -> mediator
# ---------- cubbyhousemediator: Python ----------
"""Grasshopper Script"""

from cubbyhouse.mediator import CubbyhouseMediator


mediator = CubbyhouseMediator(structure, board_stock)
# ---------- end cubbyhousemediator ----------

swatch = ColourSwatch(SwatchColor=RGB(255, 255, 255))

# ----
# Stage 1 Visualiser
view_graph = BooleanToggle(True)

c_script = CSharpScript(switcher=Toggle(True), canvas_back=swatch, canvas_grid=swatch)  # -> out, a
# ---------- c_script: C# ----------
private void RunScript(bool switcher, Color canvas_back, Color canvas_grid, ref object A)
  {
    if (switcher == true)
    {
      Grasshopper.GUI.Canvas.GH_Skin.canvas_grid = canvas_grid;
      Grasshopper.GUI.Canvas.GH_Skin.canvas_back = canvas_back; 
      Grasshopper.GUI.Canvas.GH_Skin.canvas_edge = Color.FromArgb(255, 0, 0, 0); 
      Grasshopper.GUI.Canvas.GH_Skin.canvas_shade = Color.FromArgb(80, 0, 0, 0); 
    }
    else
    {
      //DEFAULTS
      Grasshopper.GUI.Canvas.GH_Skin.canvas_grid = Color.FromArgb(30, 0, 0, 0);
      Grasshopper.GUI.Canvas.GH_Skin.canvas_back = Color.FromArgb(255, 212, 208, 200); 
      Grasshopper.GUI.Canvas.GH_Skin.canvas_edge = Color.FromArgb(255, 0, 0, 0); 
      Grasshopper.GUI.Canvas.GH_Skin.canvas_shade = Color.FromArgb(80, 0, 0, 0);
    }
  }
# ---------- end c_script ----------

# ----
# Stage 1: Dispatch
cubbyhousemediator_2 = Python3Script(mediator=cubbyhousemediator, dispatch_stage=list_7, threshold_score=surplus_factor)  # -> mediator, dispatch_matrix, normalised_dispatch_matrix, small_parts_bar; inputs dispatch_stage: Int32, threshold_score: Double
# ---------- cubbyhousemediator_2: Python ----------
"""Grasshopper Script"""


from cubbyhouse.mediator import DispatchStage
small_parts_bar = False
print(dispatch_stage)
if dispatch_stage==0:
    mediator.dispatch_section_groups(DispatchStage.STAGE0_ALL)
elif dispatch_stage==1:
    mediator.dispatch_section_groups(DispatchStage.STAGE1_STRUCT)
elif dispatch_stage==2:
    mediator.dispatch_section_groups(DispatchStage.STAGE2_MIN_SIZE)
    small_parts_bar = True
elif dispatch_stage==3:
    mediator.THRESHOLD_SCORE = threshold_score
    mediator.dispatch_section_groups(DispatchStage.STAGE3_FINAL_ALLOCATION)
    small_parts_bar = True

# mediator.dispatch_element_groups(DispatchStage.STAGE3_FINAL_ALLOCATION)
print(mediator.dispatch_matrix)
print(mediator.normalised_dispatch_matrix)

dispatch_matrix = mediator.dispatch_matrix
normalised_dispatch_matrix = mediator.normalised_dispatch_matrix
print(dispatch_matrix.sum().sum())
# ---------- end cubbyhousemediator_2 ----------
panel_6 = Panel(cubbyhousemediator_2.normalised_dispatch_matrix)
panel_7 = Panel(cubbyhousemediator_2.dispatch_matrix)

and = GateAnd(A=view_graph, B=cubbyhousemediator_2.small_parts_bar)

# ----
# All Stock Length Chart
view_graph_2 = Boolean(view_graph)
graph_attributes_2 = Data(graph_attributes)
allstocklengthchart = AllStockLengthChart(show=view_graph_2, mediator=cubbyhousemediator_2.mediator, graph_attributes=graph_attributes_2)  # -> stock_graph_text_3, stock_bar_chart_3
preview = CustomPreview(Geometry=allstocklengthchart.stock_bar_chart_3, Material=ColourSwatch(SwatchColor=RGBA(166, 166, 166, 116)))
preview_2 = CustomPreview(Geometry=allstocklengthchart.stock_graph_text_3, Material=ColourSwatch(SwatchColor=RGB(181, 181, 181)))

panel_8 = Panel(cubbyhousemediator_2.small_parts_bar)

# ----
# Stage 2 Visualiser
show_jointing_patterns = BooleanToggle(False)  # disabled
show_cutting_patterns = BooleanToggle(False)  # disabled
show_parts = BooleanToggle(False)  # disabled
show_element_groups = BooleanToggle(False)  # disabled
show_member_groups = BooleanToggle(False)  # disabled
show_members_3d = BooleanToggle(False)  # disabled
show_elements = BooleanToggle(False)  # disabled
show_members = BooleanToggle(False)  # disabled

# ----
# Elements
# todo: rename boards to elements
stockdata = Python3Script(mediator=cubbyhousemediator_2.mediator)  # -> elements, element_groups; disabled
# ---------- stockdata: Python ----------
#boards should be elements
boards = mediator.export_elements()
elements=boards
# elements = mediator.export_elements()
element_groups = mediator.export_element_groups()
# ---------- end stockdata ----------

# ----
# Stage 2:
# Patterns
solve_patterns = BooleanToggle(False)  # disabled

# ----
# Members, Jointing Patterns, Parts
memberjointing = Python3Script(mediator=cubbyhousemediator_2.mediator, solve_patterns=solve_patterns)  # -> mediator, members, member_groups, jointing_patterns, parts; disabled
# ---------- memberjointing: Python ----------
###############################
# MEMBER AND JOINTING PATTERN
###############################
if solve_patterns:
    print("Member Jointing Pattern Generation:")
    mediator.create_members() #create members including member jointing patterns
    print(f'\n Member Demand Vector Q_m: \n {mediator.Q_m}')
    print(f'\n Jointing Pattern Member Supply Matrix [M]: \n {mediator.M_matrix}')
    print(f'\n Jointing Pattern Part Demand Matrix [J]: \n {mediator.J_matrix}')

    member_groups = mediator.export_member_groups()

    members = mediator.export_members()

    jointing_patterns = mediator.export_jointing_patterns()
    parts = mediator.export_parts()
# ---------- end memberjointing ----------

# ----
# Plotting Params
list_10 = ValueList({"Engrave", "Millimeter Architectural", "Millimeter Large", "Millimeter Small"}, selected="Millimeter Small")  # disabled
member_spread = Slider(-1.2, range=-3..0)  # disabled
x_spread = Slider(514, range=0..1000)  # disabled
block_spread_ve = Panel("-200")  # disabled
block_spread_ve_2 = Panel("200")  # disabled
members_json = Data(memberjointing.members)  # disabled
elements = Data(stockdata.elements)  # disabled
parts_json = Data(memberjointing.parts)  # disabled
max_l = Max_L(path=parts_json)  # disabled
max_l_2 = Max_L(path=elements)  # disabled
max_l_3 = Max_L(path=members_json)  # disabled
y_shift_ve = Panel("-1000")  # disabled
y_shift_ve_2 = Panel("0")  # disabled
max_member_length = Number(max_l_3)  # disabled
max_part_length = Number(max_l)  # disabled
max_element_length = Number(max_l_2)  # disabled
addition = Addition(A=max_element_length, B=x_spread)  # disabled
part_x_shift = Number(expr("-x/2", max_part_length))  # disabled
addition_2 = Addition(A=max_member_length, B=x_spread)  # disabled
neg = Negative(Value=addition)  # disabled
series = Series(Start=neg, Step=neg, Count=2)  # -> simplify(graft(Series)); disabled
series_2 = Series(Start=0, Step=addition_2, Count=2)  # -> simplify(graft(Series)); disabled
bang = ExplodeTree(Data=simplify(series))  # -> Branch0, Branch1; disabled
bang_2 = ExplodeTree(Data=simplify(series_2))  # -> Branch0, Branch1; disabled

# ----
# Cutting Patterns
# Todo - Flow Control
elementcutting = Python3Script(mediator=memberjointing.mediator, solve_patterns=solve_patterns)  # -> mediator, cutting_patterns; disabled
# ---------- elementcutting: Python ----------
if solve_patterns:
    print("\n Element Cutting Pattern Generation:")
    mediator.create_element_group_cutting_patterns(pattern_type = 'no_usable_residual')
    print(f'\n Cutting Pattern Part Supply Matrix [C]: \n {mediator.C_matrix}')
    print(f'\n Cutting Pattern Element Demand Matrix [E]: \n {mediator.E_matrix}')
    print(f'\n Cutting Pattern Waste Vector [w]:\n {mediator.w_vector}')
    print(f'\n Element Supply Vector: \n {mediator.Q_e}')
    cutting_patterns = mediator.export_cutting_patterns()
# ---------- end elementcutting ----------

swatch_2 = ColourSwatch(SwatchColor=RGBA(214, 209, 188, 147))  # disabled

# ----
# Make Elements
panel_9 = Panel("elements")  # disabled
json_element_groups = Json_element_groups(path=stockdata.elements)  # -> block_definition_2, block_2, block_attributes_2, V_2, V; disabled
block_id = Text(flatten(json_element_groups.V_2))  # disabled
block_definition = Data(json_element_groups.block_definition_2)  # disabled
bakedata = BakeData(
    text_style=list_10,
    block_id=block_id,
    block_label=block_id,
    bake_name=panel_9,
    spread=block_spread_ve_2,
    x_shift=bang.Branch0,
    y_shift=y_shift_ve_2)  # -> block_instance, bake_name_3, text_2, text_bake_name; disabled
bake = BakeObjects(Geometry=bakedata.block_instance, BakeName=bakedata.bake_name_3, Bake=False, createGroups=False)  # -> Message, Ghosts; disabled
bake_2 = BakeObjects(Geometry=bakedata.text_2, BakeName=bakedata.text_bake_name, Bake=False, createGroups=False)  # -> Message, Ghosts; disabled

# ----
# Make Jointing Patterns
panel_10 = Panel("jointing_patterns")  # disabled
json_jps = Json_jps(path=memberjointing.jointing_patterns, layer_name=panel_10)  # -> block_definition_2, block_3, block_attributes_2, part_id, name_2, V; disabled
block_definition_2 = Data(json_jps.block_definition_2)  # disabled
block_id_2 = Text(simplify(flatten(json_jps.name_2)))  # disabled
bakedata_2 = BakeData(
    text_style=list_10,
    block_id=block_id_2,
    block_label=block_id_2,
    bake_name=panel_10,
    spread=block_spread_ve,
    x_shift=bang_2.Branch1,
    y_shift=y_shift_ve)  # -> block_instance, bake_name_3, text_2, text_bake_name; disabled
bake_3 = BakeObjects(Geometry=bakedata_2.block_instance, BakeName=bakedata_2.bake_name_3, Bake=False, createGroups=False)  # -> Message, Ghosts; disabled
bake_4 = BakeObjects(Geometry=bakedata_2.text_2, BakeName=bakedata_2.text_bake_name, Bake=False, createGroups=False)  # -> Message, Ghosts; disabled

# ----
# Make Element Groups
json_element_groups_2 = Json_element_groups_2(path=stockdata.element_groups)  # -> zshift, block_definition_2, block_2, block_attributes_2, name_2, R, V, V_2; disabled
panel_11 = Panel("element_groups")  # disabled
block_definition_3 = Data(json_element_groups_2.block_definition_2)  # disabled
block_id_3 = Text(flatten(json_element_groups_2.name_2))  # disabled
label = Text(flatten(json_element_groups_2.R))  # disabled
bakedata_3 = BakeData(
    text_style=list_10,
    block_id=block_id_3,
    block_label=label,
    bake_name=panel_11,
    spread=block_spread_ve_2,
    x_shift=bang.Branch1,
    y_shift=y_shift_ve_2,
    F=json_element_groups_2.zshift)  # -> block_instance, bake_name_3, text_2, text_bake_name; disabled
bake_5 = BakeObjects(Geometry=bakedata_3.block_instance, BakeName=bakedata_3.bake_name_3, Bake=False, createGroups=False)  # -> Message, Ghosts; disabled
bake_6 = BakeObjects(Geometry=bakedata_3.text_2, BakeName=bakedata_3.text_bake_name, Bake=False, createGroups=False)  # -> Message, Ghosts; disabled

# ----
# Make Members
json_member = Json_member(path=memberjointing.members)  # -> block_definition_2, block_2, block_attributes_2, name_2, V_2, V; disabled
panel_12 = Panel("members")  # disabled
block_definition_4 = Data(json_member.block_definition_2)  # disabled
block_id_4 = Text(flatten(json_member.name_2))  # disabled
bakedata_4 = BakeData(
    text_style=list_10,
    block_id=block_id_4,
    block_label=block_id_4,
    bake_name=panel_12,
    spread=block_spread_ve_2,
    x_shift=bang_2.Branch0,
    y_shift=y_shift_ve_2)  # -> block_instance, bake_name_3, text_2, text_bake_name; disabled
bake_7 = BakeObjects(Geometry=bakedata_4.block_instance, BakeName=bakedata_4.bake_name_3, Bake=False, createGroups=False)  # -> Message, Ghosts; disabled
bake_8 = BakeObjects(Geometry=bakedata_4.text_2, BakeName=bakedata_4.text_bake_name, Bake=False, createGroups=False)  # -> Message, Ghosts; disabled

# ----
# Make Cutting Patterns
json_cps = Json_cps(path=elementcutting.cutting_patterns)  # -> V, block_definition_2, block_3, block_attributes_2, name_2; disabled
panel_13 = Panel("cutting_patterns")  # disabled
cutting_pattern_blocks = Data(json_cps.block_definition_2)  # disabled
block_id_5 = Text(simplify(flatten(json_cps.name_2)))  # disabled
bakedata_5 = BakeData(
    text_style=list_10,
    block_id=block_id_5,
    block_label=block_id_5,
    bake_name=panel_13,
    spread=block_spread_ve,
    x_shift=bang.Branch1,
    y_shift=y_shift_ve)  # -> block_instance, bake_name_3, text_2, text_bake_name; disabled
bake_9 = BakeObjects(Geometry=bakedata_5.block_instance, BakeName=bakedata_5.bake_name_3, Bake=False, createGroups=False)  # -> Message, Ghosts; disabled
bake_10 = BakeObjects(Geometry=bakedata_5.text_2, BakeName=bakedata_5.text_bake_name, Bake=False, createGroups=False)  # -> Message, Ghosts; disabled

# ----
# Make Member Groups
panel_14 = Panel("member_groups")  # disabled
json_member_groups = Json_member_groups(path=memberjointing.member_groups, layer_name=panel_14)  # -> block_definition_2, block_2, block_attributes_2, name_2, label_2; disabled
block_definition_5 = Data(json_member_groups.block_definition_2)  # disabled
block_label = Text(flatten(json_member_groups.label_2))  # disabled
block_id_6 = Text(flatten(json_member_groups.name_2))  # disabled
bakedata_6 = BakeData(
    text_style=list_10,
    block_id=block_id_6,
    block_label=block_label,
    bake_name=panel_14,
    spread=block_spread_ve_2,
    x_shift=bang_2.Branch1,
    y_shift=y_shift_ve_2)  # -> block_instance, bake_name_3, text_2, text_bake_name; disabled
bake_11 = BakeObjects(Geometry=bakedata_6.block_instance, BakeName=bakedata_6.bake_name_3, Bake=False, createGroups=False)  # -> Message, Ghosts; disabled
bake_12 = BakeObjects(Geometry=bakedata_6.text_2, BakeName=bakedata_6.text_bake_name, Bake=False, createGroups=False)  # -> Message, Ghosts; disabled

# ----
# Make Parts
panel_15 = Panel("parts")  # disabled
json_block = Json_block(path=memberjointing.parts, layer=panel_15)  # -> block_definition_2, block_2, block_attributes_2, name_2, V; disabled
block_definition_6 = Data(json_block.block_definition_2)  # disabled
block_id_7 = Text(flatten(json_block.name_2))  # disabled
bakedata_7 = BakeData(
    text_style=list_10,
    block_id=block_id_7,
    block_label=block_id_7,
    bake_name=panel_15,
    spread=block_spread_ve,
    x_shift=part_x_shift,
    y_shift=y_shift_ve)  # -> block_instance, bake_name_3, text_2, text_bake_name; disabled
bake_13 = BakeObjects(Geometry=bakedata_7.block_instance, BakeName=bakedata_7.bake_name_3, Bake=False, createGroups=False)  # -> Message, Ghosts; disabled
bake_14 = BakeObjects(Geometry=bakedata_7.text_2, BakeName=bakedata_7.text_bake_name, Bake=False, createGroups=False)  # -> Message, Ghosts; disabled

# ----
# Show Text
element_blocks = Data(bakedata.text_2)  # disabled
element_group_blocks = Data(bakedata_3.text_2)  # disabled
member_blocks = Data(bakedata_4.text_2)  # disabled
member_group_blocks = Data(bakedata_6.text_2)  # disabled
jointing_pattern_blocks = Data(bakedata_2.text_2)  # disabled
part_blocks = Data(bakedata_7.text_2)  # disabled
cutting_pattern_blocks_2 = Data(bakedata_5.text_2)  # disabled
gate = StreamGate(Stream=element_blocks, Gate=show_elements)  # -> Target0, Target1; disabled
gate_2 = StreamGate(Stream=element_group_blocks, Gate=show_element_groups)  # -> Target0, Target1; disabled
gate_3 = StreamGate(Stream=member_blocks, Gate=show_members)  # -> Target0, Target1; disabled
gate_4 = StreamGate(Stream=member_group_blocks, Gate=show_member_groups)  # -> Target0, Target1; disabled
gate_5 = StreamGate(Stream=jointing_pattern_blocks, Gate=show_jointing_patterns)  # -> Target0, Target1; disabled
gate_6 = StreamGate(Stream=part_blocks, Gate=show_parts)  # -> Target0, Target1; disabled
gate_7 = StreamGate(Stream=cutting_pattern_blocks_2, Gate=show_cutting_patterns)  # -> Target0, Target1; disabled
merge_2 = Merge(
    Data1=gate.Target1,
    Data2=gate_2.Target1,
    Data3=gate_3.Target1,
    Data4=gate_4.Target1,
    Data5=gate_5.Target1,
    Data6=gate_6.Target1,
    Data7=gate_7.Target1)  # disabled
swatch_3 = ColourSwatch(SwatchColor=RGB(0, 0, 0))  # disabled
preview_3 = CustomPreview(Geometry=merge_2, Material=swatch_3)  # disabled

# ----
# Bake Blocks
jointing_pattern_blocks_2 = Data(block_definition_2)  # disabled
member_group_blocks_2 = Data(block_definition_5)  # disabled
element_group_blocks_2 = Data(block_definition_3)  # disabled
cutting_pattern_blocks_3 = Data(cutting_pattern_blocks)  # disabled
member_blocks_2 = Data(block_definition_4)  # disabled
element_blocks_2 = Data(block_definition)  # disabled
part_blocks_2 = Data(block_definition_6)  # disabled
toggle = BooleanToggle(True)  # disabled
merge_3 = Merge(
    Data1=element_blocks_2,
    Data2=element_group_blocks_2,
    Data3=member_blocks_2,
    Data4=member_group_blocks_2,
    Data5=jointing_pattern_blocks_2,
    Data6=part_blocks_2,
    Data7=cutting_pattern_blocks_3)  # -> flatten(Result); disabled
listblockd = ListBlocksInDocument(fullName=True)  # disabled
panel_16 = Panel(listblockd)  # disabled
pushblk = PushBlockDefinitions(Objects=flatten(merge_3), Activate=toggle, overwriteBlocks=True, activate=False, ValueTable_overwriteBlocks=False)  # -> Objects, Message; disabled

panel_17 = Panel("members_in_space")  # disabled
block_definition_7 = Data(flatten(json_member.block_definition_2))  # disabled
block_id_8 = Text(flatten(json_member.name_2))  # disabled
panel_18 = Panel(json_element_groups.V)  # disabled
panel_19 = Panel(json_element_groups_2.V)  # disabled

# ----
# Stage 3:
# Solve
solve_assignment = BooleanToggle(False)  # disabled
py3 = Python3Script(mediator=elementcutting.mediator, solve=solve_assignment)  # -> objective, jointing_results, cutting_results; inputs solve: Boolean; disabled
# ---------- py3: Python ----------
from cubbyhouse.opt import solve_ilp

if solve:
    objective, result_x, result_y, constraints = solve_ilp(mediator)

    jointing_results = mediator.export_jointing_results(result_x)
    cutting_results = mediator.export_cutting_results(result_y)
# ---------- end py3 ----------

# ----
# Stage 3 Visualiser
view_2d_cutting_soln = BooleanToggle(False)  # disabled
view_2d_jointing_soln = BooleanToggle(False)  # disabled
view_3d_jointing_soln = BooleanToggle(True)  # disabled
show_parts_pc = Slider(1, range=0..1)  # disabled

# ----
# Solver Result - Jointing Patterns (2D)
dejson = DeserializeJson(JSON=py3.jointing_results, OutputsLocked=False)  # disabled
dejson_2 = DeserializeJson(JSON=dejson, OutputsLocked=False)  # -> Member_id, Member_group_id, Jointing_pattern_id, Part_id, Part_count; disabled
panel_20 = Panel("jointing_results")  # disabled
concat = Concatenate(FragmentA=dejson_2.Member_id, FragmentB=" -> ", FragmentC=dejson_2.Jointing_pattern_id)  # disabled
panel_21 = Panel("0")  # disabled
panel_22 = Panel("200")  # disabled
bakedata_8 = BakeData(
    text_style=list_10,
    block_id=dejson_2.Jointing_pattern_id,
    block_label=concat,
    bake_name=panel_20,
    spread=panel_22,
    x_shift=bang_2.Branch0,
    y_shift=panel_21)  # -> block_instance, bake_name_3, text_2, text_bake_name; disabled
bake_15 = BakeObjects(Geometry=bakedata_8.block_instance, BakeName=bakedata_8.bake_name_3, Bake=False, createGroups=False)  # -> Message, Ghosts; disabled
bake_16 = BakeObjects(Geometry=bakedata_8.text_2, BakeName=bakedata_8.text_bake_name, Bake=False, createGroups=False)  # -> Message, Ghosts; disabled

# ----
# Solver Result - Cutting Patterns (2D)
dejson_3 = DeserializeJson(JSON=py3.cutting_results, OutputsLocked=False)  # disabled
dejson_4 = DeserializeJson(JSON=dejson_3, OutputsLocked=False)  # -> Element_id, Element_group_id, Cutting_pattern_id, Part_id, Part_count, Total_part_length, L, WW; disabled
panel_23 = Panel("cutting_results")  # disabled
panel_24 = Panel("0")  # disabled
concat_2 = Concatenate(FragmentA=dejson_4.Element_id, FragmentB=" -> ", FragmentC=dejson_4.Cutting_pattern_id)  # disabled
panel_25 = Panel("200")  # disabled
bakedata_9 = BakeData(
    text_style=list_10,
    block_id=dejson_4.Cutting_pattern_id,
    block_label=concat_2,
    bake_name=panel_23,
    spread=panel_25,
    x_shift=bang.Branch0,
    y_shift=panel_24)  # -> block_instance, bake_name_3, text_2, text_bake_name; disabled
bake_17 = BakeObjects(Geometry=bakedata_9.block_instance, BakeName=bakedata_9.bake_name_3, Bake=False, createGroups=False)  # -> Message, Ghosts; disabled
bake_18 = BakeObjects(Geometry=bakedata_9.text_2, BakeName=bakedata_9.text_bake_name, Bake=False, createGroups=False)  # -> Message, Ghosts; disabled

# ----
# Solver Result - Jointing Patterns (2D)
dejson_5 = DeserializeJson(JSON=py3.jointing_results, OutputsLocked=False)  # disabled
dejson_6 = DeserializeJson(JSON=dejson_5, OutputsLocked=False)  # -> Member_id, Member_group_id, Jointing_pattern_id, Part_id, Part_count; disabled
panel_26 = Panel("jointing_results")  # disabled
concat_3 = Concatenate(FragmentA=dejson_6.Member_id, FragmentB=" -> ", FragmentC=dejson_6.Jointing_pattern_id)  # disabled
panel_27 = Panel("0")  # disabled
panel_28 = Panel("200")  # disabled
bakedata_10 = BakeData(
    text_style=list_10,
    block_id=dejson_6.Jointing_pattern_id,
    block_label=concat_3,
    bake_name=panel_26,
    spread=panel_28,
    x_shift=bang_2.Branch0,
    y_shift=panel_27)  # -> block_instance, bake_name_3, text_2, text_bake_name; disabled
bake_19 = BakeObjects(Geometry=bakedata_10.block_instance, BakeName=bakedata_10.bake_name_3, Bake=False, createGroups=False)  # -> Message, Ghosts; disabled
bake_20 = BakeObjects(Geometry=bakedata_10.text_2, BakeName=bakedata_10.text_bake_name, Bake=False, createGroups=False)  # -> Message, Ghosts; disabled

# ----
# Colours
swatch_4 = ColourSwatch(SwatchColor=RGB(255, 255, 255))
panel_29 = Panel("""#03045e
#023e8a
#0077b6
#0096c7
#00b4d8
#48cae4
#90e0ef
#ade8f4
#caf0f8""")
panel_30 = Panel("""#582f0e
#7f4f24
#936639
#a68a64
#b6ad90
#c2c5aa
#a4ac86
#656d4a
#414833
#333d29""")
member_groups_per_jointing_pattern = Data(json_jps.V)
member_groups_per_member = Data(json_member.V)
jointing_pattern_soln = Data(dejson_6.Jointing_pattern_id)
null_colour = Colour(swatch_4)
browngreen = Colour(panel_30)
blues = Colour(panel_29)
rep = ReplaceText(Text=member_groups_per_jointing_pattern, Find="M", Replace="F", RecursiveReplace=False)
rep_2 = ReplaceText(Text=member_groups_per_member, Find="M", Replace="F", RecursiveReplace=False)
panel_31 = Panel("""3
5
7""")
panel_32 = Panel("""1
2
3""")
item = ListItem(List=blues, Index=panel_31, Wrap=True)
item_2 = ListItem(List=browngreen, Index=panel_32, Wrap=True)
rep_3 = ReplaceText(RecursiveReplace=False)
col = Colour(simplify(graft(item)))
stock_colours = Data(item_2)
colourmapper1 = Python3Script(
    section_groups=stockfromfile.section_group_ids,
    section_group_colours=stock_colours,
    section_groups_per_element_group=flatten(json_element_groups_2.V),
    element_group_id=flatten(json_element_groups_2.V_2),
    element_groups_per_element=flatten(json_element_groups.V),
    element_groups_per_cutting_pattern=flatten(json_cps.V),
    cutting_pattern_id=flatten(json_cps.name_2),
    section_groups_per_part=flatten(json_block.V),
    part_id=flatten(json_block.name_2),
    cutting_pattern_soln=dejson_4.Cutting_pattern_id,
    null_colour=null_colour)  # -> out, section_group_colour_mapper, element_group_colours, element_group_colour_mapper, element_colours, cutting_pattern_colours, part_colours, cutting_pattern_soln_colours, part_colour_mapper; inputs section_groups: list, section_group_colours: list, section_groups_per_element_group: list of String, element_group_id: list of String, element_groups_per_element: list of String, element_groups_per_cutting_pattern: list of String, cutting_pattern_id: list of String, section_groups_per_part: list of String, part_id: list of String, cutting_pattern_soln: list of String
# ---------- colourmapper1: Python ----------
"""Grasshopper Script"""
a = "Hello Python 3 in Grasshopper!"
print(a)

# section_groups = ["G1", "G2", "G3"]
section_group_colour_mapper = {}

for ind, section_group in enumerate(section_groups):
    section_group_colour_mapper[section_group] = section_group_colours[ind]

element_group_colours = []
element_group_colour_mapper ={} 
for loc, section_group in enumerate(section_groups_per_element_group):
    cur_col = section_group_colour_mapper[section_group]
    element_group_colours.append(cur_col)
    element_group_colour_mapper[element_group_id[loc]] = cur_col

element_colours = []
for element_group in element_groups_per_element:
    cur_col = element_group_colour_mapper[element_group]
    element_colours.append(cur_col)


cutting_pattern_colours = []
cutting_pattern_colour_mapper={}
for loc, element_group in enumerate(element_groups_per_cutting_pattern):
    cur_col = element_group_colour_mapper[element_group]
    cutting_pattern_colours.append(cur_col)
    cutting_pattern_colour_mapper[cutting_pattern_id[loc]] = cur_col

part_colours = []
part_colour_mapper = {}
for loc,section_group in enumerate(section_groups_per_part):
    cur_col = section_group_colour_mapper[section_group]
    part_colours.append(cur_col)
    part_colour_mapper[part_id[loc]] = cur_col

cutting_pattern_soln_colours = []
for cutting_pattern in cutting_pattern_soln:
    # print(cutting_pattern)
    if cutting_pattern == '':
        cutting_pattern_soln_colours.append(null_colour)
    else:
        cur_col = cutting_pattern_colour_mapper[cutting_pattern]
        cutting_pattern_soln_colours.append(cur_col)


print(element_group_colour_mapper)
section_group_colour_mapper=[section_group_colour_mapper]
part_colour_mapper=[part_colour_mapper]
# ---------- end colourmapper1 ----------
cutting_pattern_soln_colours = Data(colourmapper1.cutting_pattern_soln_colours)
framing_group_colours = Data(col)
colourmapper2 = Python3Script(
    framing_groups=structure.framing_group_ids,
    framing_group_colours=flatten(framing_group_colours),
    section_group_colour_mapper=colourmapper1.section_group_colour_mapper,
    framing_groups_per_jointing_pattern=flatten(rep),
    framing_groups_per_member=flatten(rep_2),
    mediator=cubbyhousemediator_2.mediator)  # -> out, jointing_pattern_colours, member_colours; inputs framing_groups: list, framing_group_colours: list, framing_groups_per_jointing_pattern: list, framing_groups_per_member: list
# ---------- colourmapper2: Python ----------
"""Grasshopper Script"""
# a = "Hello Python 3 in Grasshopper!"

# for ind, row in final_assignment.iterrows():
    # print/(ind)

# fg_mapper = dict(zip(final_assignment.index,final_assignment['section_groups']))

# print(fg_mapper)

final_assignment = mediator.dispatch_final_assignment

a = list(final_assignment.index)
b = list(final_assignment['section_group'])
final_assignment = dict(zip(a,b))


# print(final_assignment)
print(section_group_colour_mapper)

framing_group_colour_mapper = {}
for ind, framing_group in enumerate(framing_groups):
    framing_group_colour_mapper[framing_group] = framing_group_colours[ind]


section_groups = []
jointing_pattern_colours=[]
for framing_group in framing_groups_per_jointing_pattern:
    cur_section_group = final_assignment[framing_group]
    section_groups.append(cur_section_group)
    cur_colour=section_group_colour_mapper[cur_section_group]
    jointing_pattern_colours.append(cur_colour)

member_colours=[]
for framing_group in framing_groups_per_member:
    # cur_section_group = final_assignment[framing_group]
    # section_groups.append(cur_section_group)
    cur_colour=framing_group_colour_mapper[framing_group]
    member_colours.append(cur_colour)
# ---------- end colourmapper2 ----------
cutting_pattern_colours = Data(colourmapper1.cutting_pattern_colours)
element_group_colours = Data(colourmapper1.element_group_colours)
element_colours = Data(colourmapper1.element_colours)
part_colours = Data(colourmapper1.part_colours)
jointing_pattern_colours = Data(colourmapper2.jointing_pattern_colours)
member_colours = Data(colourmapper2.member_colours)

# ----
# Framing Groups 3D - Case 1
target_plane = Plane(cluster)
mediator = Data(cubbyhousemediator_2.mediator)
show_framing_groups = BooleanToggle(True)
cluster_2 = Cluster(target_plane=target_plane, mediator=mediator)  # -> framing_group_srf_2, permissible_joints, permissible_joint_ordinate
framing_group_colours_2 = Data(framing_group_colours)
show_framing_groups_2 = Boolean(show_framing_groups)
framing_group_srf = Surface(cluster_2.framing_group_srf_2)
permissible_joints = Line(cluster_2.permissible_joints)
filter = StreamFilter(Gate=show_framing_groups_2, Stream1=framing_group_srf)
filter_2 = StreamFilter(Gate=show_framing_groups_2, Stream1=permissible_joints)
preview_4 = CustomPreview(Geometry=filter, Material=framing_group_colours_2)
preview_5 = CustomPreview(Geometry=filter_2, Material=ColourSwatch(SwatchColor=RGB(38, 28, 2)))

# ----
# Short Stock Chart
graph_attributes_3 = Data(graph_attributes)
stock_colours_2 = Data(stock_colours)
view_graph_3 = Boolean(and)
shortlengthchart = ShortLengthChart(show=view_graph_3, mediator=cubbyhousemediator_2.mediator, graph_attributes=graph_attributes_3)  # -> allocated_graph_text_3, allocated_bar_chart_3
outline = Curve(shortlengthchart.allocated_bar_chart_3)
preview_6 = CustomPreview(Geometry=shortlengthchart.allocated_graph_text_3, Material=ColourSwatch(SwatchColor=RGB(64, 64, 64)))
preview_7 = CustomPreview(Geometry=shortlengthchart.allocated_bar_chart_3, Material=ColourSwatch(SwatchColor=RGB(46, 46, 46)))

# ----
# Allocated Stock Length Chart
graph_attributes_4 = Data(graph_attributes)
stock_colours_3 = Data(stock_colours)
view_graph_4 = Boolean(view_graph)
allocatedlengthchart = AllocatedLengthChart(show=view_graph_4, mediator=cubbyhousemediator_2.mediator, graph_attributes=graph_attributes_4)  # -> allocated_graph_text_3, allocated_bar_chart_3
outline_2 = Curve(allocatedlengthchart.allocated_bar_chart_3)
preview_8 = CustomPreview(Geometry=allocatedlengthchart.allocated_bar_chart_3, Material=stock_colours_3)
preview_9 = CustomPreview(Geometry=[allocatedlengthchart.allocated_graph_text_3, outline_2], Material=ColourSwatch(SwatchColor=RGB(0, 0, 0)))

# ----
# Member Locations
rotate_section_2 = Boolean(rotate_section)
framing_group_plane = Plane(target_plane)
cluster_3 = Cluster_3(mediator=cubbyhousemediator_2.mediator, target_plane=framing_group_plane, rotate_section=rotate_section_2)  # -> member_loc_planes, member_locations_2, member_length_check, member_loc_planes_excl_trans_lams
show_framing = Boolean(show_framing_groups)
panel_33 = Panel(cluster_3.member_length_check)
filter_3 = StreamFilter(Gate=show_framing, Stream1=cluster_3.member_locations_2)
preview_10 = CustomPreview(Geometry=filter_3, Material=ColourSwatch(SwatchColor=RGB(112, 112, 112)))

# ----
# Required Member Length Graph
graph_attributes_5 = Data(graph_attributes)
view_graph_5 = Boolean(view_graph)
framing_group_colours_3 = Data(framing_group_colours)
requiredlengthchart = RequiredLengthChart(show=view_graph_5, mediator=cubbyhousemediator_2.mediator, graph_attributes=graph_attributes_5)  # -> req_graph_text_2, req_bar_chart_2, vertical_axis_2
outline_3 = Curve(requiredlengthchart.req_bar_chart_2)
preview_11 = CustomPreview(Geometry=requiredlengthchart.req_bar_chart_2, Material=framing_group_colours_3)
preview_12 = CustomPreview(Geometry=[requiredlengthchart.req_graph_text_2, outline_3], Material=ColourSwatch(SwatchColor=RGB(0, 0, 0)))

# ----
# Show Blocks
jointing_pattern_colours_2 = Data(simplify(graft(jointing_pattern_colours)))  # disabled
cutting_pattern_colours_2 = Data(simplify(graft(cutting_pattern_colours)))  # disabled
element_group_colours_2 = Data(simplify(graft(element_group_colours)))  # disabled
member_colours_2 = Data(simplify(graft(member_colours)))  # disabled
element_colours_2 = Data(simplify(graft(element_colours)))  # disabled
framing_group_colours_4 = Data(framing_group_colours)  # disabled
jointing_pattern_blocks_3 = Data(bakedata_2.block_instance)  # disabled
member_group_blocks_3 = Data(bakedata_6.block_instance)  # disabled
cutting_pattern_blocks_4 = Data(bakedata_5.block_instance)  # disabled
element_group_blocks_3 = Data(bakedata_3.block_instance)  # disabled
part_colours_2 = Data(simplify(graft(part_colours)))  # disabled
member_blocks_3 = Data(bakedata_4.block_instance)  # disabled
element_blocks_3 = Data(bakedata.block_instance)  # disabled
part_blocks_3 = Data(bakedata_7.block_instance)  # disabled
gate_8 = StreamGate(Stream=cutting_pattern_blocks_4, Gate=show_cutting_patterns)  # -> Target0, Target1; disabled
gate_9 = StreamGate(Stream=element_blocks_3, Gate=show_elements)  # -> Target0, Target1; disabled
gate_10 = StreamGate(Stream=member_blocks_3, Gate=show_members)  # -> Target0, Target1; disabled
gate_11 = StreamGate(Stream=member_group_blocks_3, Gate=show_member_groups)  # -> Target0, Target1; disabled
gate_12 = StreamGate(Stream=jointing_pattern_blocks_3, Gate=show_jointing_patterns)  # -> Target0, Target1; disabled
gate_13 = StreamGate(Stream=part_blocks_3, Gate=show_parts)  # -> Target0, Target1; disabled
gate_14 = StreamGate(Stream=element_group_blocks_3, Gate=show_element_groups)  # -> Target0, Target1; disabled
preview_13 = CustomPreview(Geometry=gate_13.Target1, Material=part_colours_2)  # disabled
expblock = ExplodeBlock(Block=gate_14.Target1, recursive=False)  # -> Name, Transform, Geometry; disabled
preview_14 = CustomPreview(Geometry=gate_11.Target1, Material=framing_group_colours_4)  # disabled
preview_15 = CustomPreview(Geometry=gate_10.Target1, Material=member_colours_2)  # disabled
preview_16 = CustomPreview(Geometry=gate_9.Target1, Material=element_colours_2)  # disabled
explode = ExplodeObject(Object=expblock.Geometry, Recursive=False)  # disabled
expblock_2 = ExplodeBlock(Block=gate_12.Target1, recursive=False)  # -> Name, Transform, Geometry; disabled
expblock_3 = ExplodeBlock(Block=gate_8.Target1, recursive=False)  # -> Name, Transform, Geometry; disabled
crv = Curve(explode)  # disabled
split = SplitList(List=expblock_2.Geometry, Index=1)  # -> ListA, ListB; disabled
swatch_5 = ColourSwatch(SwatchColor=RGB(0, 0, 0))  # disabled
swatch_6 = ColourSwatch(SwatchColor=RGBA(214, 209, 188, 147))  # disabled
split_2 = SplitList(List=expblock_3.Geometry, Index=1)  # -> ListA, ListB; disabled
merge_4 = Merge(Data1=split.ListA, Data2=split_2.ListA)  # disabled
preview_17 = CustomPreview(Geometry=gate_14.Target1, Material=element_group_colours_2)  # disabled
preview_18 = CustomPreview(Geometry=crv, Material=swatch_5)  # disabled
preview_19 = CustomPreview(Geometry=simplify(split_2.ListB), Material=cutting_pattern_colours_2)  # disabled
preview_20 = CustomPreview(Geometry=merge_4, Material=swatch_6)  # disabled
preview_21 = CustomPreview(Geometry=simplify(split.ListB), Material=jointing_pattern_colours_2)  # disabled
swatch_7 = ColourSwatch(SwatchColor=RGB(145, 127, 9))  # disabled

preview_22 = CustomPreview(Geometry=gate_9.Target1, Material=swatch_2)  # disabled
member_loc_planes = Plane(flatten(cluster_3.member_loc_planes_excl_trans_lams))  # disabled
bakeinspace = BakeInSpace(
    text_style=list_10,
    block_id=block_id_8,
    block_label=block_definition_7,
    bake_name=panel_17,
    target_plane=member_loc_planes)  # -> block_instance, bake_name_3, text_2, text_bake_name; disabled
member_colours_3 = Data(simplify(graft(member_colours)))  # disabled
member_blocks_4 = Data(simplify(graft(bakeinspace.block_instance)))  # disabled
gate_15 = StreamGate(Stream=member_blocks_4, Gate=show_members_3d)  # -> Target0, Target1; disabled
preview_23 = CustomPreview(Geometry=gate_15.Target1, Material=member_colours_3)  # disabled

# ----
# Solver Result - Jointing Patterns (3D)
panel_34 = Panel("jointing_results_in_space")  # disabled
member_loc_planes_2 = Plane(flatten(cluster_3.member_loc_planes_excl_trans_lams))  # disabled
bakeinspace_2 = BakeInSpace(
    text_style=list_10,
    block_id=dejson_2.Jointing_pattern_id,
    block_label=concat,
    bake_name=panel_34,
    target_plane=member_loc_planes_2)  # -> block_instance, bake_name_3, text_2, text_bake_name; disabled
bake_21 = BakeObjects(Geometry=bakeinspace_2.block_instance, BakeName=bakeinspace_2.bake_name_3, Bake=False, createGroups=False)  # -> Message, Ghosts; disabled
bake_22 = BakeObjects(Geometry=bakeinspace_2.text_2, BakeName=bakeinspace_2.text_bake_name, Bake=False, createGroups=False)  # -> Message, Ghosts; disabled

swatch_8 = ColourSwatch(SwatchColor=RGBA(184, 121, 121, 48))  # disabled
number_slider = Slider(93, range=0..93)  # disabled
swatch_9 = ColourSwatch(SwatchColor=RGBA(214, 209, 188, 147))  # disabled

# ----
# View Pattern Solution - Full Pattern
# (remove first nested block - element or member) remaining blocks are parts
cutting_pattern_soln_colours_2 = Data(simplify(graft(cutting_pattern_soln_colours)))  # disabled
cutting_patterns = Data(bakedata_9.text_2)  # disabled
jointing_patterns = Data(bakedata_10.text_2)  # disabled
cutting_patterns_2 = Data(bakedata_9.block_instance)  # disabled
jointing_patterns_2 = Data(bakedata_10.block_instance)  # disabled
expblock_4 = ExplodeBlock(Block=jointing_patterns_2, recursive=False)  # -> Name, Transform, Geometry; disabled
expblock_5 = ExplodeBlock(Block=cutting_patterns_2, recursive=False)  # -> Name, Transform, Geometry; disabled
cull_i = CullIndex(List=expblock_5.Geometry, Indices=0, Wrap=True)  # disabled
cull_i_2 = CullIndex(List=expblock_4.Geometry, Indices=0, Wrap=True)  # disabled
swatch_10 = ColourSwatch(SwatchColor=RGB(35, 102, 161))  # disabled
gate_16 = StreamGate(Stream=jointing_patterns, Gate=view_2d_jointing_soln)  # -> Target0, Target1; disabled
swatch_11 = ColourSwatch(SwatchColor=RGB(0, 0, 0))  # disabled
gate_17 = StreamGate(Stream=cull_i, Gate=view_2d_jointing_soln)  # -> Target0, Target1; disabled
gate_18 = StreamGate(Stream=cutting_patterns, Gate=view_2d_cutting_soln)  # -> Target0, Target1; disabled
swatch_12 = ColourSwatch(SwatchColor=RGB(0, 0, 0))  # disabled
gate_19 = StreamGate(Stream=cull_i_2, Gate=view_2d_jointing_soln)  # -> Target0, Target1; disabled
preview_24 = CustomPreview(Geometry=gate_16.Target1, Material=swatch_11)  # disabled
preview_25 = CustomPreview(Geometry=gate_18.Target1, Material=swatch_12)  # disabled
preview_26 = CustomPreview(Geometry=gate_17.Target1, Material=swatch_9)  # disabled
preview_27 = CustomPreview(Geometry=gate_19.Target1, Material=swatch_10)  # disabled

swatch_13 = ColourSwatch(SwatchColor=RGB(0, 0, 0))  # disabled
txt = Text("-")  # disabled
number_slider_2 = Slider(90, range=0..100)  # disabled
Y = UnitY(Factor=number_slider_2)  # disabled
xy = XYPlane(Origin=Y)  # disabled
Z = UnitZ(Factor=40)  # disabled
Z_2 = UnitZ(Factor=80)  # disabled

# ----
# View Pattern Solution - Part Order (3D)
# Note: number cutting parts > number jointing parts as some parts are unused
part_colour_mapper = Data(colourmapper1.part_colour_mapper)  # disabled
jointing_patterns_3 = Data(bakedata_10.block_instance)  # disabled
cutting_patterns_3 = Data(bakedata_9.block_instance)  # disabled
expblock_6 = ExplodeBlock(Block=jointing_patterns_3, recursive=False)  # -> Name, Transform, Geometry; disabled
expblock_7 = ExplodeBlock(Block=cutting_patterns_3, recursive=False)  # -> Name, Transform, Geometry; disabled
cull_i_3 = CullIndex(List=expblock_6.Geometry, Indices=0, Wrap=True)  # disabled
cull_i_4 = CullIndex(List=expblock_7.Geometry, Indices=0, Wrap=True)  # disabled
expblock_8 = ExplodeBlock(Block=simplify(cull_i_3), recursive=False)  # -> Name, Transform, Geometry; disabled
expblock_9 = ExplodeBlock(Block=simplify(cull_i_4), recursive=False)  # -> Name, Transform, Geometry; disabled
data = Data(flatten(expblock_9.Name))  # disabled
data_2 = Data(flatten(expblock_9.Geometry))  # disabled
data_3 = Data(flatten(expblock_8.Geometry))  # disabled
data_4 = Data(flatten(expblock_8.Name))  # disabled
py3_2 = Python3Script(list_cp=data, list_jp=data_4, part_colour_mapper=part_colour_mapper)  # -> out, mapping, locations, part_colours; inputs list_cp: list, list_jp: list; disabled
# ---------- py3_2: Python ----------
# Define the two lists
# list_cp = ["P4", "P5", "P5", "P1", "P1", "P1", "P1", "P1", "P1"]
# list_jp = ["P0", "P3", "P14", "P0", "P3", "P14", "P0", "P3", "P14", "P0"]
from math import nan

# Function to map locations based on occurrence
def map_locations(list_cp, list_jp):
    # Track index positions of each part in list_jp
    index_map = {}
    for idx, part in enumerate(list_cp):
        if part not in index_map:
            index_map[part] = []
        index_map[part].append(idx)

    # Track occurrences of parts in list_cp and map to list_jp indices
    part_count = {}
    result = []

    for part in list_jp:
        if part not in part_count:
            part_count[part] = 0
        part_count[part] += 1

        # If the part exists in list_jp and there's an available occurrence
        if part in index_map and part_count[part] <= len(index_map[part]):
            corresponding_index = index_map[part][part_count[part] - 1]
            result.append((part, corresponding_index))
        else:
            # If no match exists, indicate "Not Found"
            result.append((part, nan))
            ...
    return result

# Run the function and store results
mapping = map_locations(list_cp, list_jp)

locations=[]
part_names = []
# Display results
part_colours =[]
print(part_colour_mapper)
# print("Element in List1", "Corresponding Index in List2")
for item in mapping:
    locations.append(item[1])
    cur_part_name = item[0]
    part_names.append(cur_part_name)
    print(cur_part_name)
    part_colours.append(part_colour_mapper[item[0]])
    # print(f"{item[0]:<16} {item[1]}")
# ---------- end py3_2 ----------
py3_3 = Python3Script(list1=data_4, list2=data, part_colour_mapper=part_colour_mapper)  # -> out, mapping, locations, part_names, part_colours; inputs list1: list, list2: list; disabled
# ---------- py3_3: Python ----------
# Define the two lists
# list1 = ["P4", "P5", "P5", "P1", "P1", "P1", "P1", "P1", "P1"]
# list2 = ["P0", "P3", "P14", "P0", "P3", "P14", "P0", "P3", "P14", "P0"]
from math import nan

# Function to map locations based on occurrence
def map_locations(list1, list2):
    # Track index positions of each element in list2
    index_map = {}
    for idx, element in enumerate(list2):
        if element not in index_map:
            index_map[element] = []
        index_map[element].append(idx)

    # Track occurrences of elements in list1 and map to list2 indices
    element_count = {}
    result = []

    for element in list1:
        if element not in element_count:
            element_count[element] = 0
        element_count[element] += 1

        # If the element exists in list2 and there's an available occurrence
        if element in index_map and element_count[element] <= len(index_map[element]):
            corresponding_index = index_map[element][element_count[element] - 1]
            result.append((element, corresponding_index))
        else:
            # If no match exists, indicate "Not Found"
            result.append((element, nan))
            ...
    return result

# Run the function and store results
mapping = map_locations(list1, list2)

locations=[]
part_names = []
# Display results
part_colours =[]
print(part_colour_mapper)
# print("Element in List1", "Corresponding Index in List2")
for item in mapping:
    locations.append(item[1])
    cur_part_name = item[0]
    part_names.append(cur_part_name)
    print(cur_part_name)
    part_colours.append(part_colour_mapper[item[0]])
    # print(f"{item[0]:<16} {item[1]}")
# ---------- end py3_3 ----------
item_3 = ListItem(List=data_3, Index=py3_2.locations, Wrap=True)  # disabled
lng = ListLength(List=item_3)  # disabled
remap = RemapNumbers(Value=show_parts_pc, Source=Domain(0, 1), Target=lng)  # -> Mapped, Clipped; disabled
item_4 = ListItem(List=data_2, Index=py3_3.locations, Wrap=True)  # disabled
int = Integer(remap.Mapped)  # disabled
split_3 = SplitList(List=py3_2.part_colours, Index=number_slider)  # -> ListA, ListB; disabled
split_4 = SplitList(List=item_4, Index=number_slider)  # -> ListA, ListB; disabled
split_5 = SplitList(List=data_3, Index=number_slider)  # -> ListA, ListB; disabled
element_blocks_4 = Data(bakedata.block_instance)  # disabled
jointing_parts = Data(split_5.ListA)  # disabled
cutting_parts = Data(split_4.ListA)  # disabled
swatch_14 = ColourSwatch(SwatchColor=RGBA(214, 209, 188, 147))  # disabled
text_style = Data(list_10)  # disabled
and_2 = GateAnd(A=view_2d_cutting_soln, B=view_2d_jointing_soln)  # disabled
gate_20 = StreamGate(Stream=element_blocks_4, Gate=view_2d_cutting_soln)  # -> Target0, Target1; disabled
gate_21 = StreamGate(Stream=jointing_parts, Gate=view_2d_jointing_soln)  # -> Target0, Target1; disabled
gate_22 = StreamGate(Stream=cutting_parts, Gate=view_2d_cutting_soln)  # -> Target0, Target1; disabled
swatch_15 = ColourSwatch(SwatchColor=RGB(0, 0, 0))  # disabled
swatch_16 = ColourSwatch(SwatchColor=RGB(0, 0, 0))  # disabled
preview_28 = CustomPreview(Geometry=gate_21.Target1, Material=split_3.ListA)  # disabled
preview_29 = CustomPreview(Geometry=gate_20.Target1, Material=swatch_14)  # disabled

# ----
# View Pattern Solution - Part Order (3D)
jointing_patterns_4 = Data(bakeinspace_2.block_instance)  # disabled
expblock_10 = ExplodeBlock(Block=jointing_patterns_4, recursive=False)  # -> Name, Transform, Geometry; disabled
cull_i_5 = CullIndex(List=expblock_10.Geometry, Indices=0, Wrap=True)  # disabled
expblock_11 = ExplodeBlock(Block=simplify(cull_i_5), recursive=False)  # -> Name, Transform, Geometry; disabled
data_5 = Data(flatten(expblock_11.Geometry))  # disabled
split_6 = SplitList(List=data_5, Index=number_slider)  # -> ListA, ListB; disabled
jointing_parts_2 = Data(split_6.ListA)  # disabled
gate_23 = StreamGate(Stream=jointing_parts_2, Gate=view_3d_jointing_soln)  # -> Target0, Target1; disabled
preview_30 = CustomPreview(Geometry=gate_23.Target1, Material=split_3.ListA)  # disabled

explode_2 = ExplodeObject(Object=gate_23.Target1, Recursive=False)  # disabled
crv_2 = Curve(explode_2)  # disabled
split_7 = SplitList(List=py3_3.part_names, Index=number_slider)  # -> ListA, ListB; disabled
preview_31 = CustomPreview(Geometry=crv_2, Material=swatch_13)  # disabled
item_5 = ListItem(List=jointing_parts, Index=-1, Wrap=True)  # disabled
item_6 = ListItem(List=split_7.ListA, Index=-1, Wrap=True)  # disabled
item_7 = ListItem(List=cutting_parts, Index=-1, Wrap=True)  # disabled
merge_5 = Merge(Data1=txt, Data2=py3_3.part_names)  # disabled
item_8 = ListItem(List=flatten(merge_5), Index=number_slider, Wrap=True)  # disabled
text = DefineTextObject(Text=simplify(graft(number_slider)), Plane=xy, DimensionStyle=text_style)  # disabled
data_6 = Data(text)  # disabled
preview_32 = CustomPreview(Geometry=data_6, Material=swatch_15)  # disabled
move = Move(Geometry=gate_22.Target1, Motion=Z)  # -> Geometry, Transform; disabled

brep = Brep(item_5)  # disabled
brep_2 = Brep(item_7)  # disabled
bbox = BoundingBox(Content=brep, Plane=PlaneXY(0, 0, 0), UnionBox=True)  # -> Box, Box_2; disabled
bbox_2 = BoundingBox(Content=brep_2, Plane=PlaneXY(0, 0, 0), UnionBox=True)  # -> Box, Box_2; disabled
box = EvaluateBox(Box=bbox.Box, UParameter=0.5, VParameter=0.5, WParameter=0.5)  # -> Plane, Point, Include; disabled
box_2 = EvaluateBox(Box=bbox_2.Box, UParameter=0.5, VParameter=0.5, WParameter=0.5)  # -> Plane, Point, Include; disabled
text_2 = DefineTextObject(Text=simplify(graft(item_8)), Plane=PlaneXY(0, 0, 0), DimensionStyle=text_style)  # disabled
ln = Line(StartPoint=box.Point, EndPoint=box_2.Point)  # disabled
gate_24 = StreamGate(Stream=ln, Gate=and_2)  # -> Target0, Target1; disabled
data_7 = Data(text_2)  # disabled
preview_33 = CustomPreview(Geometry=data_7, Material=swatch_15)  # disabled
preview_34 = CustomPreview(Geometry=move.Geometry, Material=split_3.ListA)  # disabled

move_2 = Move(Geometry=gate_24.Target1, Motion=Z_2)  # -> Geometry, Transform; disabled

preview_35 = CustomPreview(Geometry=move_2.Geometry, Material=swatch_16)  # disabled

# ==== cluster Cluster
mediator = ClusterInput()
mediator_2 = Data(mediator)
py3 = Python3Script(mediator=mediator_2)  # -> framing_groups
# ---------- py3: Python ----------
framing_groups=list(mediator.structure.framing_groups.values())
# ---------- end py3 ----------
py3_2 = Python3Script(framing_group=simplify(graft(py3)))  # -> framing_group_id, length, width, max_parts_per_length, simplify(permissible_joints)
# ---------- py3_2: Python ----------
framing_group_id = framing_group.name
length=framing_group.length
width=framing_group.width
# design_parameters=framing_group..design_parameters
max_parts_per_length=framing_group.max_parts_per_length

permissible_joints = framing_group.discrete_joints.ordinates
permissible_joints=[float(x) for x in permissible_joints]

print(permissible_joints)
# ---------- end py3_2 ----------
number_slider = Slider(200, range=0..200)
number_slider_2 = Slider(50, range=0..100)
addition = Addition(B=number_slider_2)
addition_2 = Addition(B=number_slider)
neg = Negative(Value=number_slider_2)
neg_2 = Negative(Value=number_slider)
Y = UnitY(Factor=py3_2.permissible_joints)
panel = Panel(py3_2.length)
pt = ConstructPoint(XCoordinate=0, YCoordinate=neg, ZCoordinate=0)
pt_2 = ConstructPoint(XCoordinate=0, YCoordinate=neg_2, ZCoordinate=0)
pt_3 = ConstructPoint(XCoordinate=py3_2.length, YCoordinate=py3_2.width, ZCoordinate=0)
target_plane = ClusterInput()
rec_2pt = Rectangle2Pt(Plane=PlaneXY(0, 0, 0), PointA=Point(0, 0, 0), PointB=pt_3, Radius=0)  # -> Rectangle, Length
X = UnitX(Factor=py3_2.permissible_joints)
ln = Line(StartPoint=pt, EndPoint=pt_2)
permissible_joint_ordinate = ClusterOutput(Y)
move = Move(Geometry=ln, Motion=X)  # -> Geometry, Transform
framing_group_srf = Surface(rec_2pt.Rectangle)
target_plane_2 = Plane(target_plane)
orient = Orient(Geometry=move.Geometry, Source=PlaneXY(0, 0, 0), Target=target_plane_2)  # -> Permissible_joints, Transform
orient_2 = Orient(Geometry=framing_group_srf, Source=PlaneXY(0, 0, 0), Target=target_plane_2)  # -> Framing_group_srf, Transform
framing_group_srf_2 = ClusterOutput(orient_2.Framing_group_srf)
permissible_joints = ClusterOutput(orient.Permissible_joints)

# ==== cluster Cluster_2
z_spread = ClusterInput()
corner_pt = ClusterInput()
flip_xy = ClusterInput()
z_spread_2 = Number(z_spread)
panel = Panel("-100")
flip_xy_2 = Boolean(flip_xy)
lng = ListLength(List=flip_xy_2)
corner_pt_2 = Point(corner_pt)
series = Series(Start=0, Step=z_spread_2, Count=lng)
Z = UnitZ(Factor=series)
addition = Addition(A=flatten(corner_pt_2), B=flatten(Z))
X = UnitX(Factor=1)
X_2 = UnitX(Factor=1)
Y = UnitY(Factor=1)
Y_2 = UnitY(Factor=1)
pl = ConstructPlane(Origin=addition, XAxis=X, YAxis=Y)
pl_2 = ConstructPlane(Origin=addition, XAxis=Y_2, YAxis=X_2)
p_n_c = PickNChoose(Pattern=flatten(flip_xy_2), Stream0=pl, Stream1=pl_2)  # -> simplify(graft(Target_plane))
target_plane = ClusterOutput(p_n_c)

# ==== cluster Cluster_3
mediator = ClusterInput()
rotate_section = ClusterInput()
mediator_2 = Data(mediator)
py3 = Python3Script(mediator=mediator_2)  # -> out, simplify(flatten(framing_group_ids)), simplify(flatten(assigned_section_group))
# ---------- py3: Python ----------
print(mediator.dispatch_matrix)
first_nonzero_idx = (mediator.dispatch_matrix != 0).idxmax()

print(first_nonzero_idx)

framing_group_ids = list(first_nonzero_idx.index)
assigned_section_group=list(first_nonzero_idx.values)
# ---------- end py3 ----------
rotate_section_2 = Boolean(rotate_section)
panel = Panel(py3.framing_group_ids)
panel_2 = Panel(py3.assigned_section_group)
memberqty = Python3Script(mediator=mediator_2, framing_group_name=py3.framing_group_ids, section_group_name=py3.assigned_section_group)  # -> spacing, qty, lam_y, length, simplify(member_locs)
# ---------- memberqty: Python ----------
from numpy import arange
# spacing = mediator.element_group_spacing_df.at[section_group_name,framing_group_name]
# spacing = float(spacing)
qty = mediator.section_group_quantity_df.at[section_group_name,framing_group_name]
qty = int(qty)
framing_group = mediator.structure.framing_groups[framing_group_name]
lam_y = framing_group.transverse_laminations
lam_y= int(lam_y)
length = framing_group.length


member_locs = mediator.member_location_df.at[section_group_name,framing_group_name]
# ---------- end memberqty ----------
target_plane = ClusterInput()
member_locs = Data(simplify(memberqty.member_locs))
X = UnitX(Factor=1)
Y = UnitY(Factor=member_locs)
item = ListItem(List=memberqty.qty, Index=0, Wrap=True)
member_ordinates = Vector(Y)
panel_3 = Panel(memberqty.qty)
memberlocs = MemberLocs(
    member_ordinates=member_ordinates,
    target_plane=target_plane,
    lam_y=simplify(graft(memberqty.lam_y)),
    length=simplify(graft(memberqty.length)),
    rotate_section=rotate_section_2)  # -> simplify(member_locs_3), member_loc_planes, member_loc_planes_excl_trans_lams
len = Length(Curve=memberlocs.member_locs_3)
ma = MassAddition(Input=len)  # -> flatten(Member_length_check), PartialResults
# TODO: lam_y >1
data = Data(memberlocs.member_loc_planes)
deplane = DeconstructPlane(Plane=data)  # -> Origin, XAxis, YAxis, ZAxis
number_slider = Slider(10, range=0..10)
member_locs_2 = Line(memberlocs.member_locs_3)
member_loc_planes = ClusterOutput(memberlocs.member_loc_planes)
member_length_check = ClusterOutput(ma.Member_length_check)
panel_4 = Panel(deplane.XAxis)
Z = UnitZ(Factor=expr("2*x", number_slider))
pipe = Pipe(Curve=member_locs_2, Radius=number_slider, Caps=1)
panel_5 = Panel(member_locs_2)
cap = CapHoles(Brep=pipe)
move = Move(Geometry=simplify(pipe), Motion=Z)  # -> simplify(Geometry), Transform
member_loc_planes_excl_trans_lams = ClusterOutput(memberlocs.member_loc_planes_excl_trans_lams)
member_locations = Geometry(move.Geometry)
member_locations_2 = ClusterOutput(member_locations)

# ==== cluster Json_element_groups
path = ClusterInput()
dejson = DeserializeJson(JSON=path, OutputsLocked=False)
data = Data(simplify(graft(dejson)))
dejson_2 = DeserializeJson(JSON=data, OutputsLocked=False)  # -> Element_id, D, B, L, Element_group_id
element_group_id = Panel("element_group_id")
dejsonkv = DeserializeKeysAndValues(JSON=data)  # -> simplify(Key), simplify(Value)
dejsonkv_2 = DeserializeKeysAndValues(JSON=data, Keys="D")  # -> simplify(Key), simplify(Value)
dejsonkv_3 = DeserializeKeysAndValues(JSON=data, Keys="B")  # -> simplify(Key), simplify(Value)
dejsonkv_4 = DeserializeKeysAndValues(JSON=data, Keys="L")  # -> simplify(Key), simplify(Value)
dejsonkv_5 = DeserializeKeysAndValues(JSON=data, Keys="element_id")  # -> simplify(Key), simplify(Value)
dejsonkv_6 = DeserializeKeysAndValues(JSON=data, Keys=element_group_id)  # -> simplify(Key), simplify(Value)
keysearch = KeyValueSearch(Keys=dejsonkv.Key, Values=dejsonkv.Value, FullLayerName="FullLayerName")  # disabled
keysearch_2 = KeyValueSearch(Keys=dejsonkv.Key, Values=dejsonkv.Value, MaterialName="MaterialName")  # disabled
cuboid = Cuboid(length=dejsonkv_4.Value, width=dejsonkv_2.Value, thickness=dejsonkv_3.Value)  # -> cross_section_2, solid
# Make Block (Single Instance)
ef_att = EleFrontAttributes(Keys=dejsonkv.Key, Values=dejsonkv.Value, ColourSource="Object", ObjectColour=ColourSwatch(SwatchColor=RGB(94, 94, 94)))  # -> Attributes, Keys, Values, Name, Layer, ColourSource, DisplayColour, MaterialSource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
panel = Panel(dejsonkv_5.Value)
xy = XYPlane(Origin=Point(0, 0, 0))
# Make Block Definition (Geom Only)
defembed = DefineEmbeddedBlock(Geometry=cuboid.solid, Attributes=ef_att.Attributes, BlockName=dejsonkv_5.Value, BasePlane=PlaneXY(0, 0, 0))
V = ClusterOutput(dejsonkv_6.Value)
insert = InsertBlock(BlockName=dejsonkv_5.Value, Plane=xy)
block_definition = Data(defembed)
block_attributes = Data(ef_att.Attributes)
block = Data(insert)
V_2 = ClusterOutput(dejsonkv_5.Value)
block_definition_2 = ClusterOutput(block_definition)
block_2 = ClusterOutput(block)
block_attributes_2 = ClusterOutput(block_attributes)

# ==== cluster Json_element_groups_2
path = ClusterInput()
dejson = DeserializeJson(JSON=path, OutputsLocked=False)
data = Data(simplify(graft(dejson)))
dejson_2 = DeserializeJson(JSON=data, OutputsLocked=False)  # -> Size, Grade, D, B, L, Qty, Batch, L_total, Section_group, Element_group_id
panel = Panel(dejson_2.Section_group)
dejsonkv = DeserializeKeysAndValues(JSON=data)  # -> simplify(Key), simplify(Value)
keysearch = KeyValueSearch(Keys=dejsonkv.Key, Values=dejsonkv.Value, FullLayerName="FullLayerName")  # disabled
keysearch_2 = KeyValueSearch(Keys=dejsonkv.Key, Values=dejsonkv.Value, MaterialName="MaterialName")  # disabled
dejsonkv_2 = DeserializeKeysAndValues(JSON=data, Keys="D")  # -> simplify(Key), simplify(Value)
dejsonkv_3 = DeserializeKeysAndValues(JSON=data, Keys="B")  # -> simplify(Key), simplify(Value)
dejsonkv_4 = DeserializeKeysAndValues(JSON=data, Keys="qty")  # -> simplify(Key), simplify(Value)
dejsonkv_5 = DeserializeKeysAndValues(JSON=data, Keys="section_group")  # -> simplify(Key), simplify(Value)
dejsonkv_6 = DeserializeKeysAndValues(JSON=data, Keys="element_group_id")  # -> simplify(Key), simplify(Value)
dejsonkv_7 = DeserializeKeysAndValues(JSON=data, Keys="L")  # -> simplify(Key), simplify(Value)
dejsonkv_8 = DeserializeKeysAndValues(JSON=data, Keys="element_group_id_and_qty")  # -> simplify(Key), simplify(Value)
dejsonkv_9 = DeserializeKeysAndValues(JSON=data, Keys="element_group_id")  # -> simplify(Key), simplify(Value)
series = Series(Start=0, Step=dejsonkv_3.Value, Count=dejsonkv_4.Value)  # -> simplify(Series)
cuboid = Cuboid(length=dejsonkv_7.Value, width=dejsonkv_2.Value, thickness=dejsonkv_3.Value)  # -> cross_section_2, solid
concat = Concatenate(FragmentA=dejsonkv_6.Value, FragmentB=" (x", FragmentC=dejsonkv_4.Value, FragmentD=")")
Z = UnitZ(Factor=series)
ef_att = EleFrontAttributes(Keys=dejsonkv.Key, Values=dejsonkv.Value)  # -> Attributes, Keys, Values, Name, Layer, ColourSource, DisplayColour, MaterialSource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
zshift = ClusterOutput(series)
panel_2 = Panel("""F14 Seasoned Hardwood
F14 Seasoned Hardwood
F14 Seasoned Hardwood
F14 Seasoned Hardwood
F14 Seasoned Hardwood
F5
MGP10""")
# Make Block (Single Instance)
xy = XYPlane(Origin=Point(0, 0, 0))
# Make Block Definition (Geom Only)
defembed = DefineEmbeddedBlock(Geometry=cuboid.solid, Attributes=ef_att.Attributes, BlockName=dejsonkv_6.Value, BasePlane=PlaneXY(0, 0, 0))
V = ClusterOutput(dejsonkv_5.Value)
name = Data(dejsonkv_6.Value)
insert = InsertBlock(BlockName=dejsonkv_6.Value, Plane=xy)
V_2 = ClusterOutput(dejsonkv_9.Value)
R = ClusterOutput(concat)
block_definition = Data(defembed)
block_attributes = Data(ef_att.Attributes)
panel_3 = Panel(name)
block = Data(insert)
name_2 = ClusterOutput(name)
block_definition_2 = ClusterOutput(block_definition)
block_2 = ClusterOutput(block)
block_attributes_2 = ClusterOutput(block_attributes)
data_2 = Data(simplify(graft(panel_2)))
concat_2 = Concatenate(
    FragmentA=dejsonkv_8.Value,
    FragmentB=" ",
    FragmentC=dejsonkv_2.Value,
    FragmentD="x",
    FragmentE=dejsonkv_3.Value,
    FragmentF="x",
    FragmentG=dejsonkv_7.Value,
    FragmentH=" ",
    FragmentI=data_2)  # disabled
panel_4 = Panel(concat_2)

# ==== cluster BakeData
block_label = ClusterInput()
x_shift = ClusterInput()
y_shift = ClusterInput()
block_id = ClusterInput()
F = ClusterInput()
text_style = ClusterInput()
bake_name = ClusterInput()
X = UnitX(X_shift=x_shift)
Z = UnitZ(Factor=F)
Y = UnitY(Y_shift=y_shift)
block_label_2 = Text(block_label)
block_id_2 = Data(block_id)
text_style_2 = Data(text_style)
spread = ClusterInput()
flip = FlipMatrix(Data=Z)
spread_2 = Number(spread)
y_shi = Vector(Y)
x_shift_2 = Vector(X)
lng = ListLength(List=block_id_2)
series = Series(Start=0, Step=spread_2, Count=lng)
txt = Text(block_label_2)
Y_2 = UnitY(Factor=series)
addition = Addition(A=simplify(graft(Y_2)), B=x_shift_2, C=y_shi, D=Z)
addition_2 = Addition(A=simplify(graft(Y_2)), B=x_shift_2, C=y_shi)
xy = XYPlane(Origin=addition)
insert = InsertBlock(BlockName=simplify(graft(block_id_2)), Plane=xy)
text = DefineTextObject(Text=simplify(graft(txt)), Plane=addition_2, DimensionStyle=text_style_2)
bake_name_2 = Data(bake_name)
concat = Concatenate(FragmentA=bake_name_2, FragmentB="_text")
text_2 = ClusterOutput(text)
bake_name_3 = ClusterOutput(bake_name_2)
block_instance = ClusterOutput(insert)
text_bake_name = ClusterOutput(concat)

# ==== cluster Json_member
path = ClusterInput()
dejson = DeserializeJson(JSON=path, OutputsLocked=False)
data = Data(simplify(graft(dejson)))
dejson_2 = DeserializeJson(JSON=data, OutputsLocked=False)  # -> Member_id, L, Member_group_id
dejsonkv = DeserializeKeysAndValues(JSON=data)  # -> simplify(Key), simplify(Value)
panel = Panel("D")
panel_2 = Panel("B")
dejsonkv_2 = DeserializeKeysAndValues(JSON=data, Keys="L")  # -> simplify(Key), simplify(Value)
dejsonkv_3 = DeserializeKeysAndValues(JSON=data, Keys="member_group_id")  # -> simplify(Key), simplify(Value)
dejsonkv_4 = DeserializeKeysAndValues(JSON=data, Keys="member_id")  # -> simplify(Key), simplify(Value)
keysearch = KeyValueSearch(Keys=dejsonkv.Key, Values=dejsonkv.Value, FullLayerName="FullLayerName")  # disabled
keysearch_2 = KeyValueSearch(Keys=dejsonkv.Key, Values=dejsonkv.Value, MaterialName="MaterialName")  # disabled
pt = ConstructPoint(XCoordinate=0, YCoordinate=0, ZCoordinate=0)
X = UnitX(Factor=dejsonkv_2.Value)
# Make Block (Single Instance)
ef_att = EleFrontAttributes(Keys=dejsonkv.Key, Values=dejsonkv.Value)  # -> Attributes, Keys, Values, Name, Layer, ColourSource, DisplayColour, MaterialSource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
ln = Line(StartPoint=pt, EndPoint=X)
move = Move(Motion=Vector(0, 0, 10))  # -> Geometry, Transform
panel_3 = Panel(dejsonkv_4.Value)
xy = XYPlane(Origin=Point(0, 0, 0))
# Make Block Definition (Geom Only)
defembed = DefineEmbeddedBlock(Geometry=ln, Attributes=ef_att.Attributes, BlockName=dejsonkv_4.Value, BasePlane=PlaneXY(0, 0, 0))
name = Data(dejsonkv_4.Value)
insert = InsertBlock(BlockName=dejsonkv_4.Value, Plane=xy)
block_definition = Data(defembed)
block_attributes = Data(ef_att.Attributes)
name_2 = ClusterOutput(name)
block = Data(insert)
V = ClusterOutput(dejsonkv_3.Value)
V_2 = ClusterOutput(dejsonkv_4.Value)
block_definition_2 = ClusterOutput(block_definition)
block_2 = ClusterOutput(block)
block_attributes_2 = ClusterOutput(block_attributes)

# ==== cluster Json_block
path = ClusterInput()
dejson = DeserializeJson(JSON=path, OutputsLocked=False)
data = Data(simplify(graft(dejson)))
dejson_2 = DeserializeJson(JSON=data, OutputsLocked=False)  # -> L, Section_group, D, B, Part_name
layer = ClusterInput()
dejsonkv = DeserializeKeysAndValues(JSON=data)  # -> simplify(Key), simplify(Value)
dejsonkv_2 = DeserializeKeysAndValues(JSON=data, Keys="section_group")  # -> simplify(Key), simplify(Value)
dejsonkv_3 = DeserializeKeysAndValues(JSON=data, Keys="B")  # -> simplify(Key), simplify(Value)
dejsonkv_4 = DeserializeKeysAndValues(JSON=data, Keys="L")  # -> simplify(Key), simplify(Value)
dejsonkv_5 = DeserializeKeysAndValues(JSON=data, Keys="D")  # -> simplify(Key), simplify(Value)
list = ValueList({"Layer", "Material", "Object", "Parent"}, selected="Layer")
dejsonkv_6 = DeserializeKeysAndValues(JSON=data, Keys="part_name")  # -> simplify(Key), simplify(Value)
layer_2 = Data(layer)
panel = Panel(dejsonkv_5.Value)
V = ClusterOutput(dejsonkv_2.Value)
cuboid = Cuboid(length=dejsonkv_4.Value, width=dejsonkv_5.Value, thickness=dejsonkv_3.Value)  # -> cross_section_2, solid
# Make Block (Single Instance)
ef_att = EleFrontAttributes(Keys=dejsonkv.Key, Values=dejsonkv.Value, Layer=layer_2, ColourSource=list)  # -> Attributes, Keys, Values, Name, Layer, ColourSource, DisplayColour, MaterialSource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
xy = XYPlane(Origin=Point(0, 0, 0))
# Make Block Definition (Geom Only)
defembed = DefineEmbeddedBlock(Geometry=cuboid.solid, Attributes=ef_att.Attributes, BlockName=dejsonkv_6.Value, BasePlane=PlaneXY(0, 0, 0))
insert = InsertBlock(BlockName=dejsonkv_6.Value, Plane=xy)
name = Data(dejsonkv_6.Value)
block_definition = Data(defembed)
block_attributes = Data(ef_att.Attributes)
block = Data(insert)
name_2 = ClusterOutput(name)
block_definition_2 = ClusterOutput(block_definition)
block_2 = ClusterOutput(block)
block_attributes_2 = ClusterOutput(block_attributes)

# ==== cluster Json_member_groups
path = ClusterInput()
dejson = DeserializeJson(JSON=path, OutputsLocked=False)
layer_name = ClusterInput()
data = Data(simplify(graft(dejson)))
dejson_2 = DeserializeJson(JSON=data, OutputsLocked=False)  # -> Qty, L, Framing_group_name, Member_group_id, Member_group_and_qty
layer_name_2 = Data(layer_name)
dejsonkv = DeserializeKeysAndValues(JSON=data)  # -> simplify(Key), simplify(Value)
dejsonkv_2 = DeserializeKeysAndValues(JSON=data, Keys="L")  # -> simplify(Key), simplify(Value)
keysearch = KeyValueSearch(Keys=dejsonkv.Key, Values=dejsonkv.Value, FullLayerName="FullLayerName")  # disabled
keysearch_2 = KeyValueSearch(Keys=dejsonkv.Key, Values=dejsonkv.Value, MaterialName="MaterialName")  # disabled
dejsonkv_3 = DeserializeKeysAndValues(JSON=data, Keys="member_group_id")  # -> simplify(Key), simplify(Value)
dejsonkv_4 = DeserializeKeysAndValues(JSON=data, Keys="member_group_and_qty")  # -> simplify(Key), simplify(Value)
pt = ConstructPoint(XCoordinate=0, YCoordinate=0, ZCoordinate=0)
X = UnitX(Factor=dejsonkv_2.Value)
# Make Block (Single Instance)
ef_att = EleFrontAttributes(Keys=dejsonkv.Key, Values=dejsonkv.Value, Layer=layer_name_2)  # -> Attributes, Keys, Values, Name, Layer, ColourSource, DisplayColour, MaterialSource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
ln = Line(StartPoint=pt, EndPoint=X)
xy = XYPlane(Origin=Point(0, 0, 0))
# Make Block Definition (Geom Only)
defembed = DefineEmbeddedBlock(Geometry=ln, Attributes=ef_att.Attributes, BlockName=dejsonkv_3.Value, BasePlane=PlaneXY(0, 0, 0))
label = Text(dejsonkv_4.Value)
name = Data(dejsonkv_3.Value)
name_2 = ClusterOutput(name)
insert = InsertBlock(BlockName=dejsonkv_3.Value, Plane=xy)
block_definition = Data(defembed)
label_2 = ClusterOutput(label)
block_attributes = Data(ef_att.Attributes)
block = Data(insert)
block_definition_2 = ClusterOutput(block_definition)
block_2 = ClusterOutput(block)
block_attributes_2 = ClusterOutput(block_attributes)

# ==== cluster Json_jps
path = ClusterInput()
layer_name = ClusterInput()
dejson = DeserializeJson(JSON=path, OutputsLocked=False)
layer_name_2 = Data(layer_name)
data = Data(simplify(graft(dejson)))
dejson_2 = DeserializeJson(JSON=data, OutputsLocked=False)  # -> Jointing_pattern_id, simplify(Member_group_id), Part_id, Part_offset, Transverse_offset
Z = UnitZ(Factor=dejson_2.Transverse_offset)
concat = Concatenate(FragmentA=layer_name_2, FragmentB="::members")
concat_2 = Concatenate(FragmentA=layer_name_2, FragmentB="::parts")
multiplication = Multiplication(A=Z, B=Slider(45, range=0..100))
X = UnitX(Factor=dejson_2.Part_offset)
addition = Addition(A=X, B=multiplication)
panel = Panel(multiplication)
xy = XYPlane(Origin=addition)
xy_2 = XYPlane(Origin=Point(0, 0, 0))
dejsonkv = DeserializeKeysAndValues(JSON=data, Keys="member_group_id")  # -> Key, simplify(Value)
dejsonkv_2 = DeserializeKeysAndValues(JSON=data)  # -> simplify(Key), simplify(Value)
V = ClusterOutput(dejsonkv.Value)
insert = InsertBlock(BlockName=dejson_2.Member_group_id, Plane=xy_2)  # -> simplify(Block)
insert_2 = InsertBlock(BlockName=dejson_2.Part_id, Plane=xy)  # -> simplify(Block)
keysearch = KeyValueSearch(Keys=dejsonkv_2.Key, Values=dejsonkv_2.Value, FullLayerName="FullLayerName")  # disabled
keysearch_2 = KeyValueSearch(Keys=dejsonkv_2.Key, Values=dejsonkv_2.Value, MaterialName="MaterialName")  # disabled
merge = Merge(Data1=insert, Data2=insert_2)
block = Data(merge)
replace = ReplaceItems(List=block, Item=concat, Indices=0, Wrap=False)  # -> simplify(List)
lng = ListLength(List=replace)
series = Series(Start=1, Step=1, Count=expr("x-1", lng))
replace_2 = ReplaceItems(List=replace, Item=concat_2, Indices=series, Wrap=False)  # -> simplify(List)
panel_2 = Panel(replace_2)
# Make Block (Single Instance)
ef_att = EleFrontAttributes(Keys=dejsonkv_2.Key, Values=dejsonkv_2.Value, Layer=replace_2)  # -> Attributes, Keys, Values, Name, Layer, ColourSource, DisplayColour, MaterialSource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
panel_3 = Panel(block)
xy_3 = XYPlane(Origin=Point(0, 0, 0))
# Make Block Definition (Geom Only)
defembed = DefineEmbeddedBlock(Geometry=block, BlockName=dejson_2.Jointing_pattern_id, BasePlane=PlaneXY(0, 0, 0))
insert_3 = InsertBlock(BlockName=dejson_2.Jointing_pattern_id, Plane=xy_3)
name = Data(dejson_2.Jointing_pattern_id)
block_definition = Data(defembed)
block_attributes = Data(ef_att.Attributes)
block_2 = Data(insert_3)
name_2 = ClusterOutput(name)
block_definition_2 = ClusterOutput(block_definition)
part_id = ClusterOutput(dejson_2.Part_id)
block_3 = ClusterOutput(block_2)
block_attributes_2 = ClusterOutput(block_attributes)

# ==== cluster Json_cps
path = ClusterInput()
dejson = DeserializeJson(JSON=path, OutputsLocked=False)
data = Data(simplify(graft(dejson)))
# Note: Deserialise Keys + Values only returns first list item for
# part_id and part_offset -> need to use DeJson
panel = Panel("element_group_id")
panel_2 = Panel(data)
dejson_2 = DeserializeJson(JSON=data, OutputsLocked=False)  # -> Element_group_id, simplify(Part_id), Cutting_pattern_id, simplify(Part_offset), Total_part_length
panel_3 = Panel("part_offset")  # disabled
panel_4 = Panel("part_id")  # disabled
panel_5 = Panel(dejson_2.Element_group_id)
dejsonkv = DeserializeKeysAndValues(JSON=data, Keys=panel)  # -> Key, simplify(Value)
dejsonkv_2 = DeserializeKeysAndValues(JSON=data, Keys=panel_3)  # -> Key, simplify(Value); disabled
dejsonkv_3 = DeserializeKeysAndValues(JSON=data, Keys="cutting_pattern_id")  # -> Key, simplify(Value)
dejsonkv_4 = DeserializeKeysAndValues(JSON=data, Keys=panel_4)  # -> Key, simplify(Value); disabled
lng = ListLength(List=flatten(dejson_2.Part_id))
X = UnitX(Factor=dejson_2.Part_offset)
larger = LargerThan(FirstNumber=flatten(lng), SecondNumber=1)  # -> LargerThan, OrEqualTo
xy = XYPlane(Origin=Point(0, 0, 0))
xy_2 = XYPlane(Origin=X)
dejsonkv_5 = DeserializeKeysAndValues(JSON=data)  # -> simplify(Key), simplify(Value)
V = ClusterOutput(dejsonkv.Value)
insert = InsertBlock(BlockName=dejson_2.Part_id, Plane=xy_2)  # -> simplify(Block)
insert_2 = InsertBlock(BlockName=dejsonkv.Value, Plane=xy)  # -> simplify(Block)
keysearch = KeyValueSearch(Keys=dejsonkv_5.Key, Values=dejsonkv_5.Value, FullLayerName="FullLayerName")  # disabled
keysearch_2 = KeyValueSearch(Keys=dejsonkv_5.Key, Values=dejsonkv_5.Value, MaterialName="MaterialName")  # disabled
simplify = SimplifyTree(Tree=simplify(insert), Front=False)
data_2 = Data(simplify(simplify))
merge = Merge(Data1=flatten(insert_2), Data2=flatten(insert))
merge_2 = Merge(Data1=insert_2, Data2=insert)
# Make Block (Single Instance)
ef_att = EleFrontAttributes(Keys=dejsonkv_5.Key, Values=dejsonkv_5.Value)  # -> Attributes, Keys, Values, Name, Layer, ColourSource, DisplayColour, MaterialSource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
filter = StreamFilter(Gate=larger.LargerThan, Stream0=merge, Stream1=merge_2)
block = Data(filter)
xy_3 = XYPlane(Origin=Point(0, 0, 0))
# Make Block Definition (Geom Only)
defembed = DefineEmbeddedBlock(Geometry=block, BlockName=dejsonkv_3.Value, BasePlane=PlaneXY(0, 0, 0))
panel_6 = Panel(dejson_2.Part_offset)
insert_3 = InsertBlock(BlockName=dejsonkv_3.Value, Plane=xy_3)
panel_7 = Panel(block)
name = Data(dejsonkv_3.Value)
block_definition = Data(defembed)
block_attributes = Data(ef_att.Attributes)
block_2 = Data(insert_3)
block_definition_2 = ClusterOutput(block_definition)
name_2 = ClusterOutput(name)
block_3 = ClusterOutput(block_2)
block_attributes_2 = ClusterOutput(block_attributes)

# ==== cluster Max_L
path = ClusterInput()
dejson = DeserializeJson(JSON=path, OutputsLocked=False)
data = Data(simplify(graft(dejson)))
L = Keys("L")
dejsonkv = DeserializeKeysAndValues(JSON=data, Keys=L)  # -> simplify(Key), simplify(Value)
sort = SortList(Keys=flatten(dejsonkv.Value))  # -> Keys, ValuesA
rev = ReverseList(List=sort.Keys)
item = ListItem(List=rev, Index=expr("0", 0), Wrap=True)
max_element_length = Number(item)
max_element_length_2 = ClusterOutput(max_element_length)

# ==== cluster RequiredLengthChart
mediator = ClusterInput()
show = ClusterInput()
mediator_2 = Data(mediator)
show_2 = Boolean(show)
graph_attributes = ClusterInput()
filter = StreamFilter(Gate=show_2, Stream1=mediator_2)
py3 = Python3Script(mediator=filter)  # -> out, framing_group_ids, required_lengths, max_length
# ---------- py3: Python ----------
"""Grasshopper Script"""

framing_group_ids=list(mediator.structure.framing_groups.keys())

print(mediator.section_group_required_length_df)


dispatch_df = mediator.dispatch_matrix
dispatch_matrix = mediator.dispatch_matrix.reset_index(names='section_group').to_json(orient='records')
print(dispatch_matrix)



required_lengths = mediator.section_group_required_length_df.reset_index(names='section_group').to_json(orient='records')
print(required_lengths)

max_required_length=mediator.section_group_required_length_df.max().max()
max_dispatch_length=mediator.dispatch_matrix.max().max()
max_length=max(max_required_length,max_dispatch_length)
max_length=round(max_length,-4)
print(max_length)
# ---------- end py3 ----------
graph_attributes_2 = Data(graph_attributes)
graph_attributes_3 = Data(graph_attributes)
graphattributesdecon = Python3Script(graph_attributes=graph_attributes_3)  # -> out, graph_text, graph_spread, length_scale_factor, width_scale_factor, text_y_shift; same code as graphattributesdecon
requiredlengthbarchart = RequiredLengthBarChart(required_lengths=py3.required_lengths, framing_group_ids=py3.framing_group_ids, graph_attributes=graph_attributes_2)  # -> text_3, G, spread_2
panel = Panel(py3.framing_group_ids)
null = NullItem(Item=filter)  # -> NullFlags, InvalidFlags, Description
multiplication = Multiplication(A=py3.max_length, Length_scale_factor=graphattributesdecon.length_scale_factor)
Y = UnitY(Factor=multiplication)
req_length_graph_text = Data(requiredlengthbarchart.text_3)
req_length_bar_chart = Surface(requiredlengthbarchart.G)
ln = Line(StartPoint=Point(0, 0, 0), EndPoint=Y)
X = UnitX(Factor=requiredlengthbarchart.spread_2)
move = Move(Geometry=ln, Motion=X)  # -> Geometry, Transform
filter_2 = StreamFilter(Gate=null.NullFlags, Stream0=req_length_graph_text)
filter_3 = StreamFilter(Gate=null.NullFlags, Stream0=req_length_bar_chart)
vertical_axis = Data(move.Geometry)
req_graph_text = Data(filter_2)
req_bar_chart = Surface(filter_3)
vertical_axis_2 = ClusterOutput(vertical_axis)
req_bar_chart_2 = ClusterOutput(req_bar_chart)
req_graph_text_2 = ClusterOutput(req_graph_text)

# ==== cluster AllStockLengthChart
show = ClusterInput()
mediator = ClusterInput()
show_2 = Boolean(show)
mediator_2 = Data(mediator)
filter = StreamFilter(Gate=show_2, Stream1=mediator_2)
py3 = Python3Script(mediator=filter)  # -> out, framing_group_ids, section_groups, section_group_ids
# ---------- py3: Python ----------
"""Grasshopper Script"""
# a = "Hello Python 3 in Grasshopper!"
# print(a)

framing_group_ids=list(mediator.structure.framing_groups.keys())

section_group_ids = list(mediator.stock.section_group_df.index)
section_groups = mediator.stock.section_group_df.to_json(orient="records")
# ---------- end py3 ----------
graph_attributes = ClusterInput()
dejson = DeserializeJson(JSON=py3.section_groups, OutputsLocked=False)
graph_attributes_2 = Data(graph_attributes)
dejsonkv = DeserializeKeysAndValues(JSON=dejson, Keys="L_total")  # -> Key, flatten(Value)
stocklengthbarchart = StockLengthBarChart(
    stock_length=dejsonkv.Value,
    framing_group_ids=py3.framing_group_ids,
    section_group_ids=py3.section_group_ids,
    graph_attributes=graph_attributes_2)  # -> V, text_3, G
stock_graph_text = Data(stocklengthbarchart.text_3)
stock_bar_chart = Surface(stocklengthbarchart.G)
filter_2 = StreamFilter(Gate=0, Stream0=stock_graph_text)
filter_3 = StreamFilter(Gate=0, Stream0=stock_bar_chart)
stock_graph_text_2 = Data(filter_2)
stock_bar_chart_2 = Surface(filter_3)
stock_graph_text_3 = ClusterOutput(stock_graph_text_2)
stock_bar_chart_3 = ClusterOutput(stock_bar_chart_2)

# ==== cluster AllocatedLengthChart
mediator = ClusterInput()
show = ClusterInput()
mediator_2 = Data(mediator)
show_2 = Boolean(show)
filter = StreamFilter(Gate=show_2, Stream1=mediator_2)
py3 = Python3Script(mediator=filter)  # -> out, framing_group_ids, dispatch_matrix, section_group_ids
# ---------- py3: Python ----------
"""Grasshopper Script"""
# a = "Hello Python 3 in Grasshopper!"
# print(a)

framing_group_ids=list(mediator.structure.framing_groups.keys())

section_group_ids = list(mediator.stock.section_group_df.index)
dispatch_matrix = mediator.dispatch_matrix.reset_index(names='section_group').to_json(orient='records')
# ---------- end py3 ----------
framing_group_ids = Text(py3.framing_group_ids)
graph_attributes = ClusterInput()
dejson = DeserializeJson(JSON=py3.dispatch_matrix, OutputsLocked=False)
dejsonkv = DeserializeKeysAndValues(JSON=dejson, Keys=graft(framing_group_ids))  # -> Key, simplify(Value)
graph_attributes_2 = Data(graph_attributes)
path_mapper = PathMapper(dejsonkv.Value, source="{A;B}", target="{B}")
dispatch_lengths = Number(path_mapper)
flip = FlipMatrix(Data=dispatch_lengths)
stocklengthbarchart = StockLengthBarChart_2(
    stock_length=flip,
    framing_group_ids=py3.framing_group_ids,
    section_group_ids=py3.section_group_ids,
    graph_attributes=graph_attributes_2)  # -> V, text_3, G
panel = Panel(path_mapper)
allocated_graph_text = Data(stocklengthbarchart.text_3)
allocated_bar_chart = Surface(stocklengthbarchart.G)
filter_2 = StreamFilter(Gate=0, Stream0=allocated_graph_text)
filter_3 = StreamFilter(Gate=0, Stream0=allocated_bar_chart)
allocated_graph_text_2 = Data(filter_2)
allocated_bar_chart_2 = Surface(filter_3)
allocated_graph_text_3 = ClusterOutput(allocated_graph_text_2)
allocated_bar_chart_3 = ClusterOutput(allocated_bar_chart_2)

# ==== cluster ShortLengthChart
mediator = ClusterInput()
show = ClusterInput()
mediator_2 = Data(mediator)
show_2 = Boolean(show)
filter = StreamFilter(Gate=show_2, Stream1=mediator_2)
py3 = Python3Script(mediator=filter)  # -> out, framing_group_ids, section_groups, section_group_ids; same code as py3
py3_2 = Python3Script(mediator=filter)  # -> out, removed_short_lengths
# ---------- py3_2: Python ----------
"""Grasshopper Script"""

from cubbyhouse.mediator import DispatchStage
from copy import deepcopy
m1 =deepcopy(mediator)
m1.dispatch_section_groups(DispatchStage.STAGE1_STRUCT)
df1 = m1.dispatch_matrix

m2 =deepcopy(mediator)
m2.dispatch_section_groups(DispatchStage.STAGE2_MIN_SIZE)
df2 = m2.dispatch_matrix


removed_df = df1 - df2

removed_short_lengths =removed_df.reset_index(names='section_group').to_json(orient='records')
# ---------- end py3_2 ----------
framing_group_ids = Text(py3.framing_group_ids)
graph_attributes = ClusterInput()
dejson = DeserializeJson(JSON=py3_2.removed_short_lengths, OutputsLocked=False)
dejson_2 = DeserializeJson(JSON=py3.section_groups, OutputsLocked=False)
dejsonkv = DeserializeKeysAndValues(JSON=dejson, Keys=graft(framing_group_ids))  # -> Key, simplify(Value)
dejsonkv_2 = DeserializeKeysAndValues(JSON=dejson_2, Keys="L_total")  # -> Key, flatten(Value)
graph_attributes_2 = Data(graph_attributes)
panel = Panel(dejsonkv_2.Value)
path_mapper = PathMapper(dejsonkv.Value, source="{A;B}", target="{B}")
dispatch_lengths = Number(path_mapper)
flip = FlipMatrix(Data=dispatch_lengths)
shortlengthbarchart = ShortLengthBarChart(
    stock_length=dejsonkv_2.Value,
    framing_group_ids=py3.framing_group_ids,
    short_length=path_mapper,
    section_group_ids=py3.section_group_ids,
    graph_attributes=graph_attributes_2)  # -> V, text_3, G
panel_2 = Panel(path_mapper)
allocated_graph_text = Data(shortlengthbarchart.text_3)
allocated_bar_chart = Surface(shortlengthbarchart.G)
filter_2 = StreamFilter(Gate=0, Stream0=allocated_graph_text)
filter_3 = StreamFilter(Gate=0, Stream0=allocated_bar_chart)
allocated_graph_text_2 = Data(filter_2)
allocated_bar_chart_2 = Surface(filter_3)
allocated_graph_text_3 = ClusterOutput(allocated_graph_text_2)
allocated_bar_chart_3 = ClusterOutput(allocated_bar_chart_2)

# ==== cluster BakeInSpace
block_label = ClusterInput()
block_id = ClusterInput()
text_style = ClusterInput()
bake_name = ClusterInput()
target_plane = ClusterInput()
block_label_2 = Text(block_label)
block_id_2 = Data(block_id)
text_style_2 = Data(text_style)
target_plane_2 = Plane(target_plane)
txt = Text(block_label_2)
text = DefineTextObject(Text=txt, Plane=target_plane_2, DimensionStyle=text_style_2)
insert = InsertBlock(BlockName=block_id_2, Plane=target_plane_2)
bake_name_2 = Data(bake_name)
concat = Concatenate(FragmentA=bake_name_2, FragmentB="_text")
text_bake_name = ClusterOutput(concat)
text_2 = ClusterOutput(text)
bake_name_3 = ClusterOutput(bake_name_2)
block_instance = ClusterOutput(insert)

# ==== cluster MemberLocs
target_plane = ClusterInput()
member_ordinates = ClusterInput()
lam_y = ClusterInput()
length = ClusterInput()
rotate_section = ClusterInput()
target_plane_2 = Plane(target_plane)
lam_y_2 = Number(lam_y)
length_2 = Number(length)
member_ordinates_2 = Vector(member_ordinates)
rotate_section_2 = Boolean(rotate_section)
X = UnitX(Factor=length_2)
panel = Panel(member_ordinates_2)
series = Series(Start=0, Step=Slider(34, range=0..100), Count=simplify(lam_y_2))  # -> simplify(Series)
ln = Line(StartPoint=Point(0, 0, 0), EndPoint=X)
move = Move(Geometry=simplify(graft(ln)), Motion=member_ordinates_2)  # -> simplify(Geometry), Transform
# Draw Transverse Laminations
Y = UnitY(Factor=series)  # -> graft(UnitVector)
move_2 = Move(Geometry=move.Geometry, Motion=Y)  # -> Geometry, Transform
path_mapper = PathMapper(move_2.Geometry, source="{A;B}", target="{A}")
orient = Orient(Geometry=path_mapper, Source=PlaneXY(0, 0, 0), Target=target_plane_2)  # -> Geometry, Transform
# Excluding Transverse Laminations
orient_2 = Orient(Geometry=move.Geometry, Source=PlaneXY(0, 0, 0), Target=target_plane_2)  # -> Geometry, Transform
member_locs = Line(orient.Geometry)
member_locs_2 = Line(orient_2.Geometry)
num = Number(rotate_section_2)
eval = EvaluateCurve(Curve=reparameterize(member_locs), Parameter=0)  # -> Member_loc_planes, Tangent, Angle
eval_2 = EvaluateCurve(Curve=reparameterize(member_locs_2), Parameter=0)  # -> Member_loc_planes, Tangent, Angle
xy = XYPlane(Origin=Point(0, 0, 0))
xy_2 = XYPlane(Origin=Point(0, 0, 0))
member_locs_3 = ClusterOutput(member_locs)
rotate = Rotate(Geometry=eval.Tangent, Angle=1.570796327, Plane=xy)  # -> Geometry, Transform
Z = UnitZ(Factor=1)
rotate_2 = Rotate(Geometry=eval_2.Tangent, Angle=1.570796327, Plane=xy_2)  # -> Geometry, Transform
pl = ConstructPlane(Origin=eval.Member_loc_planes, XAxis=eval.Tangent, YAxis=rotate.Geometry)
p_n_c = PickNChoose(Pattern=simplify(graft(num)), Stream0=Z, Stream1=rotate_2.Geometry)
pl_2 = ConstructPlane(Origin=eval_2.Member_loc_planes, XAxis=eval_2.Tangent, YAxis=p_n_c)
deplane = DeconstructPlane(Plane=pl)  # -> Origin, XAxis, YAxis, ZAxis
member_loc_planes = ClusterOutput(pl)
member_loc_planes_excl_trans_lams = ClusterOutput(pl_2)
panel_2 = Panel(pl_2)

# ==== cluster Cuboid
width = ClusterInput()
thickness = ClusterInput()
length = ClusterInput()
thickness_2 = Number(thickness)
width_2 = Number(width)
length_2 = Number(length)
pt = ConstructPoint(XCoordinate=0, YCoordinate=width_2, ZCoordinate=thickness_2)
rec_2pt = Rectangle2Pt(Plane=PlaneYZ(0, 0, 0), PointA=Point(0, 0, 0), PointB=pt, Radius=0)  # -> Rectangle, Length
X = UnitX(Factor=length_2)
cross_section = Surface(rec_2pt.Rectangle)
extr = Extrude(Base=cross_section, Direction=X)
solid = ClusterOutput(extr)
cross_section_2 = ClusterOutput(cross_section)

# ==== cluster RequiredLengthBarChart
graph_attributes = ClusterInput()
graph_attributes_2 = Data(graph_attributes)
framing_group_ids = ClusterInput()
required_lengths = ClusterInput()
graphattributesdecon = Python3Script(graph_attributes=graph_attributes_2)  # -> out, graph_text, graph_spread, length_scale_factor, width_scale_factor, text_y_shift
# ---------- graphattributesdecon: Python ----------
"""Grasshopper Script"""

graph_text= graph_attributes.graph_text
graph_spread= graph_attributes.graph_spread
length_scale_factor= graph_attributes.length_scale_factor
width_scale_factor= graph_attributes.width_scale_factor
text_y_shift=graph_attributes.text_y_shift
# ---------- end graphattributesdecon ----------
framing_group_ids_2 = Text(simplify(graft(framing_group_ids)))
dejson = DeserializeJson(Required_lengths=required_lengths, OutputsLocked=False)
dejsonkv = DeserializeKeysAndValues(JSON=dejson, Keys=simplify(framing_group_ids_2))  # -> Key, simplify(Value)
spread_factor = Number(graphattributesdecon.graph_spread)
multiplication = Multiplication(Width_scale_factor=graphattributesdecon.width_scale_factor)
text_style = Data(graphattributesdecon.graph_text)
path_mapper = PathMapper(dejsonkv.Value, source="{A;:}", target="{A}")
# Bar Spread
multiplication_2 = Multiplication(A=multiplication, B=spread_factor)
num = Number(path_mapper)
cset = CreateSet(List=num)  # -> Set, Map
num_2 = Number(cset.Set)
multiplication_3 = Multiplication(A=num_2, Length_scale_factor=graphattributesdecon.length_scale_factor)
tstat = TreeStatistics(Tree=multiplication_3)  # -> Paths, Length, Count
lng = ListLength(List=tstat.Paths)
series = Series(Start=0, Step=multiplication_2, Count=lng)  # -> simplify(graft(Series))
spread = Number(series)
spread_2 = ClusterOutput(spread)
X = UnitX(Factor=series)  # -> simplify(UnitVector)
Y = UnitY(Factor=expr("-x", graphattributesdecon.text_y_shift))
X_2 = UnitX(Factor=expr("x/2", graphattributesdecon.width_scale_factor))
spread_3 = Vector(X)
# Text
expression = Expression(x=num_2, Expression="Format(\"{0:0}\", x/1000)")
# Bar Shapes
Y_2 = UnitY(Factor=multiplication_3)
move = Move(Geometry=spread_3, Motion=Y)  # -> Geometry, Transform
X_3 = UnitX(Factor=multiplication)
ln = Line(StartPoint=Point(0, 0, 0), EndPoint=Y_2)
addition = Addition(A=Y_2, B=spread_3)
move_2 = Move(Geometry=addition, Motion=Y)  # -> Geometry, Transform
ln_2 = Line(StartPoint=Point(0, 0, 0), EndPoint=X_3)
move_3 = Move(Geometry=move_2.Geometry, Motion=X_2)  # -> Geometry, Transform
move_4 = Move(Geometry=move.Geometry, Motion=X_2)  # -> Geometry, Transform
text = DefineTextObject(Text=framing_group_ids_2, Plane=simplify(graft(move_4.Geometry)), DimensionStyle=text_style)
text_2 = DefineTextObject(Text=expression, Plane=simplify(move_3.Geometry), DimensionStyle=text_style)
extrcrv = ExtrudeAlong(Base=ln, Curve=ln_2)
srf = Surface(extrcrv)
text_3 = ClusterOutput([text, text_2])
move_5 = Move(Geometry=srf, Motion=simplify(X))  # -> Geometry, Transform
G = ClusterOutput(move_5.Geometry)

# ==== cluster StockLengthBarChart
graph_attributes = ClusterInput()
section_group_ids = ClusterInput()
graph_attributes_2 = Data(graph_attributes)
section_group_ids_2 = Text(section_group_ids)
graphattributesdecon = Python3Script(graph_attributes=graph_attributes_2)  # -> out, graph_text, graph_spread, length_scale_factor, width_scale_factor, text_y_shift
# ---------- graphattributesdecon: Python ----------
"""Grasshopper Script"""

graph_text= graph_attributes.graph_text
graph_spread= graph_attributes.graph_spread
length_scale_factor= graph_attributes.length_scale_factor
width_scale_factor= graph_attributes.width_scale_factor
text_y_shift =graph_attributes.text_y_shift
# ---------- end graphattributesdecon ----------
framing_group_ids = ClusterInput()
stock_length = ClusterInput()
framing_group_ids_2 = Text(framing_group_ids)
number_slider = Slider(80, range=0..100)
stock_length_2 = Number(stock_length)
multiplication = Multiplication(A=stock_length_2, Length_scale_factor=graphattributesdecon.length_scale_factor)
multiplication_2 = Multiplication(Width_scale_factor=graphattributesdecon.width_scale_factor)
spread_factor = Number(graphattributesdecon.graph_spread)
expression = Expression(x=stock_length_2, Expression="Format(\"{0:0}\", x/1000)")
division = Division(A=stock_length_2, B=100)
multiplication_3 = Multiplication(A=graphattributesdecon.width_scale_factor, B=spread_factor)
Y = UnitY(Factor=multiplication)
_0_5_w = Number(expr("0.5*x", graphattributesdecon.width_scale_factor))
Y_2 = UnitY(Factor=expr("-x", graphattributesdecon.text_y_shift))
Y_3 = UnitY(Factor=expr("5*x", graphattributesdecon.text_y_shift))
lng = ListLength(List=framing_group_ids_2)
addition = Addition(A=graphattributesdecon.width_scale_factor)
lng_2 = ListLength(List=stock_length_2)
X = UnitX(Factor=graphattributesdecon.width_scale_factor)
X_2 = UnitX(Factor=_0_5_w)
sort = SortList(Keys=multiplication)  # -> Keys, ValuesA
xy = XYPlane(Origin=Point(0, 0, 0))
concat = Concatenate(FragmentA=expression, FragmentB=" ")
item = ListItem(List=sort.Keys, Index=-1, Wrap=True)
series = Series(Start=addition, Step=graphattributesdecon.width_scale_factor, Count=lng_2)  # -> simplify(Series)
ln = Line(StartPoint=Point(0, 0, 0), EndPoint=X)
series_2 = Series(Start=0, Step=multiplication_3, Count=lng)  # -> simplify(graft(Series))
ln_2 = Line(StartPoint=Point(0, 0, 0), EndPoint=Y)
X_3 = UnitX(Factor=series)
addition_2 = Addition(A=X_2, B=X_3)
move = Move(Geometry=xy, Motion=addition_2)  # -> Geometry, Transform
X_4 = UnitX(Factor=series_2)  # -> simplify(UnitVector)
addition_3 = Addition(A=Y_2, B=X_4)
width = Number(graphattributesdecon.width_scale_factor)
move_2 = Move(Geometry=move.Geometry, Motion=addition_3)  # -> Geometry, Transform
extrcrv = ExtrudeAlong(Base=ln_2, Curve=ln)
text = DefineTextObject(Text=section_group_ids_2, Plane=simplify(move_2.Geometry), DimensionStyle=graphattributesdecon.graph_text)
Y_4 = UnitY(Factor=item)
spread = Vector(X_4)
addition_4 = Addition(A=Y, B=spread)
move_3 = Move(Geometry=addition_4, Motion=Y_3)  # -> Geometry, Transform
move_4 = Move(Geometry=move_3.Geometry, Motion=addition_2)  # -> Geometry, Transform
text_2 = DefineTextObject(Text=concat, Plane=simplify(move_4.Geometry), DimensionStyle=graphattributesdecon.graph_text)
srf = Surface(extrcrv)
move_5 = Move(Geometry=srf, Motion=X_3)  # -> Geometry, Transform
V = ClusterOutput(Y_4)
text_3 = ClusterOutput([text_2, text])
move_6 = Move(Geometry=move_5.Geometry, Motion=simplify(X_4))  # -> Geometry, Transform
G = ClusterOutput(move_6.Geometry)

# ==== cluster StockLengthBarChart_2
graph_attributes = ClusterInput()
section_group_ids = ClusterInput()
graph_attributes_2 = Data(graph_attributes)
section_group_ids_2 = Text(section_group_ids)
graphattributesdecon = Python3Script(graph_attributes=graph_attributes_2)  # -> out, graph_text, graph_spread, length_scale_factor, width_scale_factor, text_y_shift; same code as graphattributesdecon
framing_group_ids = ClusterInput()
stock_length = ClusterInput()
framing_group_ids_2 = Text(framing_group_ids)
number_slider = Slider(80, range=0..100)
stock_length_2 = Number(stock_length)
multiplication = Multiplication(A=stock_length_2, Length_scale_factor=graphattributesdecon.length_scale_factor)
spread_factor = Number(graphattributesdecon.graph_spread)
expression = Expression(x=stock_length_2, Expression="Format(\"{0:0}\", x/1000)")
division = Division(A=stock_length_2, B=100)
multiplication_2 = Multiplication(A=graphattributesdecon.width_scale_factor, B=spread_factor)
Y = UnitY(Factor=expr("-x", graphattributesdecon.text_y_shift))
Y_2 = UnitY(Factor=expr("5*x", graphattributesdecon.text_y_shift))
Y_3 = UnitY(Factor=multiplication)
_0_5_w = Number(expr("0.5*x", graphattributesdecon.width_scale_factor))
lng = ListLength(List=framing_group_ids_2)
addition = Addition(A=graphattributesdecon.width_scale_factor)
lng_2 = ListLength(List=stock_length_2)
X = UnitX(Factor=graphattributesdecon.width_scale_factor)
X_2 = UnitX(Factor=_0_5_w)
sort = SortList(Keys=multiplication)  # -> Keys, ValuesA
concat = Concatenate(FragmentA=expression, FragmentB=" ")
xy = XYPlane(Origin=Point(0, 0, 0))
item = ListItem(List=sort.Keys, Index=-1, Wrap=True)
series = Series(Start=addition, Step=graphattributesdecon.width_scale_factor, Count=lng_2)  # -> simplify(Series)
ln = Line(StartPoint=Point(0, 0, 0), EndPoint=X)
series_2 = Series(Start=0, Step=multiplication_2, Count=lng)  # -> simplify(graft(Series))
ln_2 = Line(StartPoint=Point(0, 0, 0), EndPoint=Y_3)
panel = Panel(concat)
X_3 = UnitX(Factor=series)
addition_2 = Addition(A=X_2, B=X_3)
move = Move(Geometry=xy, Motion=addition_2)  # -> Geometry, Transform
X_4 = UnitX(Factor=series_2)  # -> simplify(UnitVector)
width = Number(graphattributesdecon.width_scale_factor)
addition_3 = Addition(A=Y, B=X_4)
extrcrv = ExtrudeAlong(Base=ln_2, Curve=ln)
move_2 = Move(Geometry=move.Geometry, Motion=addition_3)  # -> Geometry, Transform
Y_4 = UnitY(Factor=item)
spread = Vector(X_4)
addition_4 = Addition(A=Y_3, B=spread)
move_3 = Move(Geometry=addition_4, Motion=Y_2)  # -> Geometry, Transform
move_4 = Move(Geometry=move_3.Geometry, Motion=addition_2)  # -> Geometry, Transform
text = DefineTextObject(Text=concat, Plane=simplify(move_4.Geometry), DimensionStyle=graphattributesdecon.graph_text)
srf = Surface(extrcrv)
text_2 = DefineTextObject(Text=section_group_ids_2, Plane=simplify(move_2.Geometry), DimensionStyle=graphattributesdecon.graph_text)
move_5 = Move(Geometry=srf, Motion=X_3)  # -> Geometry, Transform
V = ClusterOutput(Y_4)
text_3 = ClusterOutput([text, text_2])
move_6 = Move(Geometry=move_5.Geometry, Motion=simplify(X_4))  # -> Geometry, Transform
G = ClusterOutput(move_6.Geometry)

# ==== cluster ShortLengthBarChart
graph_attributes = ClusterInput()
section_group_ids = ClusterInput()
graph_attributes_2 = Data(graph_attributes)
short_length = ClusterInput()
section_group_ids_2 = Text(section_group_ids)
short_length_2 = Data(short_length)
graphattributesdecon = Python3Script(graph_attributes=graph_attributes_2)  # -> out, graph_text, graph_spread, length_scale_factor, width_scale_factor, text_y_shift; same code as graphattributesdecon
num = Number(short_length_2)
framing_group_ids = ClusterInput()
stock_length = ClusterInput()
multiplication = Multiplication(A=num, Length_scale_factor=graphattributesdecon.length_scale_factor)
framing_group_ids_2 = Text(framing_group_ids)
number_slider = Slider(80, range=0..100)
stock_length_2 = Number(stock_length)
multiplication_2 = Multiplication(A=simplify(graft(stock_length_2)), Length_scale_factor=graphattributesdecon.length_scale_factor)
spread_factor = Number(graphattributesdecon.graph_spread)
subtraction = Subtraction(A=multiplication_2, B=multiplication)
expression = Expression(x=num, Expression="Format(\"{0:0}\", x/1000)")
division = Division(A=stock_length_2, B=100)
multiplication_3 = Multiplication(A=graphattributesdecon.width_scale_factor, B=spread_factor)
Y = UnitY(Factor=expr("-x", graphattributesdecon.text_y_shift))
Y_2 = UnitY(Factor=expr("5*x", graphattributesdecon.text_y_shift))
Y_3 = UnitY(Factor=subtraction)
lng = ListLength(List=Y_3)
Y_4 = UnitY(Factor=multiplication_2)
data = Data(simplify(graft(Y_4)))
_0_5_w = Number(expr("0.5*x", graphattributesdecon.width_scale_factor))
lng_2 = ListLength(List=framing_group_ids_2)
addition = Addition(A=graphattributesdecon.width_scale_factor)
lng_3 = ListLength(List=stock_length_2)
X = UnitX(Factor=graphattributesdecon.width_scale_factor)
sort = SortList(Keys=multiplication_2)  # -> Keys, ValuesA
X_2 = UnitX(Factor=_0_5_w)
repeat = RepeatData(Data=data, Length=lng)  # -> simplify(Data)
concat = Concatenate(FragmentA=expression)
xy = XYPlane(Origin=Point(0, 0, 0))
item = ListItem(List=sort.Keys, Index=-1, Wrap=True)
series = Series(Start=addition, Step=graphattributesdecon.width_scale_factor, Count=lng_3)  # -> simplify(Series)
series_2 = Series(Start=0, Step=multiplication_3, Count=lng_2)  # -> simplify(graft(Series))
txt = Text(" ")
equals = Equality(FirstNumber=expression, SecondNumber=0)  # -> Equality, Inequality
ln = Line(StartPoint=Y_3, EndPoint=Y_4)
ln_2 = Line(StartPoint=Point(0, 0, 0), EndPoint=X)
p_n_c = PickNChoose(Pattern=equals.Equality, Stream0=concat, Stream1=txt)
extrcrv = ExtrudeAlong(Base=ln, Curve=ln_2)
X_3 = UnitX(Factor=series_2)  # -> simplify(UnitVector)
rep = ReplaceText(Text=concat, Find="0", RecursiveReplace=False)
panel = Panel(rep)
width = Number(graphattributesdecon.width_scale_factor)
addition_2 = Addition(A=Y, B=X_3)
X_4 = UnitX(Factor=series)
addition_3 = Addition(A=X_2, B=X_4)
move = Move(Geometry=xy, Motion=addition_3)  # -> Geometry, Transform
move_2 = Move(Geometry=move.Geometry, Motion=addition_2)  # -> Geometry, Transform
Y_5 = UnitY(Factor=item)
spread = Vector(X_3)
addition_4 = Addition(A=Y_4, B=spread)
move_3 = Move(Geometry=addition_4, Motion=Y_2)  # -> Geometry, Transform
move_4 = Move(Geometry=move_3.Geometry, Motion=addition_3)  # -> Geometry, Transform
text = DefineTextObject(Text=p_n_c, Plane=simplify(move_4.Geometry), DimensionStyle=graphattributesdecon.graph_text)
text_2 = DefineTextObject(Text=section_group_ids_2, Plane=simplify(move_2.Geometry), DimensionStyle=graphattributesdecon.graph_text)
srf = Surface(extrcrv)
flip = FlipMatrix(Data=srf)
V = ClusterOutput(Y_5)
text_3 = ClusterOutput([text, text_2])
move_5 = Move(Geometry=flip, Motion=X_4)  # -> Geometry, Transform
move_6 = Move(Geometry=move_5.Geometry, Motion=simplify(X_3))  # -> Geometry, Transform
G = ClusterOutput(move_6.Geometry)
