# Grasshopper definition Cubbyhouse GH Example - Case 2.gh (Grasshopper 1.0.8)
# plug-ins: jSwan, horsterCameraControl, eleFront

number_slider = Slider(100, range=0..300)
panel = Panel("""#ee9b00
#ca6702""")

# ----
# Examples
list = ValueList({"Case 1": "case_1", "Case 2": "case_2"}, selected="Case 2")

# ----
# Graph Attributes - Case 2
list_2 = ValueList({"Engrave", "Millimeter Architectural", "Millimeter Large", "Millimeter Small", "Millimeter Small -graph"}, selected="Millimeter Small -graph")
graph_spread = Slider(10, range=0..10)
length_scale_factor = Slider(0.011, range=0..0.4)
width_scale_factor = Slider(177.25, range=0.01..200)
text_y_shift = Slider(20, range=0..20)
graphattributes = Python3Script(
    graph_text=list_2,
    graph_spread=graph_spread,
    length_scale_factor=length_scale_factor,
    width_scale_factor=width_scale_factor,
    text_y_shift=text_y_shift)  # -> out, graph_attributes; inputs graph_spread: Double, length_scale_factor: Double, width_scale_factor: Double
# ---------- graphattributes: Python ----------
"""Grasshopper Script"""

from dataclasses import  dataclass

@dataclass
class GraphAttributes():
    graph_text: str
    graph_spread: float
    length_scale_factor: float
    width_scale_factor: float
    text_y_shift: float


graph_attributes=GraphAttributes(
    graph_text=graph_text, 
    graph_spread=graph_spread, 
    length_scale_factor=length_scale_factor,
    width_scale_factor=width_scale_factor,
    text_y_shift=text_y_shift)
print(graph_attributes)
# ---------- end graphattributes ----------
graph_attributes = Data(graphattributes.graph_attributes)

# ----
# Structure - Case 2
panel_2 = Panel("600")
py3 = Python3Script(
    house_front_height="2400",
    house_back_height="2400",
    roof_type="sheet",
    roof_height="2700",
    roof_load_width="1500",
    house_length="6000",
    stud_spacing_front_wall=panel_2,
    stud_spacing_back_wall=panel_2,
    stud_spacing_side_wall=panel_2,
    front_wall_opening="900",
    rafter_spacing="900",
    joist_spacing="600",
    tie_down_spacing="0",
    roof_mass="10",
    unit_width=number_slider)  # -> out, structure, framing_group_ids, front_wall_A_width, front_wall_B_width, house_width; inputs house_front_height: Int32, house_back_height: Int32, roof_type: String, roof_height: Int32, roof_load_width: Int32, house_length: Int32, stud_spacing_front_wall: Int32, stud_spacing_back_wall: Int32, stud_spacing_side_wall: Int32, front_wall_opening: Int32, rafter_spacing: Int32, joist_spacing: Int32, tie_down_spacing: Int32, roof_mass: Int32, unit_width: Double
# ---------- py3: Python ----------
import json
import jsonpickle
import copy
from cubbyhouse.utils import IO_FOLDERS
from cubbyhouse.array import DiscreteJoints
from cubbyhouse.building import (
    FramingGroup,
    DeckingParams,
    DeckJoistParams,
    FloorBearerParams,
    WallStudParams,
    JambStudParams,
    LintelParams,
    TopPlateParams,
    BottomPlateParams,
    RafterParams,
    TimberFramedStructure
    # DeckJoistParams
)

####################
# Create Case JSONS
####################
front_wall_A_width =(house_length-front_wall_opening)*2/3
# house_front_height = 2700
# house_back_height = 2400
# roof_load_width = 1500  #NOTE - lintel roof_load_width is [1500,3000,4500,6000,7500]
house_width = roof_load_width*2
# house_length = 6000
# rafter_spacing = 450  #NOTE - lintel rafter_spacing is [600,1200]
# stud_spacing_front_wall = 600
# stud_spacing_back_wall=600
# stud_spacing_side_wall = 600
# front_wall_opening_width = 900
# roof_type="sheet"
# tie_down_spacing = 0
# joist_spacing = 600
# roof_mass = 10
# unit_width=100
house_width = roof_load_width*2
roof_span = (house_width**2 + (roof_height-house_back_height)**2)**0.5

# top_plates_lam_x = 3
top_plates_lam_y = 2 

# bot_plates_lam_x = 3
bot_plates_lam_y = 2 



front_wall_A = FramingGroup(
    "F1", #front wall
    length=house_front_height,
    width=(house_length-front_wall_opening)*2/3,
    design_parameters=WallStudParams(
        design_span=house_front_height, 
        span_type="single",
        rafter_spacing=rafter_spacing,
        roof_type=roof_type,
        roof_load_width=roof_load_width,
        stud_spacing=stud_spacing_front_wall                
    ),
    max_parts_per_length=1
)

front_jamb = FramingGroup(
    "F2",
    length=house_front_height,
    width=front_wall_opening,
    design_parameters=JambStudParams(
    design_span=house_front_height, 
    span_type="single",
    # rafter_spacing=rafter_spacing,
    roof_type=roof_type,
    opening_width=front_wall_opening,
            roof_load_width=roof_load_width,
            # stud_spacing=stud_spacing_front_wall                
        ),
        max_parts_per_length=1
    )

lintel = FramingGroup(
    "F3",
    length=front_wall_opening,
    width=unit_width,
    design_parameters=LintelParams(
        design_span=front_wall_opening, 
        span_type="single",
        rafter_spacing=rafter_spacing,
        roof_type=roof_type,
        roof_load_width=roof_load_width,         
    ),
    max_parts_per_length=1
)

front_wall_B = FramingGroup(
    "F4", #front wall
    length=house_front_height,
    width=(house_length-front_wall_opening)*1/3,
    design_parameters=WallStudParams(
        design_span=house_front_height, 
        span_type="single",
        rafter_spacing=rafter_spacing, 
        roof_type=roof_type,
        roof_load_width=roof_load_width,
        stud_spacing=stud_spacing_front_wall           
    ),
    max_parts_per_length=1
)

side_wall_A = FramingGroup(
    "F5", #side wall
    length=house_back_height,
    width=house_width,
    design_parameters=WallStudParams(
        design_span=house_back_height, 
        span_type="single",
        rafter_spacing=rafter_spacing, #? not sure what this is used for -> if RLW =0 though should be irrelevant
        roof_type=roof_type, #ditto
        roof_load_width=0,
        stud_spacing=stud_spacing_side_wall                
    ),
    max_parts_per_length=2,
    transverse_laminations=2
)


back_wall = FramingGroup(
    "F6", #back wall
    length=house_back_height,
    width=house_length,
    design_parameters=WallStudParams(
        design_span=house_back_height, 
        span_type="single",
        rafter_spacing=rafter_spacing,
        roof_type=roof_type,
        roof_load_width=roof_load_width,
        stud_spacing=stud_spacing_back_wall                
    ),
    max_parts_per_length=1
)

side_wall_B = copy.deepcopy(side_wall_A)
side_wall_B.name = "F7"


#############
# TOP PLATES
#############

top_plate_front = FramingGroup(
    "F8", #top_plate
    length=house_length,
    width=unit_width,
    design_parameters=TopPlateParams(
        design_span=stud_spacing_front_wall, 
        span_type="continuous",
        rafter_spacing=rafter_spacing,
        roof_type=roof_type, #ditto
        roof_load_width=roof_load_width,    
        tie_down_spacing = tie_down_spacing    
    ),
    max_parts_per_length=4,
    transverse_laminations=top_plates_lam_y
)


top_plate_side_A = FramingGroup(
    "F9", #top_plate
    length=house_width,
    width=unit_width,
    design_parameters=TopPlateParams(
        design_span=stud_spacing_side_wall, 
        span_type="continuous",
        rafter_spacing=rafter_spacing, #needed?
        roof_type=roof_type,  #needed?
        roof_load_width=0,    
        tie_down_spacing = tie_down_spacing    
    ),
    max_parts_per_length=2,
    transverse_laminations=top_plates_lam_y
)


top_plate_back = FramingGroup(
    "F10", #top_plate
    length=house_length,
    width=unit_width,
    design_parameters=TopPlateParams(
        design_span=stud_spacing_back_wall, 
        span_type="continuous",
        rafter_spacing=rafter_spacing,
        roof_type=roof_type, #ditto
        roof_load_width=roof_load_width,    
        tie_down_spacing = tie_down_spacing    
    ),
    max_parts_per_length=4,
    transverse_laminations=top_plates_lam_y
)

top_plate_side_B = copy.deepcopy(top_plate_side_A)
top_plate_side_B.name = "F11"

#############
# BOT PLATES
#############


bot_plate_front = FramingGroup(
    "F12", #bot_plate
    length=house_length,
    width=unit_width,
    design_parameters=BottomPlateParams(
        design_span=joist_spacing, 
        span_type="continuous",
        rafter_spacing=rafter_spacing,
        roof_type=roof_type, 
        roof_load_width=roof_load_width,    
        # tie_down_spacing = tie_down_spacing    
    ),
    max_parts_per_length=4,
    transverse_laminations=bot_plates_lam_y
)


bot_plate_side_A = FramingGroup(
    "F13", 
    length=house_width,
    width=unit_width,
    design_parameters=BottomPlateParams(
        design_span=0,  #note - parallel to joists
            span_type="continuous",
            rafter_spacing=rafter_spacing, #needed?
            roof_type=roof_type,  #needed?
            roof_load_width=0,       
        ),
        max_parts_per_length=2,
        transverse_laminations=bot_plates_lam_y
    )


bot_plate_back = FramingGroup(
    "F14", #top_plate
    length=house_length,
    width=unit_width,
    design_parameters=BottomPlateParams(
        design_span=joist_spacing, 
        span_type="continuous",
        rafter_spacing=rafter_spacing,
        roof_type=roof_type, #ditto
        roof_load_width=roof_load_width,    
    ),
    max_parts_per_length=4,
    transverse_laminations=bot_plates_lam_y
)

bot_plate_side_B = copy.deepcopy(bot_plate_side_A)
bot_plate_side_B.name = "F15"



rafters_A = FramingGroup(
    "F16", #rafter
    length=int(roof_span/2), 
    width=house_length,
    design_parameters=RafterParams(
        design_span=int(roof_span/2), 
        span_type="single",
        rafter_spacing=rafter_spacing,
        roof_mass=roof_mass, #ditto    
    ),
    max_parts_per_length=1,
    transverse_laminations=1
)

rafters_B = copy.deepcopy(rafters_A)
rafters_B.name = "F17"



# battens_A = FramingGroup(
#     "F18", #rafter
#     length=house_length, 
#     width=int(roof_span/2),
#     design_parameters=RoofBattenParams(
#         design_span=rafter_spacing, 
#         span_type="continuous",
#         roof_type=roof_type,
#         batten_spacing=batten_spacing,  
#     ),
#     max_parts_per_length=3,
#     transverse_laminations=1
# )

# battens_B = copy.deepcopy(battens_A)
# battens_B.name = "F19"


# update framing group joints
framing_groups = [
    front_wall_A, front_jamb, lintel, front_wall_B,
    side_wall_A, 
    back_wall,
    side_wall_B,
    top_plate_front, top_plate_side_A, top_plate_back, top_plate_side_B,
    bot_plate_front, bot_plate_side_A, bot_plate_back, bot_plate_side_B,
    rafters_A, rafters_B
]

for framing_group in framing_groups:
    if framing_group not in [bot_plate_side_A, bot_plate_side_B, side_wall_A, side_wall_B]:
        framing_group.update_framing_group_joints(joints_from="design_span")
    elif framing_group in [bot_plate_side_A, bot_plate_side_B]:
        framing_group.discrete_joints= DiscreteJoints.from_support_span(framing_group.length, stud_spacing_side_wall)
    else:
        framing_group.discrete_joints=DiscreteJoints.from_support_span(framing_group.length, house_back_height/3)

structure = TimberFramedStructure.from_list(framing_groups)

framing_group_ids = list(structure.framing_groups.keys())
# ---------- end py3 ----------

gold = Colour(panel)

# ----
# Structure - Import from File
structurefromfile = Python3Script(case=list)  # -> structure, framing_group_ids; inputs case: String; disabled
# ---------- structurefromfile: Python ----------
from cubbyhouse.utils import get_structure_from_case_id

####################################
# CREATE STRUCTURE, STOCK, MEDIATOR
####################################

structure = get_structure_from_case_id(case)
framing_group_ids = list(structure.framing_groups.keys())
# ---------- end structurefromfile ----------

# ----
# Stock - Import from File
stockfromfile = Python3Script(case=list)  # -> board_stock, section_group_ids; inputs case: String
# ---------- stockfromfile: Python ----------
from cubbyhouse.utils import get_stock_file_from_case_id
from cubbyhouse.boardstock import BoardStock

####################################
# CREATE STRUCTURE, STOCK, MEDIATOR
####################################
board_stock = BoardStock.from_element_group_csv(get_stock_file_from_case_id(case))

print("\n Element Groups:")
print(board_stock.element_group_df)
print("\n Section Groups:")
print(board_stock.section_group_df)

section_group_ids = list(board_stock.section_group_df.index)
# ---------- end stockfromfile ----------
panel_3 = Panel(stockfromfile.board_stock)

# ----
# Target Planes - Case 2
pt = Point(Point(8026.454116, 6926.423427, 0))
panel_4 = Panel("""True
True
True
True
True
True
True
True
True
True
True
True
True
True
True
True
True""")
cluster = Cluster_3(
    corner_pt=pt,
    house_length="6000",
    house_front_height="2400",
    house_back_height="2400",
    roof_height="2700",
    front_wall_a_width=py3.front_wall_A_width,
    front_wall_b_width=py3.front_wall_B_width,
    front_wall_opening_width="900",
    house_width=py3.house_width,
    unit_width=number_slider)
rotate_section = Boolean(panel_4)
case2 = Plane(simplify(graft(cluster)))

# ----
# Mediator
cubbyhousemediator = Python3Script(structure=py3.structure, board_stock=stockfromfile.board_stock)  # -> mediator
# ---------- cubbyhousemediator: Python ----------
"""Grasshopper Script"""

from cubbyhouse.mediator import CubbyhouseMediator


mediator = CubbyhouseMediator(structure, board_stock)
# ---------- end cubbyhousemediator ----------

# ----
# Stage 1 Visualiser
view_graph = BooleanToggle(False)

# ----
# Stage 1: Dispatch
threshold_score = Slider(7.8, range=0..10)
list_3 = ValueList({"STAGE0_ALL": 0, "STAGE1_STRUCT": 1, "STAGE2_MIN_SIZE": 2, "STAGE3_FINAL_ALLOCATION": 3}, selected="STAGE3_FINAL_ALLOCATION")
cubbyhousemediator_2 = Python3Script(mediator=cubbyhousemediator, dispatch_stage=list_3, threshold_score=threshold_score)  # -> mediator, dispatch_matrix, normalised_dispatch_matrix; inputs dispatch_stage: Int32, threshold_score: Double
# ---------- cubbyhousemediator_2: Python ----------
"""Grasshopper Script"""


from cubbyhouse.mediator import DispatchStage

mediator.THRESHOLD_SCORE = threshold_score

print(dispatch_stage)
if dispatch_stage==0:
    mediator.dispatch_section_groups(DispatchStage.STAGE0_ALL)
elif dispatch_stage==1:
    mediator.dispatch_section_groups(DispatchStage.STAGE1_STRUCT)
elif dispatch_stage==2:
    mediator.dispatch_section_groups(DispatchStage.STAGE2_MIN_SIZE)
elif dispatch_stage==3:
    
    mediator.dispatch_section_groups(DispatchStage.STAGE3_FINAL_ALLOCATION)

# mediator.dispatch_element_groups(DispatchStage.STAGE3_FINAL_ALLOCATION)
print(mediator.dispatch_matrix)
print(mediator.normalised_dispatch_matrix)

dispatch_matrix = mediator.dispatch_matrix
normalised_dispatch_matrix = mediator.normalised_dispatch_matrix
print(dispatch_matrix.sum().sum())
# ---------- end cubbyhousemediator_2 ----------
panel_5 = Panel(cubbyhousemediator_2.dispatch_matrix)
panel_6 = Panel(cubbyhousemediator_2.normalised_dispatch_matrix)

# ----
# All Stock Length Chart
view_graph_2 = Boolean(view_graph)
graph_attributes_2 = Data(graph_attributes)
allstocklengthchart = AllStockLengthChart(show=view_graph_2, mediator=cubbyhousemediator_2.mediator, graph_attributes=graph_attributes_2)  # -> stock_graph_text_3, stock_bar_chart_3
preview = CustomPreview(Geometry=allstocklengthchart.stock_bar_chart_3, Material=ColourSwatch(SwatchColor=RGBA(166, 166, 166, 116)))
preview_2 = CustomPreview(Geometry=allstocklengthchart.stock_graph_text_3, Material=ColourSwatch(SwatchColor=RGB(181, 181, 181)))

panel_7 = Panel("""15
16""")  # disabled
panel_8 = Panel("""7
8
9
10
11
12
13
14""")  # disabled
panel_9 = Panel("""0
1
2
3
4
5
6""")  # disabled
path = ConstructPath(Indices=graft(panel_9))  # -> simplify(Branch); disabled

# ----
# Stage 2 Visualiser
show_jointing_patterns = BooleanToggle(False)
show_cutting_patterns = BooleanToggle(False)
show_parts = BooleanToggle(False)
show_element_groups = BooleanToggle(False)
show_member_groups = BooleanToggle(False)
show_members_3d = BooleanToggle(False)
show_elements = BooleanToggle(False)
show_members = BooleanToggle(False)

# ----
# Elements
# todo: rename boards to elements
stockdata = Python3Script(mediator=cubbyhousemediator_2.mediator)  # -> elements, element_groups
# ---------- stockdata: Python ----------
#boards should be elements
boards = mediator.export_elements()
elements=boards
# elements = mediator.export_elements()
element_groups = mediator.export_element_groups()
# ---------- end stockdata ----------

# ----
# Stage 2:
# Patterns
solve_patterns = BooleanToggle(True)

# ----
# Members, Jointing Patterns, Parts
memberjointing = Python3Script(mediator=cubbyhousemediator_2.mediator, solve_patterns=solve_patterns)  # -> mediator, members, member_groups, jointing_patterns, parts
# ---------- memberjointing: Python ----------
###############################
# MEMBER AND JOINTING PATTERN
###############################
if solve_patterns:
    print("Member Jointing Pattern Generation:")
    mediator.create_members() #create members including member jointing patterns
    print(f'\n Member Demand Vector Q_m: \n {mediator.Q_m}')
    print(f'\n Jointing Pattern Member Supply Matrix [M]: \n {mediator.M_matrix}')
    print(f'\n Jointing Pattern Part Demand Matrix [J]: \n {mediator.J_matrix}')

    member_groups = mediator.export_member_groups()

    members = mediator.export_members()

    jointing_patterns = mediator.export_jointing_patterns()
    parts = mediator.export_parts()
# ---------- end memberjointing ----------

# ----
# Plotting Params
list_4 = ValueList({"Engrave", "Millimeter Architectural", "Millimeter Large", "Millimeter Small"}, selected="Millimeter Small")
member_spread = Slider(-1.2, range=-3..0)
x_spread = Slider(514, range=0..1000)
block_spread_ve = Panel("-200")
block_spread_ve_2 = Panel("200")
members_json = Data(memberjointing.members)
elements = Data(stockdata.elements)
parts_json = Data(memberjointing.parts)
max_l = Max_L(path=parts_json)
max_l_2 = Max_L(path=elements)
max_l_3 = Max_L(path=members_json)
y_shift_ve = Panel("-1000")
y_shift_ve_2 = Panel("0")
max_member_length = Number(max_l_3)
max_part_length = Number(max_l)
max_element_length = Number(max_l_2)
addition = Addition(A=max_element_length, B=x_spread)
part_x_shift = Number(expr("-x/2", max_part_length))
addition_2 = Addition(A=max_member_length, B=x_spread)
neg = Negative(Value=addition)
series = Series(Start=neg, Step=neg, Count=2)  # -> simplify(graft(Series))
series_2 = Series(Start=0, Step=addition_2, Count=2)  # -> simplify(graft(Series))
bang = ExplodeTree(Data=simplify(series))  # -> Branch0, Branch1
bang_2 = ExplodeTree(Data=simplify(series_2))  # -> Branch0, Branch1

# ----
# Cutting Patterns
# Todo - Flow Control
elementcutting = Python3Script(mediator=memberjointing.mediator, solve_patterns=solve_patterns)  # -> mediator, cutting_patterns
# ---------- elementcutting: Python ----------
if solve_patterns:
    print("\n Element Cutting Pattern Generation:")
    mediator.create_element_group_cutting_patterns(pattern_type = 'no_usable_residual')
    print(f'\n Cutting Pattern Part Supply Matrix [C]: \n {mediator.C_matrix}')
    print(f'\n Cutting Pattern Element Demand Matrix [E]: \n {mediator.E_matrix}')
    print(f'\n Cutting Pattern Waste Vector [w]:\n {mediator.w_vector}')
    print(f'\n Element Supply Vector: \n {mediator.Q_e}')
    cutting_patterns = mediator.export_cutting_patterns()
# ---------- end elementcutting ----------

panel_10 = Panel("""0
7000""")
panel_11 = Panel("""0
5500
11000""")
panel_12 = Panel("""0
6000""")

# ----
# Make Elements
panel_13 = Panel("elements")
json_element_groups = Json_element_groups(path=stockdata.elements)  # -> block_definition_2, block_2, block_attributes_2, V_2, V
block_id = Text(flatten(json_element_groups.V_2))
block_definition = Data(json_element_groups.block_definition_2)
bakedata = BakeData(
    text_style=list_4,
    block_id=block_id,
    block_label=block_id,
    bake_name=panel_13,
    spread=block_spread_ve_2,
    x_shift=bang.Branch0,
    y_shift=y_shift_ve_2)  # -> block_instance, bake_name_3, text_2, text_bake_name
bake = BakeObjects(Geometry=bakedata.block_instance, BakeName=bakedata.bake_name_3, Bake=False, createGroups=False)  # -> Message, Ghosts
bake_2 = BakeObjects(Geometry=bakedata.text_2, BakeName=bakedata.text_bake_name, Bake=False, createGroups=False)  # -> Message, Ghosts

panel_14 = Panel("""0
7000
14000""")

# ----
# Make Jointing Patterns
panel_15 = Panel("jointing_patterns")
json_jps = Json_jps(path=memberjointing.jointing_patterns, layer_name=panel_15)  # -> block_definition_2, block_3, block_attributes_2, part_id, name_2, V
block_definition_2 = Data(json_jps.block_definition_2)
block_id_2 = Text(simplify(flatten(json_jps.name_2)))
bakedata_2 = BakeData(
    text_style=list_4,
    block_id=block_id_2,
    block_label=block_id_2,
    bake_name=panel_15,
    spread=block_spread_ve,
    x_shift=bang_2.Branch1,
    y_shift=y_shift_ve)  # -> block_instance, bake_name_3, text_2, text_bake_name
bake_3 = BakeObjects(Geometry=bakedata_2.block_instance, BakeName=bakedata_2.bake_name_3, Bake=False, createGroups=False)  # -> Message, Ghosts
bake_4 = BakeObjects(Geometry=bakedata_2.text_2, BakeName=bakedata_2.text_bake_name, Bake=False, createGroups=False)  # -> Message, Ghosts

# ----
# Make Element Groups
json_element_groups_2 = Json_element_groups_2(path=stockdata.element_groups)  # -> zshift, block_definition_2, block_2, block_attributes_2, name_2, R, V, V_2
block_definition_3 = Data(json_element_groups_2.block_definition_2)
block_id_3 = Text(flatten(json_element_groups_2.name_2))
label = Text(flatten(json_element_groups_2.R))
bakedata_3 = BakeData(
    text_style=list_4,
    block_id=block_id_3,
    block_label=label,
    bake_name="element_groups",
    spread=block_spread_ve_2,
    x_shift=bang.Branch1,
    y_shift=y_shift_ve_2,
    F=json_element_groups_2.zshift)  # -> block_instance, bake_name_3, text_2, text_bake_name
bake_5 = BakeObjects(Geometry=bakedata_3.block_instance, BakeName=bakedata_3.bake_name_3, Bake=False, createGroups=False)  # -> Message, Ghosts
bake_6 = BakeObjects(Geometry=bakedata_3.text_2, BakeName=bakedata_3.text_bake_name, Bake=False, createGroups=False)  # -> Message, Ghosts

# ----
# Make Members
json_member = Json_member(path=memberjointing.members)  # -> block_definition_2, block_2, block_attributes_2, name_2, V_2, V
block_definition_4 = Data(json_member.block_definition_2)
block_id_4 = Text(flatten(json_member.name_2))
bakedata_4 = BakeData(
    text_style=list_4,
    block_id=block_id_4,
    block_label=block_id_4,
    bake_name="members",
    spread=block_spread_ve_2,
    x_shift=bang_2.Branch0,
    y_shift=y_shift_ve_2)  # -> block_instance, bake_name_3, text_2, text_bake_name
bake_7 = BakeObjects(Geometry=bakedata_4.block_instance, BakeName=bakedata_4.bake_name_3, Bake=False, createGroups=False)  # -> Message, Ghosts
bake_8 = BakeObjects(Geometry=bakedata_4.text_2, BakeName=bakedata_4.text_bake_name, Bake=False, createGroups=False)  # -> Message, Ghosts

block_definition_5 = Data(flatten(json_member.block_definition_2))

# ----
# Make Cutting Patterns
json_cps = Json_cps(path=elementcutting.cutting_patterns)  # -> V, block_definition_2, block_3, block_attributes_2, name_2
cutting_pattern_blocks = Data(json_cps.block_definition_2)
block_id_5 = Text(simplify(flatten(json_cps.name_2)))
bakedata_5 = BakeData(
    text_style=list_4,
    block_id=block_id_5,
    block_label=block_id_5,
    bake_name="cutting_patterns",
    spread=block_spread_ve,
    x_shift=bang.Branch1,
    y_shift=y_shift_ve)  # -> block_instance, bake_name_3, text_2, text_bake_name
bake_9 = BakeObjects(Geometry=bakedata_5.block_instance, BakeName=bakedata_5.bake_name_3, Bake=False, createGroups=False)  # -> Message, Ghosts
bake_10 = BakeObjects(Geometry=bakedata_5.text_2, BakeName=bakedata_5.text_bake_name, Bake=False, createGroups=False)  # -> Message, Ghosts

# ----
# Make Member Groups
panel_16 = Panel("member_groups")
json_member_groups = Json_member_groups(path=memberjointing.member_groups, layer_name=panel_16)  # -> block_definition_2, block_2, block_attributes_2, name_2, label_2
block_definition_6 = Data(json_member_groups.block_definition_2)
block_label = Text(flatten(json_member_groups.label_2))
block_id_6 = Text(flatten(json_member_groups.name_2))
bakedata_6 = BakeData(
    text_style=list_4,
    block_id=block_id_6,
    block_label=block_label,
    bake_name=panel_16,
    spread=block_spread_ve_2,
    x_shift=bang_2.Branch1,
    y_shift=y_shift_ve_2)  # -> block_instance, bake_name_3, text_2, text_bake_name
bake_11 = BakeObjects(Geometry=bakedata_6.block_instance, BakeName=bakedata_6.bake_name_3, Bake=False, createGroups=False)  # -> Message, Ghosts
bake_12 = BakeObjects(Geometry=bakedata_6.text_2, BakeName=bakedata_6.text_bake_name, Bake=False, createGroups=False)  # -> Message, Ghosts

# ----
# Make Parts
panel_17 = Panel("parts")
json_block = Json_block(path=memberjointing.parts, layer=panel_17)  # -> block_definition_2, block_2, block_attributes_2, name_2, V
block_definition_7 = Data(json_block.block_definition_2)
block_id_7 = Text(flatten(json_block.name_2))
bakedata_7 = BakeData(
    text_style=list_4,
    block_id=block_id_7,
    block_label=block_id_7,
    bake_name=panel_17,
    spread=block_spread_ve,
    x_shift=part_x_shift,
    y_shift=y_shift_ve)  # -> block_instance, bake_name_3, text_2, text_bake_name
bake_13 = BakeObjects(Geometry=bakedata_7.block_instance, BakeName=bakedata_7.bake_name_3, Bake=False, createGroups=False)  # -> Message, Ghosts
bake_14 = BakeObjects(Geometry=bakedata_7.text_2, BakeName=bakedata_7.text_bake_name, Bake=False, createGroups=False)  # -> Message, Ghosts

# ----
# Show Text
element_blocks = Data(bakedata.text_2)
member_blocks = Data(bakedata_4.text_2)
member_group_blocks = Data(bakedata_6.text_2)
jointing_pattern_blocks = Data(bakedata_2.text_2)
part_blocks = Data(bakedata_7.text_2)
element_group_blocks = Data(bakedata_3.text_2)
cutting_pattern_blocks_2 = Data(bakedata_5.text_2)
gate = StreamGate(Stream=element_blocks, Gate=show_elements)  # -> Target0, Target1
gate_2 = StreamGate(Stream=element_group_blocks, Gate=show_element_groups)  # -> Target0, Target1
gate_3 = StreamGate(Stream=member_blocks, Gate=show_members)  # -> Target0, Target1
gate_4 = StreamGate(Stream=member_group_blocks, Gate=show_member_groups)  # -> Target0, Target1
gate_5 = StreamGate(Stream=jointing_pattern_blocks, Gate=show_jointing_patterns)  # -> Target0, Target1
gate_6 = StreamGate(Stream=part_blocks, Gate=show_parts)  # -> Target0, Target1
gate_7 = StreamGate(Stream=cutting_pattern_blocks_2, Gate=show_cutting_patterns)  # -> Target0, Target1
merge = Merge(
    Data1=gate.Target1,
    Data2=gate_2.Target1,
    Data3=gate_3.Target1,
    Data4=gate_4.Target1,
    Data5=gate_5.Target1,
    Data6=gate_6.Target1,
    Data7=gate_7.Target1)
preview_3 = CustomPreview(Geometry=merge, Material=ColourSwatch(SwatchColor=RGB(0, 0, 0)))

# ----
# Bake Blocks
jointing_pattern_blocks_2 = Data(block_definition_2)
element_group_blocks_2 = Data(block_definition_3)
member_group_blocks_2 = Data(block_definition_6)
cutting_pattern_blocks_3 = Data(cutting_pattern_blocks)
member_blocks_2 = Data(block_definition_4)
element_blocks_2 = Data(block_definition)
part_blocks_2 = Data(block_definition_7)
merge_2 = Merge(
    Data1=element_blocks_2,
    Data2=element_group_blocks_2,
    Data3=member_blocks_2,
    Data4=member_group_blocks_2,
    Data5=jointing_pattern_blocks_2,
    Data6=part_blocks_2,
    Data7=cutting_pattern_blocks_3)  # -> flatten(Result)
listblockd = ListBlocksInDocument(fullName=True)
panel_18 = Panel(listblockd)
pushblk = PushBlockDefinitions(Objects=flatten(merge_2), Activate=Toggle(True), overwriteBlocks=True, activate=False, ValueTable_overwriteBlocks=False)  # -> Objects, Message

panel_19 = Panel(json_element_groups.V)
Y = UnitY(Factor=expr("-x", panel_12))
X = UnitX(Factor=panel_12)
Z = UnitZ(Factor=panel_14)
addition_3 = Addition(A=X, B=Y)
pt_2 = Point(addition_3)
addition_4 = Addition(A=pt_2, B=graft(Z))  # -> simplify(graft(Result))
panel_20 = Panel(json_element_groups_2.V)

# ----
# Stage 3:
# Solve
number_slider_2 = Slider(6, range=0..10)
solve_assignment = BooleanToggle(True)
py3_2 = Python3Script(mediator=elementcutting.mediator, repeat_structure=number_slider_2, solve=solve_assignment)  # -> objective, jointing_results, cutting_results; inputs repeat_structure: Int32, solve: Boolean
# ---------- py3_2: Python ----------
from cubbyhouse.opt import solve_ilp

if solve:
    mediator.MEMBER_MULTIPLIER=repeat_structure
    objective, result_x, result_y, constraints = solve_ilp(mediator)

    jointing_results = mediator.export_jointing_results(result_x)
    cutting_results = mediator.export_cutting_results(result_y)
# ---------- end py3_2 ----------

num = Number(number_slider_2)
multiplication = Multiplication(A=61, B=num)
series_3 = Series(Start=0, Step=12200, Count=num)
Y_2 = UnitY(Factor=series_3)

# ----
# Stage 3 Visualiser
view_2d_cutting_soln = BooleanToggle(False)
view_2d_jointing_soln = BooleanToggle(False)
view_3d_jointing_soln = BooleanToggle(True)
show_parts_pc = Slider(0, range=0..1)

py3_3 = Python3Script(x=py3_2.jointing_results)  # -> out, a
# ---------- py3_3: Python ----------
"""Grasshopper Script"""
a = "Hello Python 3 in Grasshopper!"
print(a)


import pandas as pd
# print(jointing_results)
df = pd.read_json(x)
df['part_count'].sum()
print(df)
print(df['part_count'].sum())

print(df.loc[210:220])
# ---------- end py3_3 ----------

# ----
# Solver Result - Jointing Patterns (2D)
dejson = DeserializeJson(JSON=py3_2.jointing_results, OutputsLocked=False)
dejson_2 = DeserializeJson(JSON=dejson, OutputsLocked=False)  # -> Member_id, Member_group_id, Jointing_pattern_id, Repeat_structure, Part_id, Part_count
concat = Concatenate(FragmentA=dejson_2.Member_id, FragmentB=" -> ", FragmentC=dejson_2.Jointing_pattern_id)
bakedata_8 = BakeData(
    text_style=list_4,
    block_id=dejson_2.Jointing_pattern_id,
    block_label=concat,
    bake_name="jointing_results",
    spread="200",
    x_shift=bang_2.Branch0,
    y_shift="0")  # -> block_instance, bake_name_3, text_2, text_bake_name
bake_15 = BakeObjects(Geometry=bakedata_8.block_instance, BakeName=bakedata_8.bake_name_3, Bake=False, createGroups=False)  # -> Message, Ghosts; disabled
bake_16 = BakeObjects(Geometry=bakedata_8.text_2, BakeName=bakedata_8.text_bake_name, Bake=False, createGroups=False)  # -> Message, Ghosts; disabled

# ----
# Solver Result - Cutting Patterns (2D)
dejson_3 = DeserializeJson(JSON=py3_2.cutting_results, OutputsLocked=False)
dejson_4 = DeserializeJson(JSON=dejson_3, OutputsLocked=False)  # -> Element_id, Element_group_id, Cutting_pattern_id, Part_id, Part_count, Total_part_length, L, WW
concat_2 = Concatenate(FragmentA=dejson_4.Element_id, FragmentB=" -> ", FragmentC=dejson_4.Cutting_pattern_id)
bakedata_9 = BakeData(
    text_style=list_4,
    block_id=dejson_4.Cutting_pattern_id,
    block_label=concat_2,
    bake_name="cutting_results",
    spread="200",
    x_shift=bang.Branch0,
    y_shift="0")  # -> block_instance, bake_name_3, text_2, text_bake_name
bake_17 = BakeObjects(Geometry=bakedata_9.block_instance, BakeName=bakedata_9.bake_name_3, Bake=False, createGroups=False)  # -> Message, Ghosts; disabled
bake_18 = BakeObjects(Geometry=bakedata_9.text_2, BakeName=bakedata_9.text_bake_name, Bake=False, createGroups=False)  # -> Message, Ghosts; disabled

# ----
# Solver Result - Jointing Patterns (2D)
dejson_5 = DeserializeJson(JSON=py3_2.jointing_results, OutputsLocked=False)
dejson_6 = DeserializeJson(JSON=dejson_5, OutputsLocked=False)  # -> Member_id, Member_group_id, Jointing_pattern_id, Repeat_structure, Part_id, Part_count
concat_3 = Concatenate(FragmentA=dejson_6.Member_id, FragmentB=" -> ", FragmentC=dejson_6.Jointing_pattern_id)
bakedata_10 = BakeData(
    text_style=list_4,
    block_id=dejson_6.Jointing_pattern_id,
    block_label=concat_3,
    bake_name="jointing_results",
    spread="200",
    x_shift=bang_2.Branch0,
    y_shift="0")  # -> block_instance, bake_name_3, text_2, text_bake_name
bake_19 = BakeObjects(Geometry=bakedata_10.block_instance, BakeName=bakedata_10.bake_name_3, Bake=False, createGroups=False)  # -> Message, Ghosts; disabled
bake_20 = BakeObjects(Geometry=bakedata_10.text_2, BakeName=bakedata_10.text_bake_name, Bake=False, createGroups=False)  # -> Message, Ghosts; disabled

# ----
# Colours
# Case 2
swatch = ColourSwatch(SwatchColor=RGB(255, 255, 255))
panel_21 = Panel("""#582f0e
#7f4f24
#936639
#a68a64
#b6ad90
#c2c5aa
#a4ac86
#656d4a
#414833
#333d29""")
member_groups_per_jointing_pattern = Data(json_jps.V)
panel_22 = Panel("""#03045e
#023e8a
#0077b6
#0096c7
#00b4d8
#48cae4
#90e0ef""")
panel_23 = Panel("""#590d22
#800f2f
#a4133c
#c9184a
#ff4d6d
#ff758f
#ff8fa3
#ffb3c1""")
member_groups_per_member = Data(json_member.V)
jointing_pattern_soln = Data(dejson_6.Jointing_pattern_id)
null_colour = Colour(swatch)
reds = Colour(panel_23)
blues = Colour(panel_22)
rep = ReplaceText(Text=member_groups_per_jointing_pattern, Find="M", Replace="F", RecursiveReplace=False)
rep_2 = ReplaceText(Text=member_groups_per_member, Find="M", Replace="F", RecursiveReplace=False)
browngreen = Colour(panel_21)
merge_3 = Merge(Data1=blues, Data2=reds, Data3=gold)
rep_3 = ReplaceText(RecursiveReplace=False)
col = Colour(simplify(graft(merge_3)))
stock_colours = Data(browngreen)
colourmapper1 = Python3Script(
    section_groups=stockfromfile.section_group_ids,
    section_group_colours=stock_colours,
    section_groups_per_element_group=flatten(json_element_groups_2.V),
    element_group_id=flatten(json_element_groups_2.V_2),
    element_groups_per_element=flatten(json_element_groups.V),
    element_groups_per_cutting_pattern=flatten(json_cps.V),
    cutting_pattern_id=flatten(json_cps.name_2),
    section_groups_per_part=flatten(json_block.V),
    part_id=flatten(json_block.name_2),
    cutting_pattern_soln=dejson_4.Cutting_pattern_id,
    null_colour=null_colour)  # -> out, section_group_colour_mapper, element_group_colours, element_group_colour_mapper, element_colours, cutting_pattern_colours, part_colours, cutting_pattern_soln_colours, part_colour_mapper; inputs section_groups: list, section_group_colours: list, section_groups_per_element_group: list of String, element_group_id: list of String, element_groups_per_element: list of String, element_groups_per_cutting_pattern: list of String, cutting_pattern_id: list of String, section_groups_per_part: list of String, part_id: list of String, cutting_pattern_soln: list of String
# ---------- colourmapper1: Python ----------
"""Grasshopper Script"""
a = "Hello Python 3 in Grasshopper!"
print(a)

# section_groups = ["G1", "G2", "G3"]
section_group_colour_mapper = {}

for ind, section_group in enumerate(section_groups):
    section_group_colour_mapper[section_group] = section_group_colours[ind]

element_group_colours = []
element_group_colour_mapper ={} 
for loc, section_group in enumerate(section_groups_per_element_group):
    cur_col = section_group_colour_mapper[section_group]
    element_group_colours.append(cur_col)
    element_group_colour_mapper[element_group_id[loc]] = cur_col

element_colours = []
for element_group in element_groups_per_element:
    cur_col = element_group_colour_mapper[element_group]
    element_colours.append(cur_col)


cutting_pattern_colours = []
cutting_pattern_colour_mapper={}
for loc, element_group in enumerate(element_groups_per_cutting_pattern):
    cur_col = element_group_colour_mapper[element_group]
    cutting_pattern_colours.append(cur_col)
    cutting_pattern_colour_mapper[cutting_pattern_id[loc]] = cur_col

part_colours = []
part_colour_mapper = {}
for loc,section_group in enumerate(section_groups_per_part):
    cur_col = section_group_colour_mapper[section_group]
    part_colours.append(cur_col)
    part_colour_mapper[part_id[loc]] = cur_col

cutting_pattern_soln_colours = []
for cutting_pattern in cutting_pattern_soln:
    # print(cutting_pattern)
    if cutting_pattern == '':
        cutting_pattern_soln_colours.append(null_colour)
    else:
        cur_col = cutting_pattern_colour_mapper[cutting_pattern]
        cutting_pattern_soln_colours.append(cur_col)


print(element_group_colour_mapper)
section_group_colour_mapper=[section_group_colour_mapper]
part_colour_mapper=[part_colour_mapper]
# ---------- end colourmapper1 ----------
cutting_pattern_soln_colours = Data(colourmapper1.cutting_pattern_soln_colours)
cutting_pattern_colours = Data(colourmapper1.cutting_pattern_colours)
element_group_colours = Data(colourmapper1.element_group_colours)
framing_group_colours = Data(col)
colourmapper2 = Python3Script(
    framing_groups=py3.framing_group_ids,
    framing_group_colours=flatten(framing_group_colours),
    section_group_colour_mapper=colourmapper1.section_group_colour_mapper,
    framing_groups_per_jointing_pattern=flatten(rep),
    framing_groups_per_member=flatten(rep_2),
    mediator=cubbyhousemediator_2.mediator)  # -> out, jointing_pattern_colours, member_colours; inputs framing_groups: list, framing_group_colours: list, framing_groups_per_jointing_pattern: list, framing_groups_per_member: list
# ---------- colourmapper2: Python ----------
"""Grasshopper Script"""
# a = "Hello Python 3 in Grasshopper!"

# for ind, row in final_assignment.iterrows():
    # print/(ind)

# fg_mapper = dict(zip(final_assignment.index,final_assignment['section_groups']))

# print(fg_mapper)
print(mediator.dispatch_matrix)
final_assignment = mediator.dispatch_final_assignment

a = list(final_assignment.index)
b = list(final_assignment['section_group'])
final_assignment = dict(zip(a,b))


# print(final_assignment)
print(section_group_colour_mapper)

framing_group_colour_mapper = {}
for ind, framing_group in enumerate(framing_groups):
    framing_group_colour_mapper[framing_group] = framing_group_colours[ind]


section_groups = []
jointing_pattern_colours=[]
for framing_group in framing_groups_per_jointing_pattern:
    cur_section_group = final_assignment[framing_group]
    section_groups.append(cur_section_group)
    cur_colour=section_group_colour_mapper[cur_section_group]
    jointing_pattern_colours.append(cur_colour)

member_colours=[]
for framing_group in framing_groups_per_member:
    # cur_section_group = final_assignment[framing_group]
    # section_groups.append(cur_section_group)
    cur_colour=framing_group_colour_mapper[framing_group]
    member_colours.append(cur_colour)
# ---------- end colourmapper2 ----------
element_colours = Data(colourmapper1.element_colours)
part_colours = Data(colourmapper1.part_colours)
jointing_pattern_colours = Data(colourmapper2.jointing_pattern_colours)
member_colours = Data(colourmapper2.member_colours)

# ----
# Framing Groups 3D - Case 1
target_plane = Plane(case2)
mediator = Data(cubbyhousemediator_2.mediator)
show_framing_groups = BooleanToggle(False)
cluster_2 = Cluster(target_plane=target_plane, mediator=mediator)  # -> framing_group_srf_2, permissible_joints, permissible_joint_ordinate
framing_group_colours_2 = Data(framing_group_colours)
show_framing_groups_2 = Boolean(show_framing_groups)
framing_group_srf = Surface(cluster_2.framing_group_srf_2)
permissible_joints = Line(cluster_2.permissible_joints)
filter = StreamFilter(Gate=show_framing_groups_2, Stream1=framing_group_srf)
filter_2 = StreamFilter(Gate=show_framing_groups_2, Stream1=permissible_joints)
preview_4 = CustomPreview(Geometry=filter_2, Material=ColourSwatch(SwatchColor=RGB(38, 28, 2)))
preview_5 = CustomPreview(Geometry=filter, Material=framing_group_colours_2)

# ----
# Member Locations
framing_group_plane = Plane(target_plane)
rotate_section_2 = Boolean(rotate_section)
cluster_3 = Cluster_2(mediator=cubbyhousemediator_2.mediator, target_plane=framing_group_plane, rotate_section=rotate_section_2)  # -> member_loc_planes, member_locations_2, member_length_check, member_loc_planes_excl_trans_lams
show_framing = Boolean(show_framing_groups)
panel_24 = Panel(cluster_3.member_length_check)
path_mapper = PathMapper(cluster_3.member_locations_2, source="{A;B}", target="{A}")
swatch_2 = ColourSwatch(SwatchColor=RGB(112, 112, 112))
filter_3 = StreamFilter(Gate=show_framing, Stream1=path_mapper)
preview_6 = CustomPreview(Geometry=filter_3, Material=swatch_2)

# ----
# Short Stock Chart
graph_attributes_3 = Data(graph_attributes)
stock_colours_2 = Data(stock_colours)
view_graph_3 = Boolean(view_graph)
shortlengthchart = ShortLengthChart(show=view_graph_3, mediator=cubbyhousemediator_2.mediator, graph_attributes=graph_attributes_3)  # -> allocated_graph_text_3, allocated_bar_chart_3
outline = Curve(shortlengthchart.allocated_bar_chart_3)
preview_7 = CustomPreview(Geometry=shortlengthchart.allocated_graph_text_3, Material=ColourSwatch(SwatchColor=RGB(64, 64, 64)))
preview_8 = CustomPreview(Geometry=shortlengthchart.allocated_bar_chart_3, Material=ColourSwatch(SwatchColor=RGB(46, 46, 46)))

# ----
# Allocated Stock Length Chart
graph_attributes_4 = Data(graph_attributes)
stock_colours_3 = Data(stock_colours)
view_graph_4 = Boolean(view_graph)
allocatedlengthchart = AllocatedLengthChart(show=view_graph_4, mediator=cubbyhousemediator_2.mediator, graph_attributes=graph_attributes_4)  # -> allocated_graph_text_3, allocated_bar_chart_3
outline_2 = Curve(allocatedlengthchart.allocated_bar_chart_3)
preview_9 = CustomPreview(Geometry=allocatedlengthchart.allocated_bar_chart_3, Material=stock_colours_3)
preview_10 = CustomPreview(Geometry=[allocatedlengthchart.allocated_graph_text_3, outline_2], Material=ColourSwatch(SwatchColor=RGB(0, 0, 0)))

# ----
# Required Member Length Graph
graph_attributes_5 = Data(graph_attributes)
view_graph_5 = Boolean(view_graph)
framing_group_colours_3 = Data(framing_group_colours)
requiredlengthchart = RequiredLengthChart(show=view_graph_5, mediator=cubbyhousemediator_2.mediator, graph_attributes=graph_attributes_5)  # -> req_graph_text_2, req_bar_chart_2, vertical_axis_2
outline_3 = Curve(requiredlengthchart.req_bar_chart_2)
preview_11 = CustomPreview(Geometry=requiredlengthchart.req_bar_chart_2, Material=framing_group_colours_3)
preview_12 = CustomPreview(Geometry=[requiredlengthchart.req_graph_text_2, outline_3], Material=ColourSwatch(SwatchColor=RGB(0, 0, 0)))

split = SplitTree(Data=framing_group_colours_2, Masks=flatten(path))  # -> Positive, Negative; disabled
split_2 = SplitTree(Data=filter, Masks=flatten(path))  # -> Positive, Negative; disabled
split_3 = SplitTree(Data=filter_3, Masks=flatten(path))  # -> Positive, Negative; disabled
pln = Plane(cluster_3.member_loc_planes)
preview_13 = CustomPreview(Geometry=split_2.Positive, Material=split.Positive)  # disabled
preview_14 = CustomPreview(Geometry=split_3.Positive, Material=swatch_2)  # disabled
repeat = RepeatData(Data=member_colours, Length=multiplication)

# ----
# Nudge jamb stud parameters
member_loc_planes = Plane(pln)
P = Path("{1}")
Y_3 = UnitY(Factor=expr("-35", "35"))
Y_4 = UnitY(Factor="35")
branch = TreeBranch(Tree=member_loc_planes, Path=P, MaintainPaths=True)
merge_4 = Merge(Data1=Y_4, Data2=Y_3)
move = Move(Geometry=branch, Motion=merge_4)  # -> Geometry, Transform
split_4 = SplitTree(Data=member_loc_planes, Masks=flatten(P))  # -> Positive, Negative
merge_5 = Merge(Data1=move.Geometry, Data2=split_4.Negative)

member_loc_planes_2 = Plane(flatten(merge_5))
move_2 = Move(Geometry=member_loc_planes_2, Motion=addition_4)  # -> Geometry, Transform
move_3 = Move(Geometry=member_loc_planes_2, Motion=addition_4)  # -> flatten(Geometry), Transform

# ----
# Solver Result - Jointing Patterns (3D)
panel_25 = Panel("jointing_results_in_space")
member_loc_planes_3 = Plane(flatten(move_3.Geometry))
bakeinspace = BakeInSpace(
    text_style=list_4,
    block_id=dejson_2.Jointing_pattern_id,
    block_label=concat,
    bake_name=panel_25,
    target_plane=member_loc_planes_3)  # -> block_instance, bake_name_3, text_2, text_bake_name
bake_21 = BakeObjects(Geometry=bakeinspace.block_instance, BakeName=bakeinspace.bake_name_3, Bake=False, createGroups=False)  # -> Message, Ghosts; disabled
bake_22 = BakeObjects(Geometry=bakeinspace.text_2, BakeName=bakeinspace.text_bake_name, Bake=False, createGroups=False)  # -> Message, Ghosts; disabled

# ----
# View Pattern Solution - Full Pattern
# (remove first nested block - element or member) remaining blocks are parts
cutting_pattern_soln_colours_2 = Data(simplify(graft(cutting_pattern_soln_colours)))
cutting_patterns = Data(bakedata_9.text_2)
jointing_patterns = Data(bakedata_10.text_2)
cutting_patterns_2 = Data(bakedata_9.block_instance)
jointing_patterns_2 = Data(bakedata_10.block_instance)
expblock = ExplodeBlock(Block=jointing_patterns_2, recursive=False)  # -> Name, Transform, Geometry
expblock_2 = ExplodeBlock(Block=cutting_patterns_2, recursive=False)  # -> Name, Transform, Geometry
cull_i = CullIndex(List=expblock_2.Geometry, Indices=0, Wrap=True)
cull_i_2 = CullIndex(List=expblock.Geometry, Indices=0, Wrap=True)
gate_8 = StreamGate(Stream=jointing_patterns, Gate=view_2d_jointing_soln)  # -> Target0, Target1
gate_9 = StreamGate(Stream=cull_i, Gate=view_2d_jointing_soln)  # -> Target0, Target1
gate_10 = StreamGate(Stream=cutting_patterns, Gate=view_2d_cutting_soln)  # -> Target0, Target1
gate_11 = StreamGate(Stream=cull_i_2, Gate=view_2d_jointing_soln)  # -> Target0, Target1
preview_15 = CustomPreview(Geometry=gate_8.Target1, Material=ColourSwatch(SwatchColor=RGB(0, 0, 0)))
preview_16 = CustomPreview(Geometry=gate_10.Target1, Material=ColourSwatch(SwatchColor=RGB(0, 0, 0)))
preview_17 = CustomPreview(Geometry=gate_9.Target1, Material=cutting_pattern_soln_colours_2)
preview_18 = CustomPreview(Geometry=gate_11.Target1, Material=ColourSwatch(SwatchColor=RGB(35, 102, 161)))

number_slider_3 = Slider(760, range=0..760)
button = Button()  # disabled
toggle = BooleanToggle(True)  # disabled
txt = Text("-")
getcamera = GetCamera(GetCamera=toggle)  # -> Location, Target, LensLength, UpDirection; disabled
animcamera = AnimateCamera(SaveCameraState=button, Reset=False)  # disabled
data = Data(Point(3486.353466, 31462.50476, 55654.78235))  # disabled
Y_5 = UnitY(Factor=Slider(90, range=0..100))
data_2 = Data(Point(3852.738982, 70714.57709, 63641.48573))  # disabled
data_3 = Data(Point(2990.709599, 73715.4585, 40.03080454))  # disabled
panel_26 = Panel(data_3)  # disabled
data_4 = Data(Vector(0, 1, 0))  # disabled
data_5 = Data(2.356409599e-05)  # disabled
number_slider_4 = Slider(30, range=0..100)  # disabled
pdecon = Deconstruct(Point=data_3)  # -> XComponent, YComponent, ZComponent; disabled
xy = XYPlane(Origin=Y_5)
panel_27 = Panel("760")  # disabled
data_6 = Data(Point(3112.754264, 1499.785974, -17643.0841))  # disabled
data_7 = Data(Point(3112.754264, 1499.785974, 55654.78235))  # disabled
data_8 = Data(242.8156524)  # disabled
data_9 = Data(Vector(0, 1, 0))  # disabled
pdecon_2 = Deconstruct(Point=data_6)  # -> XComponent, YComponent, ZComponent; disabled
subtraction = Subtraction(A=pdecon.YComponent, B=pdecon_2.YComponent)  # disabled
subtraction_2 = Subtraction(A=number_slider_3, B=number_slider_4)  # disabled
pdecon_3 = Deconstruct(Point=data)  # -> XComponent, YComponent, ZComponent; disabled
division = Division(A=subtraction, B=panel_27)  # disabled
toggle_2 = BooleanToggle(False)  # disabled
min = Minimum(B=0)  # disabled
max = Maximum(A=subtraction_2, B=0)  # disabled
multiplication_2 = Multiplication(A=max, B=division)  # disabled
addition_5 = Addition(A=pdecon_2.YComponent, B=multiplication_2)  # disabled
pt_3 = ConstructPoint(XCoordinate=pdecon_3.XComponent, YCoordinate=addition_5, ZCoordinate=pdecon_3.ZComponent)  # disabled
pt_4 = ConstructPoint(XCoordinate=pdecon_3.XComponent, YCoordinate=addition_5, ZCoordinate=pdecon_3.ZComponent)  # disabled
panel_28 = Panel(data_6)  # disabled
setcam = SetCamera(CameraLocation=pt_3, TargetLocation=pt_4, LensLength=data_8, UpDirection=data_9, Activate=toggle_2)  # disabled
Z_2 = UnitZ(Factor=100)

# ----
# Show Blocks
jointing_pattern_colours_2 = Data(simplify(graft(jointing_pattern_colours)))
cutting_pattern_colours_2 = Data(simplify(graft(cutting_pattern_colours)))
element_group_colours_2 = Data(simplify(graft(element_group_colours)))
jointing_pattern_blocks_3 = Data(bakedata_2.block_instance)
member_colours_2 = Data(simplify(graft(repeat)))
element_colours_2 = Data(simplify(graft(element_colours)))
framing_group_colours_4 = Data(framing_group_colours)
member_group_blocks_3 = Data(bakedata_6.block_instance)
cutting_pattern_blocks_4 = Data(bakedata_5.block_instance)
element_group_blocks_3 = Data(bakedata_3.block_instance)
part_colours_2 = Data(simplify(graft(part_colours)))
member_blocks_3 = Data(bakedata_4.block_instance)
element_blocks_3 = Data(bakedata.block_instance)
part_blocks_3 = Data(bakedata_7.block_instance)
gate_12 = StreamGate(Stream=cutting_pattern_blocks_4, Gate=show_cutting_patterns)  # -> Target0, Target1
gate_13 = StreamGate(Stream=element_blocks_3, Gate=show_elements)  # -> Target0, Target1
gate_14 = StreamGate(Stream=element_group_blocks_3, Gate=show_element_groups)  # -> Target0, Target1
gate_15 = StreamGate(Stream=member_blocks_3, Gate=show_members)  # -> Target0, Target1
gate_16 = StreamGate(Stream=member_group_blocks_3, Gate=show_member_groups)  # -> Target0, Target1
gate_17 = StreamGate(Stream=jointing_pattern_blocks_3, Gate=show_jointing_patterns)  # -> Target0, Target1
gate_18 = StreamGate(Stream=part_blocks_3, Gate=show_parts)  # -> Target0, Target1
preview_19 = CustomPreview(Geometry=gate_18.Target1, Material=part_colours_2)
preview_20 = CustomPreview(Geometry=gate_16.Target1, Material=framing_group_colours_4)
preview_21 = CustomPreview(Geometry=gate_13.Target1, Material=element_colours_2)
preview_22 = CustomPreview(Geometry=gate_14.Target1, Material=element_group_colours_2)
expblock_3 = ExplodeBlock(Block=gate_17.Target1, recursive=False)  # -> Name, Transform, Geometry
expblock_4 = ExplodeBlock(Block=gate_14.Target1, recursive=False)  # -> Name, Transform, Geometry
expblock_5 = ExplodeBlock(Block=gate_12.Target1, recursive=False)  # -> Name, Transform, Geometry
explode = ExplodeObject(Object=expblock_4.Geometry, Recursive=False)
split_5 = SplitList(List=expblock_3.Geometry, Index=1)  # -> ListA, ListB
split_6 = SplitList(List=expblock_5.Geometry, Index=1)  # -> ListA, ListB
merge_6 = Merge(Data1=split_5.ListA, Data2=split_6.ListA)
crv = Curve(explode)
preview_23 = CustomPreview(Geometry=simplify(split_6.ListB), Material=cutting_pattern_colours_2)
preview_24 = CustomPreview(Geometry=merge_6, Material=ColourSwatch(SwatchColor=RGBA(214, 209, 188, 147)))
preview_25 = CustomPreview(Geometry=simplify(split_5.ListB), Material=jointing_pattern_colours_2)
swatch_3 = ColourSwatch(SwatchColor=RGB(145, 127, 9))
preview_26 = CustomPreview(Geometry=crv, Material=ColourSwatch(SwatchColor=RGB(0, 0, 0)))

move_4 = Move(Geometry=gate_15.Target1, Motion=Y_2)  # -> Geometry, Transform

preview_27 = CustomPreview(Geometry=move_4.Geometry, Material=member_colours_2)

# ----
# Members (3D)
block_definition_8 = Data(flatten(json_member.block_definition_2))
block_id_8 = Text(flatten(json_member.name_2))
member_loc_planes_4 = Plane(flatten(merge_5))
member_colours_3 = Data(simplify(member_colours))
lng = ListLength(List=block_definition_8)
lng_2 = ListLength(List=block_definition_8)
lng_3 = ListLength(List=block_definition_8)
multiplication_3 = Multiplication(A=number_slider_2, B=lng)
multiplication_4 = Multiplication(A=number_slider_2, B=lng_2)
multiplication_5 = Multiplication(A=number_slider_2, B=lng_3)
repeat_2 = RepeatData(Data=block_id_8, Length=multiplication_3)
repeat_3 = RepeatData(Data=block_definition_8, Length=multiplication_4)
repeat_4 = RepeatData(Data=member_colours_3, Length=multiplication_5)
bakeinspace_2 = BakeInSpace(text_style=list_4, block_id=repeat_2, block_label=repeat_3, bake_name="members_in_space", target_plane=move_3.Geometry)  # -> block_instance, bake_name_3, text_2, text_bake_name
member_blocks_4 = Data(simplify(graft(bakeinspace_2.block_instance)))
gate_19 = StreamGate(Stream=member_blocks_4, Gate=show_members_3d)  # -> Target0, Target1

member_colours_4 = Data(simplify(graft(repeat_4)))

preview_28 = CustomPreview(Geometry=gate_19.Target1, Material=member_colours_4)

# ----
# View Pattern Solution - Part Order (3D)
# Note: number cutting parts > number jointing parts as some parts are unused
part_colour_mapper = Data(colourmapper1.part_colour_mapper)
jointing_patterns_3 = Data(bakedata_10.block_instance)
cutting_patterns_3 = Data(bakedata_9.block_instance)
expblock_6 = ExplodeBlock(Block=jointing_patterns_3, recursive=False)  # -> Name, Transform, Geometry
expblock_7 = ExplodeBlock(Block=cutting_patterns_3, recursive=False)  # -> Name, Transform, Geometry
cull_i_3 = CullIndex(List=expblock_6.Geometry, Indices=0, Wrap=True)
cull_i_4 = CullIndex(List=expblock_7.Geometry, Indices=0, Wrap=True)
expblock_8 = ExplodeBlock(Block=simplify(cull_i_3), recursive=False)  # -> Name, Transform, Geometry
expblock_9 = ExplodeBlock(Block=simplify(cull_i_4), recursive=False)  # -> Name, Transform, Geometry
data_10 = Data(flatten(expblock_9.Name))
data_11 = Data(flatten(expblock_9.Geometry))
data_12 = Data(flatten(expblock_8.Geometry))
data_13 = Data(flatten(expblock_8.Name))
py3_4 = Python3Script(list_cp=data_10, list_jp=data_13, part_colour_mapper=part_colour_mapper)  # -> out, mapping, locations, part_colours; inputs list_cp: list, list_jp: list
# ---------- py3_4: Python ----------
# Define the two lists
# list_cp = ["P4", "P5", "P5", "P1", "P1", "P1", "P1", "P1", "P1"]
# list_jp = ["P0", "P3", "P14", "P0", "P3", "P14", "P0", "P3", "P14", "P0"]
from math import nan

# Function to map locations based on occurrence
def map_locations(list_cp, list_jp):
    # Track index positions of each part in list_jp
    index_map = {}
    for idx, part in enumerate(list_cp):
        if part not in index_map:
            index_map[part] = []
        index_map[part].append(idx)

    # Track occurrences of parts in list_cp and map to list_jp indices
    part_count = {}
    result = []

    for part in list_jp:
        if part not in part_count:
            part_count[part] = 0
        part_count[part] += 1

        # If the part exists in list_jp and there's an available occurrence
        if part in index_map and part_count[part] <= len(index_map[part]):
            corresponding_index = index_map[part][part_count[part] - 1]
            result.append((part, corresponding_index))
        else:
            # If no match exists, indicate "Not Found"
            result.append((part, nan))
            ...
    return result

# Run the function and store results
mapping = map_locations(list_cp, list_jp)

locations=[]
part_names = []
# Display results
part_colours =[]
print(part_colour_mapper)
# print("Element in List1", "Corresponding Index in List2")
for item in mapping:
    locations.append(item[1])
    cur_part_name = item[0]
    part_names.append(cur_part_name)
    print(cur_part_name)
    part_colours.append(part_colour_mapper[item[0]])
    # print(f"{item[0]:<16} {item[1]}")
# ---------- end py3_4 ----------
py3_5 = Python3Script(list1=data_13, list2=data_10, part_colour_mapper=part_colour_mapper)  # -> out, mapping, locations, part_names, part_colours; inputs list1: list, list2: list
# ---------- py3_5: Python ----------
# Define the two lists
# list1 = ["P4", "P5", "P5", "P1", "P1", "P1", "P1", "P1", "P1"]
# list2 = ["P0", "P3", "P14", "P0", "P3", "P14", "P0", "P3", "P14", "P0"]
from math import nan

# Function to map locations based on occurrence
def map_locations(list1, list2):
    # Track index positions of each element in list2
    index_map = {}
    for idx, element in enumerate(list2):
        if element not in index_map:
            index_map[element] = []
        index_map[element].append(idx)

    # Track occurrences of elements in list1 and map to list2 indices
    element_count = {}
    result = []

    for element in list1:
        if element not in element_count:
            element_count[element] = 0
        element_count[element] += 1

        # If the element exists in list2 and there's an available occurrence
        if element in index_map and element_count[element] <= len(index_map[element]):
            corresponding_index = index_map[element][element_count[element] - 1]
            result.append((element, corresponding_index))
        else:
            # If no match exists, indicate "Not Found"
            result.append((element, nan))
            ...
    return result

# Run the function and store results
mapping = map_locations(list1, list2)

locations=[]
part_names = []
# Display results
part_colours =[]
print(part_colour_mapper)
# print("Element in List1", "Corresponding Index in List2")
for item in mapping:
    locations.append(item[1])
    cur_part_name = item[0]
    part_names.append(cur_part_name)
    print(cur_part_name)
    part_colours.append(part_colour_mapper[item[0]])
    # print(f"{item[0]:<16} {item[1]}")
# ---------- end py3_5 ----------
item = ListItem(List=data_12, Index=py3_4.locations, Wrap=True)
lng_4 = ListLength(List=item)
remap = RemapNumbers(Value=show_parts_pc, Source=Domain(0, 1), Target=lng_4)  # -> Mapped, Clipped
item_2 = ListItem(List=data_11, Index=py3_5.locations, Wrap=True)
int = Integer(number_slider_3)
split_7 = SplitList(List=py3_4.part_colours, Index=int)  # -> ListA, ListB
split_8 = SplitList(List=item_2, Index=int)  # -> ListA, ListB
split_9 = SplitList(List=data_12, Index=int)  # -> ListA, ListB
element_blocks_4 = Data(bakedata.block_instance)
jointing_parts = Data(split_9.ListA)
cutting_parts = Data(split_8.ListA)
text_style = Data(list_4)
and = GateAnd(A=view_2d_cutting_soln, B=view_2d_jointing_soln)
gate_20 = StreamGate(Stream=element_blocks_4, Gate=view_2d_cutting_soln)  # -> Target0, Target1
gate_21 = StreamGate(Stream=jointing_parts, Gate=view_2d_jointing_soln)  # -> Target0, Target1
gate_22 = StreamGate(Stream=cutting_parts, Gate=view_2d_cutting_soln)  # -> Target0, Target1
swatch_4 = ColourSwatch(SwatchColor=RGB(0, 0, 0))
preview_29 = CustomPreview(Geometry=gate_22.Target1, Material=split_7.ListA)
preview_30 = CustomPreview(Geometry=gate_21.Target1, Material=split_7.ListA)
preview_31 = CustomPreview(Geometry=gate_20.Target1, Material=ColourSwatch(SwatchColor=RGBA(214, 209, 188, 147)))

# ----
# View Pattern Solution - Part Order (3D)
jointing_patterns_4 = Data(bakeinspace.block_instance)
expblock_10 = ExplodeBlock(Block=jointing_patterns_4, recursive=False)  # -> Name, Transform, Geometry
cull_i_5 = CullIndex(List=expblock_10.Geometry, Indices=0, Wrap=True)
expblock_11 = ExplodeBlock(Block=simplify(cull_i_5), recursive=False)  # -> Name, Transform, Geometry
data_14 = Data(flatten(expblock_11.Geometry))
split_10 = SplitList(List=data_14, Index=int)  # -> ListA, ListB
jointing_parts_2 = Data(split_10.ListA)
gate_23 = StreamGate(Stream=jointing_parts_2, Gate=view_3d_jointing_soln)  # -> Target0, Target1
preview_32 = CustomPreview(Geometry=gate_23.Target1, Material=split_7.ListA)

panel_29 = Panel(expblock_11.Geometry)
explode_2 = ExplodeObject(Object=jointing_parts_2, Recursive=False)
crv_2 = Curve(flatten(explode_2))
gate_24 = StreamGate(Stream=crv_2, Gate=view_3d_jointing_soln)  # -> Target0, Target1
split_11 = SplitList(Index=int)  # -> ListA, ListB
preview_33 = CustomPreview(Geometry=gate_24.Target1, Material=ColourSwatch(SwatchColor=RGB(0, 0, 0)))
merge_7 = Merge(Data1=txt, Data2=py3_5.part_names)
item_3 = ListItem(List=jointing_parts, Index=-1, Wrap=True)
item_4 = ListItem(List=cutting_parts, Index=-1, Wrap=True)
item_5 = ListItem(List=flatten(merge_7), Index=number_slider_3, Wrap=True)
text = DefineTextObject(Text=simplify(graft(number_slider_3)), Plane=xy, DimensionStyle=text_style)
data_15 = Data(text)
preview_34 = CustomPreview(Geometry=data_15, Material=swatch_4)

brep = Brep(item_3)
brep_2 = Brep(item_4)
bbox = BoundingBox(Content=brep, Plane=PlaneXY(0, 0, 0), UnionBox=True)  # -> Box, Box_2
bbox_2 = BoundingBox(Content=brep_2, Plane=PlaneXY(0, 0, 0), UnionBox=True)  # -> Box, Box_2
box = EvaluateBox(Box=bbox.Box, UParameter=0.5, VParameter=0.5, WParameter=0.5)  # -> Plane, Point, Include
box_2 = EvaluateBox(Box=bbox_2.Box, UParameter=0.5, VParameter=0.5, WParameter=0.5)  # -> Plane, Point, Include
text_2 = DefineTextObject(Text=simplify(graft(item_5)), Plane=PlaneXY(0, 0, 0), DimensionStyle=text_style)
ln = Line(StartPoint=box.Point, EndPoint=box_2.Point)
gate_25 = StreamGate(Stream=ln, Gate=and)  # -> Target0, Target1
data_16 = Data(text_2)
preview_35 = CustomPreview(Geometry=data_16, Material=swatch_4)

move_5 = Move(Geometry=gate_25.Target1, Motion=Z_2)  # -> Geometry, Transform

preview_36 = CustomPreview(Geometry=move_5.Geometry, Material=ColourSwatch(SwatchColor=RGB(0, 0, 0)))

# ==== cluster Cluster
mediator = ClusterInput()
mediator_2 = Data(mediator)
py3 = Python3Script(mediator=mediator_2)  # -> framing_groups
# ---------- py3: Python ----------
framing_groups=list(mediator.structure.framing_groups.values())
# ---------- end py3 ----------
py3_2 = Python3Script(framing_group=simplify(graft(py3)))  # -> framing_group_id, length, width, max_parts_per_length, simplify(permissible_joints)
# ---------- py3_2: Python ----------
framing_group_id = framing_group.name
length=framing_group.length
width=framing_group.width
# design_parameters=framing_group..design_parameters
max_parts_per_length=framing_group.max_parts_per_length

permissible_joints = framing_group.discrete_joints.ordinates
permissible_joints=[float(x) for x in permissible_joints]

print(permissible_joints)
# ---------- end py3_2 ----------
number_slider = Slider(200, range=0..200)
number_slider_2 = Slider(50, range=0..100)
addition = Addition(B=number_slider_2)
addition_2 = Addition(B=number_slider)
neg = Negative(Value=number_slider_2)
neg_2 = Negative(Value=number_slider)
Y = UnitY(Factor=py3_2.permissible_joints)
panel = Panel(py3_2.length)
pt = ConstructPoint(XCoordinate=0, YCoordinate=neg, ZCoordinate=0)
pt_2 = ConstructPoint(XCoordinate=0, YCoordinate=neg_2, ZCoordinate=0)
pt_3 = ConstructPoint(XCoordinate=py3_2.length, YCoordinate=py3_2.width, ZCoordinate=0)
target_plane = ClusterInput()
rec_2pt = Rectangle2Pt(Plane=PlaneXY(0, 0, 0), PointA=Point(0, 0, 0), PointB=pt_3, Radius=0)  # -> Rectangle, Length
X = UnitX(Factor=py3_2.permissible_joints)
ln = Line(StartPoint=pt, EndPoint=pt_2)
permissible_joint_ordinate = ClusterOutput(Y)
move = Move(Geometry=ln, Motion=X)  # -> Geometry, Transform
framing_group_srf = Surface(rec_2pt.Rectangle)
target_plane_2 = Plane(target_plane)
orient = Orient(Geometry=move.Geometry, Source=PlaneXY(0, 0, 0), Target=target_plane_2)  # -> Permissible_joints, Transform
orient_2 = Orient(Geometry=framing_group_srf, Source=PlaneXY(0, 0, 0), Target=target_plane_2)  # -> Framing_group_srf, Transform
framing_group_srf_2 = ClusterOutput(orient_2.Framing_group_srf)
permissible_joints = ClusterOutput(orient.Permissible_joints)

# ==== cluster Cluster_2
mediator = ClusterInput()
rotate_section = ClusterInput()
mediator_2 = Data(mediator)
py3 = Python3Script(mediator=mediator_2)  # -> out, simplify(flatten(framing_group_ids)), simplify(flatten(assigned_section_group))
# ---------- py3: Python ----------
print(mediator.dispatch_matrix)
first_nonzero_idx = (mediator.dispatch_matrix != 0).idxmax()

print(first_nonzero_idx)

framing_group_ids = list(first_nonzero_idx.index)
assigned_section_group=list(first_nonzero_idx.values)
# ---------- end py3 ----------
rotate_section_2 = Boolean(rotate_section)
panel = Panel(py3.assigned_section_group)
panel_2 = Panel(py3.framing_group_ids)
memberqty = Python3Script(mediator=mediator_2, framing_group_name=py3.framing_group_ids, section_group_name=py3.assigned_section_group)  # -> spacing, qty, lam_y, length, simplify(member_locs)
# ---------- memberqty: Python ----------
from numpy import arange
# spacing = mediator.element_group_spacing_df.at[section_group_name,framing_group_name]
# spacing = float(spacing)
qty = mediator.section_group_quantity_df.at[section_group_name,framing_group_name]
qty = int(qty)
framing_group = mediator.structure.framing_groups[framing_group_name]
lam_y = framing_group.transverse_laminations
lam_y= int(lam_y)
length = framing_group.length


member_locs = mediator.member_location_df.at[section_group_name,framing_group_name]
# ---------- end memberqty ----------
target_plane = ClusterInput()
member_locs = Data(simplify(memberqty.member_locs))
Y = UnitY(Factor=member_locs)
member_ordinates = Vector(Y)
memberlocs = MemberLocs(
    member_ordinates=member_ordinates,
    target_plane=target_plane,
    lam_y=simplify(graft(memberqty.lam_y)),
    length=simplify(graft(memberqty.length)),
    rotate_section=rotate_section_2)  # -> simplify(member_locs_3), member_loc_planes, member_loc_planes_excl_trans_lams
panel_3 = Panel(memberlocs.member_loc_planes)
number_slider = Slider(10, range=0..10)
len = Length(Curve=memberlocs.member_locs_3)
ma = MassAddition(Input=len)  # -> flatten(Member_length_check), PartialResults
# TODO: lam_y >1
data = Data(memberlocs.member_loc_planes)
X = UnitX(Factor=memberqty.length)
pt = ConstructPoint(XCoordinate=0, YCoordinate=0, ZCoordinate=0)
Y_2 = UnitY(Factor=number_slider)
deplane = DeconstructPlane(Plane=data)  # -> Origin, XAxis, YAxis, ZAxis
number_slider_2 = Slider(10, range=0..10)
ln = Line(StartPoint=pt, EndPoint=X)  # -> simplify(graft(Line))
member_locs_2 = Line(memberlocs.member_locs_3)
series = Series(Start=0, Step=number_slider, Count=memberqty.lam_y)  # -> simplify(Series)
member_loc_planes = ClusterOutput(memberlocs.member_loc_planes)
member_length_check = ClusterOutput(ma.Member_length_check)
panel_4 = Panel(deplane.XAxis)
Y_3 = UnitY(Factor=series)
pipe = Pipe(Curve=member_locs_2, Radius=number_slider_2, Caps=1)
Z = UnitZ(Factor=expr("2*x", number_slider_2))
move = Move(Geometry=ln, Motion=Y_3)  # -> Geometry, Transform
panel_5 = Panel(member_locs_2)  # disabled
pipe_2 = Pipe(Curve=move.Geometry, Radius=number_slider_2, Caps=1)  # disabled
move_2 = Move(Geometry=simplify(pipe), Motion=Z)  # -> simplify(Geometry), Transform
member_loc_planes_excl_trans_lams = ClusterOutput(memberlocs.member_loc_planes_excl_trans_lams)
cap = CapHoles(Brep=pipe_2)  # -> simplify(Brep); disabled
member_locations = Geometry(move_2.Geometry)
path_mapper = PathMapper(cap, source="{A;B}", target="{A}")  # disabled
member_locations_2 = ClusterOutput(member_locations)
orient = Orient(Geometry=cap, Source=PlaneXY(0, 0, 0), Target=graft(memberlocs.member_loc_planes))  # -> Geometry, Transform; disabled

# ==== cluster Json_element_groups
path = ClusterInput()
dejson = DeserializeJson(JSON=path, OutputsLocked=False)
data = Data(simplify(graft(dejson)))
dejson_2 = DeserializeJson(JSON=data, OutputsLocked=False)  # -> Element_id, D, B, L, Element_group_id
element_group_id = Panel("element_group_id")
dejsonkv = DeserializeKeysAndValues(JSON=data)  # -> simplify(Key), simplify(Value)
dejsonkv_2 = DeserializeKeysAndValues(JSON=data, Keys="D")  # -> simplify(Key), simplify(Value)
dejsonkv_3 = DeserializeKeysAndValues(JSON=data, Keys="B")  # -> simplify(Key), simplify(Value)
dejsonkv_4 = DeserializeKeysAndValues(JSON=data, Keys="L")  # -> simplify(Key), simplify(Value)
dejsonkv_5 = DeserializeKeysAndValues(JSON=data, Keys="element_id")  # -> simplify(Key), simplify(Value)
dejsonkv_6 = DeserializeKeysAndValues(JSON=data, Keys=element_group_id)  # -> simplify(Key), simplify(Value)
keysearch = KeyValueSearch(Keys=dejsonkv.Key, Values=dejsonkv.Value, FullLayerName="FullLayerName")  # disabled
keysearch_2 = KeyValueSearch(Keys=dejsonkv.Key, Values=dejsonkv.Value, MaterialName="MaterialName")  # disabled
cuboid = Cuboid(length=dejsonkv_4.Value, width=dejsonkv_2.Value, thickness=dejsonkv_3.Value)  # -> cross_section_2, solid
# Make Block (Single Instance)
ef_att = EleFrontAttributes(Keys=dejsonkv.Key, Values=dejsonkv.Value, ColourSource="Object", ObjectColour=ColourSwatch(SwatchColor=RGB(94, 94, 94)))  # -> Attributes, Keys, Values, Name, Layer, ColourSource, DisplayColour, MaterialSource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
panel = Panel(dejsonkv_5.Value)
xy = XYPlane(Origin=Point(0, 0, 0))
# Make Block Definition (Geom Only)
defembed = DefineEmbeddedBlock(Geometry=cuboid.solid, Attributes=ef_att.Attributes, BlockName=dejsonkv_5.Value, BasePlane=PlaneXY(0, 0, 0))
V = ClusterOutput(dejsonkv_6.Value)
insert = InsertBlock(BlockName=dejsonkv_5.Value, Plane=xy)
block_definition = Data(defembed)
block_attributes = Data(ef_att.Attributes)
block = Data(insert)
V_2 = ClusterOutput(dejsonkv_5.Value)
block_definition_2 = ClusterOutput(block_definition)
block_2 = ClusterOutput(block)
block_attributes_2 = ClusterOutput(block_attributes)

# ==== cluster Json_element_groups_2
path = ClusterInput()
dejson = DeserializeJson(JSON=path, OutputsLocked=False)
data = Data(simplify(graft(dejson)))
dejson_2 = DeserializeJson(JSON=data, OutputsLocked=False)  # -> Size, Grade, D, B, L, Qty, Batch, L_total, Section_group, Element_group_id
panel = Panel(dejson_2.Section_group)
dejsonkv = DeserializeKeysAndValues(JSON=data)  # -> simplify(Key), simplify(Value)
keysearch = KeyValueSearch(Keys=dejsonkv.Key, Values=dejsonkv.Value, FullLayerName="FullLayerName")  # disabled
keysearch_2 = KeyValueSearch(Keys=dejsonkv.Key, Values=dejsonkv.Value, MaterialName="MaterialName")  # disabled
dejsonkv_2 = DeserializeKeysAndValues(JSON=data, Keys="D")  # -> simplify(Key), simplify(Value)
dejsonkv_3 = DeserializeKeysAndValues(JSON=data, Keys="B")  # -> simplify(Key), simplify(Value)
dejsonkv_4 = DeserializeKeysAndValues(JSON=data, Keys="qty")  # -> simplify(Key), simplify(Value)
dejsonkv_5 = DeserializeKeysAndValues(JSON=data, Keys="section_group")  # -> simplify(Key), simplify(Value)
dejsonkv_6 = DeserializeKeysAndValues(JSON=data, Keys="element_group_id")  # -> simplify(Key), simplify(Value)
dejsonkv_7 = DeserializeKeysAndValues(JSON=data, Keys="L")  # -> simplify(Key), simplify(Value)
dejsonkv_8 = DeserializeKeysAndValues(JSON=data, Keys="element_group_id_and_qty")  # -> simplify(Key), simplify(Value)
dejsonkv_9 = DeserializeKeysAndValues(JSON=data, Keys="element_group_id")  # -> simplify(Key), simplify(Value)
series = Series(Start=0, Step=dejsonkv_3.Value, Count=dejsonkv_4.Value)  # -> simplify(Series)
cuboid = Cuboid(length=dejsonkv_7.Value, width=dejsonkv_2.Value, thickness=dejsonkv_3.Value)  # -> cross_section_2, solid
concat = Concatenate(FragmentA=dejsonkv_6.Value, FragmentB=" (x", FragmentC=dejsonkv_4.Value, FragmentD=")")
Z = UnitZ(Factor=series)
ef_att = EleFrontAttributes(Keys=dejsonkv.Key, Values=dejsonkv.Value)  # -> Attributes, Keys, Values, Name, Layer, ColourSource, DisplayColour, MaterialSource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
zshift = ClusterOutput(series)
panel_2 = Panel("""F14 Seasoned Hardwood
F14 Seasoned Hardwood
F14 Seasoned Hardwood
F14 Seasoned Hardwood
F14 Seasoned Hardwood
F5
MGP10""")
# Make Block (Single Instance)
xy = XYPlane(Origin=Point(0, 0, 0))
# Make Block Definition (Geom Only)
defembed = DefineEmbeddedBlock(Geometry=cuboid.solid, Attributes=ef_att.Attributes, BlockName=dejsonkv_6.Value, BasePlane=PlaneXY(0, 0, 0))
V = ClusterOutput(dejsonkv_5.Value)
name = Data(dejsonkv_6.Value)
insert = InsertBlock(BlockName=dejsonkv_6.Value, Plane=xy)
V_2 = ClusterOutput(dejsonkv_9.Value)
R = ClusterOutput(concat)
block_definition = Data(defembed)
block_attributes = Data(ef_att.Attributes)
panel_3 = Panel(name)
block = Data(insert)
name_2 = ClusterOutput(name)
block_definition_2 = ClusterOutput(block_definition)
block_2 = ClusterOutput(block)
block_attributes_2 = ClusterOutput(block_attributes)
data_2 = Data(simplify(graft(panel_2)))
concat_2 = Concatenate(
    FragmentA=dejsonkv_8.Value,
    FragmentB=" ",
    FragmentC=dejsonkv_2.Value,
    FragmentD="x",
    FragmentE=dejsonkv_3.Value,
    FragmentF="x",
    FragmentG=dejsonkv_7.Value,
    FragmentH=" ",
    FragmentI=data_2)  # disabled
panel_4 = Panel(concat_2)

# ==== cluster BakeData
block_label = ClusterInput()
x_shift = ClusterInput()
y_shift = ClusterInput()
block_id = ClusterInput()
F = ClusterInput()
text_style = ClusterInput()
bake_name = ClusterInput()
X = UnitX(X_shift=x_shift)
Z = UnitZ(Factor=F)
Y = UnitY(Y_shift=y_shift)
block_label_2 = Text(block_label)
block_id_2 = Data(block_id)
text_style_2 = Data(text_style)
spread = ClusterInput()
flip = FlipMatrix(Data=Z)
spread_2 = Number(spread)
y_shi = Vector(Y)
x_shift_2 = Vector(X)
lng = ListLength(List=block_id_2)
series = Series(Start=0, Step=spread_2, Count=lng)
txt = Text(block_label_2)
Y_2 = UnitY(Factor=series)
addition = Addition(A=simplify(graft(Y_2)), B=x_shift_2, C=y_shi, D=Z)
addition_2 = Addition(A=simplify(graft(Y_2)), B=x_shift_2, C=y_shi)
xy = XYPlane(Origin=addition)
insert = InsertBlock(BlockName=simplify(graft(block_id_2)), Plane=xy)
text = DefineTextObject(Text=simplify(graft(txt)), Plane=addition_2, DimensionStyle=text_style_2)
bake_name_2 = Data(bake_name)
concat = Concatenate(FragmentA=bake_name_2, FragmentB="_text")
text_2 = ClusterOutput(text)
bake_name_3 = ClusterOutput(bake_name_2)
block_instance = ClusterOutput(insert)
text_bake_name = ClusterOutput(concat)

# ==== cluster Json_member
path = ClusterInput()
dejson = DeserializeJson(JSON=path, OutputsLocked=False)
data = Data(simplify(graft(dejson)))
dejson_2 = DeserializeJson(JSON=data, OutputsLocked=False)  # -> Member_id, L, Member_group_id
dejsonkv = DeserializeKeysAndValues(JSON=data)  # -> simplify(Key), simplify(Value)
panel = Panel("D")
panel_2 = Panel("B")
dejsonkv_2 = DeserializeKeysAndValues(JSON=data, Keys="L")  # -> simplify(Key), simplify(Value)
dejsonkv_3 = DeserializeKeysAndValues(JSON=data, Keys="member_group_id")  # -> simplify(Key), simplify(Value)
dejsonkv_4 = DeserializeKeysAndValues(JSON=data, Keys="member_id")  # -> simplify(Key), simplify(Value)
keysearch = KeyValueSearch(Keys=dejsonkv.Key, Values=dejsonkv.Value, FullLayerName="FullLayerName")  # disabled
keysearch_2 = KeyValueSearch(Keys=dejsonkv.Key, Values=dejsonkv.Value, MaterialName="MaterialName")  # disabled
pt = ConstructPoint(XCoordinate=0, YCoordinate=0, ZCoordinate=0)
X = UnitX(Factor=dejsonkv_2.Value)
# Make Block (Single Instance)
ef_att = EleFrontAttributes(Keys=dejsonkv.Key, Values=dejsonkv.Value)  # -> Attributes, Keys, Values, Name, Layer, ColourSource, DisplayColour, MaterialSource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
ln = Line(StartPoint=pt, EndPoint=X)
move = Move(Motion=Vector(0, 0, 10))  # -> Geometry, Transform
panel_3 = Panel(dejsonkv_4.Value)
xy = XYPlane(Origin=Point(0, 0, 0))
# Make Block Definition (Geom Only)
defembed = DefineEmbeddedBlock(Geometry=ln, Attributes=ef_att.Attributes, BlockName=dejsonkv_4.Value, BasePlane=PlaneXY(0, 0, 0))
name = Data(dejsonkv_4.Value)
insert = InsertBlock(BlockName=dejsonkv_4.Value, Plane=xy)
block_definition = Data(defembed)
block_attributes = Data(ef_att.Attributes)
name_2 = ClusterOutput(name)
block = Data(insert)
V = ClusterOutput(dejsonkv_3.Value)
V_2 = ClusterOutput(dejsonkv_4.Value)
block_definition_2 = ClusterOutput(block_definition)
block_2 = ClusterOutput(block)
block_attributes_2 = ClusterOutput(block_attributes)

# ==== cluster Json_block
path = ClusterInput()
dejson = DeserializeJson(JSON=path, OutputsLocked=False)
data = Data(simplify(graft(dejson)))
dejson_2 = DeserializeJson(JSON=data, OutputsLocked=False)  # -> L, Section_group, D, B, Part_name
layer = ClusterInput()
dejsonkv = DeserializeKeysAndValues(JSON=data)  # -> simplify(Key), simplify(Value)
dejsonkv_2 = DeserializeKeysAndValues(JSON=data, Keys="section_group")  # -> simplify(Key), simplify(Value)
dejsonkv_3 = DeserializeKeysAndValues(JSON=data, Keys="B")  # -> simplify(Key), simplify(Value)
dejsonkv_4 = DeserializeKeysAndValues(JSON=data, Keys="L")  # -> simplify(Key), simplify(Value)
dejsonkv_5 = DeserializeKeysAndValues(JSON=data, Keys="D")  # -> simplify(Key), simplify(Value)
list = ValueList({"Layer", "Material", "Object", "Parent"}, selected="Layer")
dejsonkv_6 = DeserializeKeysAndValues(JSON=data, Keys="part_name")  # -> simplify(Key), simplify(Value)
layer_2 = Data(layer)
panel = Panel(dejsonkv_5.Value)
V = ClusterOutput(dejsonkv_2.Value)
cuboid = Cuboid(length=dejsonkv_4.Value, width=dejsonkv_5.Value, thickness=dejsonkv_3.Value)  # -> cross_section_2, solid
# Make Block (Single Instance)
ef_att = EleFrontAttributes(Keys=dejsonkv.Key, Values=dejsonkv.Value, Layer=layer_2, ColourSource=list)  # -> Attributes, Keys, Values, Name, Layer, ColourSource, DisplayColour, MaterialSource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
xy = XYPlane(Origin=Point(0, 0, 0))
# Make Block Definition (Geom Only)
defembed = DefineEmbeddedBlock(Geometry=cuboid.solid, Attributes=ef_att.Attributes, BlockName=dejsonkv_6.Value, BasePlane=PlaneXY(0, 0, 0))
insert = InsertBlock(BlockName=dejsonkv_6.Value, Plane=xy)
name = Data(dejsonkv_6.Value)
block_definition = Data(defembed)
block_attributes = Data(ef_att.Attributes)
block = Data(insert)
name_2 = ClusterOutput(name)
block_definition_2 = ClusterOutput(block_definition)
block_2 = ClusterOutput(block)
block_attributes_2 = ClusterOutput(block_attributes)

# ==== cluster Json_member_groups
path = ClusterInput()
dejson = DeserializeJson(JSON=path, OutputsLocked=False)
layer_name = ClusterInput()
data = Data(simplify(graft(dejson)))
dejson_2 = DeserializeJson(JSON=data, OutputsLocked=False)  # -> Qty, L, Framing_group_name, Member_group_id, Member_group_and_qty
layer_name_2 = Data(layer_name)
dejsonkv = DeserializeKeysAndValues(JSON=data)  # -> simplify(Key), simplify(Value)
dejsonkv_2 = DeserializeKeysAndValues(JSON=data, Keys="L")  # -> simplify(Key), simplify(Value)
keysearch = KeyValueSearch(Keys=dejsonkv.Key, Values=dejsonkv.Value, FullLayerName="FullLayerName")  # disabled
keysearch_2 = KeyValueSearch(Keys=dejsonkv.Key, Values=dejsonkv.Value, MaterialName="MaterialName")  # disabled
dejsonkv_3 = DeserializeKeysAndValues(JSON=data, Keys="member_group_id")  # -> simplify(Key), simplify(Value)
dejsonkv_4 = DeserializeKeysAndValues(JSON=data, Keys="member_group_and_qty")  # -> simplify(Key), simplify(Value)
pt = ConstructPoint(XCoordinate=0, YCoordinate=0, ZCoordinate=0)
X = UnitX(Factor=dejsonkv_2.Value)
# Make Block (Single Instance)
ef_att = EleFrontAttributes(Keys=dejsonkv.Key, Values=dejsonkv.Value, Layer=layer_name_2)  # -> Attributes, Keys, Values, Name, Layer, ColourSource, DisplayColour, MaterialSource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
ln = Line(StartPoint=pt, EndPoint=X)
xy = XYPlane(Origin=Point(0, 0, 0))
# Make Block Definition (Geom Only)
defembed = DefineEmbeddedBlock(Geometry=ln, Attributes=ef_att.Attributes, BlockName=dejsonkv_3.Value, BasePlane=PlaneXY(0, 0, 0))
label = Text(dejsonkv_4.Value)
name = Data(dejsonkv_3.Value)
name_2 = ClusterOutput(name)
insert = InsertBlock(BlockName=dejsonkv_3.Value, Plane=xy)
block_definition = Data(defembed)
label_2 = ClusterOutput(label)
block_attributes = Data(ef_att.Attributes)
block = Data(insert)
block_definition_2 = ClusterOutput(block_definition)
block_2 = ClusterOutput(block)
block_attributes_2 = ClusterOutput(block_attributes)

# ==== cluster Json_jps
path = ClusterInput()
layer_name = ClusterInput()
dejson = DeserializeJson(JSON=path, OutputsLocked=False)
layer_name_2 = Data(layer_name)
data = Data(simplify(graft(dejson)))
dejson_2 = DeserializeJson(JSON=data, OutputsLocked=False)  # -> Jointing_pattern_id, simplify(Member_group_id), Part_id, Part_offset, Transverse_offset
Z = UnitZ(Factor=dejson_2.Transverse_offset)
concat = Concatenate(FragmentA=layer_name_2, FragmentB="::members")
concat_2 = Concatenate(FragmentA=layer_name_2, FragmentB="::parts")
multiplication = Multiplication(A=Z, B=Slider(45, range=0..100))
X = UnitX(Factor=dejson_2.Part_offset)
addition = Addition(A=X, B=multiplication)
panel = Panel(multiplication)
xy = XYPlane(Origin=addition)
xy_2 = XYPlane(Origin=Point(0, 0, 0))
dejsonkv = DeserializeKeysAndValues(JSON=data, Keys="member_group_id")  # -> Key, simplify(Value)
dejsonkv_2 = DeserializeKeysAndValues(JSON=data)  # -> simplify(Key), simplify(Value)
V = ClusterOutput(dejsonkv.Value)
insert = InsertBlock(BlockName=dejson_2.Member_group_id, Plane=xy_2)  # -> simplify(Block)
insert_2 = InsertBlock(BlockName=dejson_2.Part_id, Plane=xy)  # -> simplify(Block)
keysearch = KeyValueSearch(Keys=dejsonkv_2.Key, Values=dejsonkv_2.Value, FullLayerName="FullLayerName")  # disabled
keysearch_2 = KeyValueSearch(Keys=dejsonkv_2.Key, Values=dejsonkv_2.Value, MaterialName="MaterialName")  # disabled
merge = Merge(Data1=insert, Data2=insert_2)
block = Data(merge)
replace = ReplaceItems(List=block, Item=concat, Indices=0, Wrap=False)  # -> simplify(List)
lng = ListLength(List=replace)
series = Series(Start=1, Step=1, Count=expr("x-1", lng))
replace_2 = ReplaceItems(List=replace, Item=concat_2, Indices=series, Wrap=False)  # -> simplify(List)
panel_2 = Panel(replace_2)
# Make Block (Single Instance)
ef_att = EleFrontAttributes(Keys=dejsonkv_2.Key, Values=dejsonkv_2.Value, Layer=replace_2)  # -> Attributes, Keys, Values, Name, Layer, ColourSource, DisplayColour, MaterialSource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
panel_3 = Panel(block)
xy_3 = XYPlane(Origin=Point(0, 0, 0))
# Make Block Definition (Geom Only)
defembed = DefineEmbeddedBlock(Geometry=block, BlockName=dejson_2.Jointing_pattern_id, BasePlane=PlaneXY(0, 0, 0))
insert_3 = InsertBlock(BlockName=dejson_2.Jointing_pattern_id, Plane=xy_3)
name = Data(dejson_2.Jointing_pattern_id)
block_definition = Data(defembed)
block_attributes = Data(ef_att.Attributes)
block_2 = Data(insert_3)
name_2 = ClusterOutput(name)
block_definition_2 = ClusterOutput(block_definition)
part_id = ClusterOutput(dejson_2.Part_id)
block_3 = ClusterOutput(block_2)
block_attributes_2 = ClusterOutput(block_attributes)

# ==== cluster Json_cps
path = ClusterInput()
dejson = DeserializeJson(JSON=path, OutputsLocked=False)
data = Data(simplify(graft(dejson)))
# Note: Deserialise Keys + Values only returns first list item for
# part_id and part_offset -> need to use DeJson
panel = Panel("element_group_id")
panel_2 = Panel(data)
dejson_2 = DeserializeJson(JSON=data, OutputsLocked=False)  # -> Element_group_id, simplify(Part_id), Cutting_pattern_id, simplify(Part_offset), Total_part_length
panel_3 = Panel("part_offset")  # disabled
panel_4 = Panel("part_id")  # disabled
panel_5 = Panel(dejson_2.Element_group_id)
dejsonkv = DeserializeKeysAndValues(JSON=data, Keys=panel)  # -> Key, simplify(Value)
dejsonkv_2 = DeserializeKeysAndValues(JSON=data, Keys=panel_3)  # -> Key, simplify(Value); disabled
dejsonkv_3 = DeserializeKeysAndValues(JSON=data, Keys="cutting_pattern_id")  # -> Key, simplify(Value)
dejsonkv_4 = DeserializeKeysAndValues(JSON=data, Keys=panel_4)  # -> Key, simplify(Value); disabled
lng = ListLength(List=flatten(dejson_2.Part_id))
X = UnitX(Factor=dejson_2.Part_offset)
larger = LargerThan(FirstNumber=flatten(lng), SecondNumber=1)  # -> LargerThan, OrEqualTo
xy = XYPlane(Origin=Point(0, 0, 0))
xy_2 = XYPlane(Origin=X)
dejsonkv_5 = DeserializeKeysAndValues(JSON=data)  # -> simplify(Key), simplify(Value)
V = ClusterOutput(dejsonkv.Value)
insert = InsertBlock(BlockName=dejson_2.Part_id, Plane=xy_2)  # -> simplify(Block)
insert_2 = InsertBlock(BlockName=dejsonkv.Value, Plane=xy)  # -> simplify(Block)
keysearch = KeyValueSearch(Keys=dejsonkv_5.Key, Values=dejsonkv_5.Value, FullLayerName="FullLayerName")  # disabled
keysearch_2 = KeyValueSearch(Keys=dejsonkv_5.Key, Values=dejsonkv_5.Value, MaterialName="MaterialName")  # disabled
simplify = SimplifyTree(Tree=simplify(insert), Front=False)
data_2 = Data(simplify(simplify))
merge = Merge(Data1=flatten(insert_2), Data2=flatten(insert))
merge_2 = Merge(Data1=insert_2, Data2=insert)
# Make Block (Single Instance)
ef_att = EleFrontAttributes(Keys=dejsonkv_5.Key, Values=dejsonkv_5.Value)  # -> Attributes, Keys, Values, Name, Layer, ColourSource, DisplayColour, MaterialSource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
filter = StreamFilter(Gate=larger.LargerThan, Stream0=merge, Stream1=merge_2)
block = Data(filter)
xy_3 = XYPlane(Origin=Point(0, 0, 0))
# Make Block Definition (Geom Only)
defembed = DefineEmbeddedBlock(Geometry=block, BlockName=dejsonkv_3.Value, BasePlane=PlaneXY(0, 0, 0))
panel_6 = Panel(dejson_2.Part_offset)
insert_3 = InsertBlock(BlockName=dejsonkv_3.Value, Plane=xy_3)
panel_7 = Panel(block)
name = Data(dejsonkv_3.Value)
block_definition = Data(defembed)
block_attributes = Data(ef_att.Attributes)
block_2 = Data(insert_3)
block_definition_2 = ClusterOutput(block_definition)
name_2 = ClusterOutput(name)
block_3 = ClusterOutput(block_2)
block_attributes_2 = ClusterOutput(block_attributes)

# ==== cluster Max_L
path = ClusterInput()
dejson = DeserializeJson(JSON=path, OutputsLocked=False)
data = Data(simplify(graft(dejson)))
L = Keys("L")
dejsonkv = DeserializeKeysAndValues(JSON=data, Keys=L)  # -> simplify(Key), simplify(Value)
sort = SortList(Keys=flatten(dejsonkv.Value))  # -> Keys, ValuesA
rev = ReverseList(List=sort.Keys)
item = ListItem(List=rev, Index=expr("0", 0), Wrap=True)
max_element_length = Number(item)
max_element_length_2 = ClusterOutput(max_element_length)

# ==== cluster RequiredLengthChart
mediator = ClusterInput()
show = ClusterInput()
mediator_2 = Data(mediator)
show_2 = Boolean(show)
graph_attributes = ClusterInput()
filter = StreamFilter(Gate=show_2, Stream1=mediator_2)
py3 = Python3Script(mediator=filter)  # -> out, framing_group_ids, required_lengths, max_length
# ---------- py3: Python ----------
"""Grasshopper Script"""

framing_group_ids=list(mediator.structure.framing_groups.keys())

print(mediator.section_group_required_length_df)


dispatch_df = mediator.dispatch_matrix
dispatch_matrix = mediator.dispatch_matrix.reset_index(names='section_group').to_json(orient='records')
print(dispatch_matrix)



required_lengths = mediator.section_group_required_length_df.reset_index(names='section_group').to_json(orient='records')
print(required_lengths)

max_required_length=mediator.section_group_required_length_df.max().max()
max_dispatch_length=mediator.dispatch_matrix.max().max()
max_length=max(max_required_length,max_dispatch_length)
max_length=round(max_length,-4)
print(max_length)
# ---------- end py3 ----------
graph_attributes_2 = Data(graph_attributes)
graph_attributes_3 = Data(graph_attributes)
graphattributesdecon = Python3Script(graph_attributes=graph_attributes_3)  # -> out, graph_text, graph_spread, length_scale_factor, width_scale_factor, text_y_shift; same code as graphattributesdecon
requiredlengthbarchart = RequiredLengthBarChart(required_lengths=py3.required_lengths, framing_group_ids=py3.framing_group_ids, graph_attributes=graph_attributes_2)  # -> text_3, G, spread_2
panel = Panel(py3.framing_group_ids)
null = NullItem(Item=filter)  # -> NullFlags, InvalidFlags, Description
multiplication = Multiplication(A=py3.max_length, Length_scale_factor=graphattributesdecon.length_scale_factor)
Y = UnitY(Factor=multiplication)
req_length_graph_text = Data(requiredlengthbarchart.text_3)
req_length_bar_chart = Surface(requiredlengthbarchart.G)
ln = Line(StartPoint=Point(0, 0, 0), EndPoint=Y)
X = UnitX(Factor=requiredlengthbarchart.spread_2)
move = Move(Geometry=ln, Motion=X)  # -> Geometry, Transform
filter_2 = StreamFilter(Gate=null.NullFlags, Stream0=req_length_graph_text)
filter_3 = StreamFilter(Gate=null.NullFlags, Stream0=req_length_bar_chart)
vertical_axis = Data(move.Geometry)
req_graph_text = Data(filter_2)
req_bar_chart = Surface(filter_3)
vertical_axis_2 = ClusterOutput(vertical_axis)
req_bar_chart_2 = ClusterOutput(req_bar_chart)
req_graph_text_2 = ClusterOutput(req_graph_text)

# ==== cluster AllStockLengthChart
show = ClusterInput()
mediator = ClusterInput()
show_2 = Boolean(show)
mediator_2 = Data(mediator)
filter = StreamFilter(Gate=show_2, Stream1=mediator_2)
py3 = Python3Script(mediator=filter)  # -> out, framing_group_ids, section_groups, section_group_ids
# ---------- py3: Python ----------
"""Grasshopper Script"""
# a = "Hello Python 3 in Grasshopper!"
# print(a)

framing_group_ids=list(mediator.structure.framing_groups.keys())

section_group_ids = list(mediator.stock.section_group_df.index)
section_groups = mediator.stock.section_group_df.to_json(orient="records")
# ---------- end py3 ----------
graph_attributes = ClusterInput()
dejson = DeserializeJson(JSON=py3.section_groups, OutputsLocked=False)
graph_attributes_2 = Data(graph_attributes)
dejsonkv = DeserializeKeysAndValues(JSON=dejson, Keys="L_total")  # -> Key, flatten(Value)
stocklengthbarchart = StockLengthBarChart(
    stock_length=dejsonkv.Value,
    framing_group_ids=py3.framing_group_ids,
    section_group_ids=py3.section_group_ids,
    graph_attributes=graph_attributes_2)  # -> V, text_3, G
stock_graph_text = Data(stocklengthbarchart.text_3)
stock_bar_chart = Surface(stocklengthbarchart.G)
filter_2 = StreamFilter(Gate=0, Stream0=stock_graph_text)
filter_3 = StreamFilter(Gate=0, Stream0=stock_bar_chart)
stock_graph_text_2 = Data(filter_2)
stock_bar_chart_2 = Surface(filter_3)
stock_graph_text_3 = ClusterOutput(stock_graph_text_2)
stock_bar_chart_3 = ClusterOutput(stock_bar_chart_2)

# ==== cluster AllocatedLengthChart
mediator = ClusterInput()
show = ClusterInput()
mediator_2 = Data(mediator)
show_2 = Boolean(show)
filter = StreamFilter(Gate=show_2, Stream1=mediator_2)
py3 = Python3Script(mediator=filter)  # -> out, framing_group_ids, dispatch_matrix, section_group_ids
# ---------- py3: Python ----------
"""Grasshopper Script"""
# a = "Hello Python 3 in Grasshopper!"
# print(a)

framing_group_ids=list(mediator.structure.framing_groups.keys())

section_group_ids = list(mediator.stock.section_group_df.index)
dispatch_matrix = mediator.dispatch_matrix.reset_index(names='section_group').to_json(orient='records')
# ---------- end py3 ----------
framing_group_ids = Text(py3.framing_group_ids)
graph_attributes = ClusterInput()
dejson = DeserializeJson(JSON=py3.dispatch_matrix, OutputsLocked=False)
dejsonkv = DeserializeKeysAndValues(JSON=dejson, Keys=graft(framing_group_ids))  # -> Key, simplify(Value)
graph_attributes_2 = Data(graph_attributes)
path_mapper = PathMapper(dejsonkv.Value, source="{A;B}", target="{B}")
dispatch_lengths = Number(path_mapper)
flip = FlipMatrix(Data=dispatch_lengths)
stocklengthbarchart = StockLengthBarChart_2(
    stock_length=flip,
    framing_group_ids=py3.framing_group_ids,
    section_group_ids=py3.section_group_ids,
    graph_attributes=graph_attributes_2)  # -> V, text_3, G
panel = Panel(path_mapper)
allocated_graph_text = Data(stocklengthbarchart.text_3)
allocated_bar_chart = Surface(stocklengthbarchart.G)
filter_2 = StreamFilter(Gate=0, Stream0=allocated_graph_text)
filter_3 = StreamFilter(Gate=0, Stream0=allocated_bar_chart)
allocated_graph_text_2 = Data(filter_2)
allocated_bar_chart_2 = Surface(filter_3)
allocated_graph_text_3 = ClusterOutput(allocated_graph_text_2)
allocated_bar_chart_3 = ClusterOutput(allocated_bar_chart_2)

# ==== cluster ShortLengthChart
mediator = ClusterInput()
show = ClusterInput()
mediator_2 = Data(mediator)
show_2 = Boolean(show)
filter = StreamFilter(Gate=show_2, Stream1=mediator_2)
py3 = Python3Script(mediator=filter)  # -> out, framing_group_ids, section_groups, section_group_ids; same code as py3
py3_2 = Python3Script(mediator=filter)  # -> out, removed_short_lengths
# ---------- py3_2: Python ----------
"""Grasshopper Script"""

from cubbyhouse.mediator import DispatchStage
from copy import deepcopy
m1 =deepcopy(mediator)
m1.dispatch_section_groups(DispatchStage.STAGE1_STRUCT)
df1 = m1.dispatch_matrix

m2 =deepcopy(mediator)
m2.dispatch_section_groups(DispatchStage.STAGE2_MIN_SIZE)
df2 = m2.dispatch_matrix


removed_df = df1 - df2

removed_short_lengths =removed_df.reset_index(names='section_group').to_json(orient='records')
# ---------- end py3_2 ----------
framing_group_ids = Text(py3.framing_group_ids)
graph_attributes = ClusterInput()
dejson = DeserializeJson(JSON=py3_2.removed_short_lengths, OutputsLocked=False)
dejson_2 = DeserializeJson(JSON=py3.section_groups, OutputsLocked=False)
dejsonkv = DeserializeKeysAndValues(JSON=dejson, Keys=graft(framing_group_ids))  # -> Key, simplify(Value)
dejsonkv_2 = DeserializeKeysAndValues(JSON=dejson_2, Keys="L_total")  # -> Key, flatten(Value)
graph_attributes_2 = Data(graph_attributes)
panel = Panel(dejsonkv_2.Value)
path_mapper = PathMapper(dejsonkv.Value, source="{A;B}", target="{B}")
dispatch_lengths = Number(path_mapper)
flip = FlipMatrix(Data=dispatch_lengths)
shortlengthbarchart = ShortLengthBarChart(
    stock_length=dejsonkv_2.Value,
    framing_group_ids=py3.framing_group_ids,
    short_length=path_mapper,
    section_group_ids=py3.section_group_ids,
    graph_attributes=graph_attributes_2)  # -> V, text_3, G
panel_2 = Panel(path_mapper)
allocated_graph_text = Data(shortlengthbarchart.text_3)
allocated_bar_chart = Surface(shortlengthbarchart.G)
filter_2 = StreamFilter(Gate=0, Stream0=allocated_graph_text)
filter_3 = StreamFilter(Gate=0, Stream0=allocated_bar_chart)
allocated_graph_text_2 = Data(filter_2)
allocated_bar_chart_2 = Surface(filter_3)
allocated_graph_text_3 = ClusterOutput(allocated_graph_text_2)
allocated_bar_chart_3 = ClusterOutput(allocated_bar_chart_2)

# ==== cluster BakeInSpace
block_label = ClusterInput()
block_id = ClusterInput()
text_style = ClusterInput()
bake_name = ClusterInput()
target_plane = ClusterInput()
block_label_2 = Text(block_label)
block_id_2 = Data(block_id)
text_style_2 = Data(text_style)
target_plane_2 = Plane(target_plane)
txt = Text(block_label_2)
text = DefineTextObject(Text=txt, Plane=target_plane_2, DimensionStyle=text_style_2)
insert = InsertBlock(BlockName=block_id_2, Plane=target_plane_2)
bake_name_2 = Data(bake_name)
concat = Concatenate(FragmentA=bake_name_2, FragmentB="_text")
text_bake_name = ClusterOutput(concat)
text_2 = ClusterOutput(text)
bake_name_3 = ClusterOutput(bake_name_2)
block_instance = ClusterOutput(insert)

# ==== cluster Cluster_3
house_back_height = ClusterInput()
roof_height = ClusterInput()
corner_pt = ClusterInput()
house_length = ClusterInput()
house_front_height = ClusterInput()
front_wall_a_width = ClusterInput()
front_wall_b_width = ClusterInput()
front_wall_opening_width = ClusterInput()
house_width = ClusterInput()
corner_pt_2 = Point(corner_pt)
house_length_2 = Number(house_length)
front_wall_opening_width_2 = Number(front_wall_opening_width)
unit_width = ClusterInput()
house_front_height_2 = Number(house_front_height)
house_width_2 = Number(house_width)
house_back_height_2 = Number(house_back_height)
front_wall_b_width_2 = Number(front_wall_b_width)
roof_height_2 = Number(roof_height)
front_wall_a_width_2 = Number(front_wall_a_width)
unit_width_2 = Number(unit_width)
X = UnitX(Factor=expr("x/2", house_width_2))
Z = UnitZ(Factor=house_front_height_2)
Z_2 = UnitZ(Factor=house_front_height_2)
X_2 = UnitX(Factor=house_width_2)
Z_3 = UnitZ(Factor=roof_height_2)
addition = Addition(A=X, B=Z_3)
addition_2 = Addition(A=X_2, B=Z)
Z_4 = UnitZ(Factor=house_back_height_2)
Y = UnitY(Factor=house_length_2)
X_3 = UnitX(Factor=house_width_2)
pt = ConstructPoint(XCoordinate=0, YCoordinate=0, ZCoordinate=0)
pt_2 = ConstructPoint(XCoordinate=0, YCoordinate=front_wall_a_width_2, ZCoordinate=0)
Z_5 = UnitZ(Factor=house_front_height_2)
addition_3 = Addition(A=front_wall_a_width_2, B=front_wall_opening_width_2)
Z_6 = UnitZ(Factor=-1)
X_4 = UnitX(Factor=-1)
Y_2 = UnitY(Factor=1)
Z_7 = UnitZ(Factor=-1)
Y_3 = UnitY(Factor=-1)
Y_4 = UnitY(Factor=1)
Z_8 = UnitZ(Factor=-1)
Y_5 = UnitY(Factor=-1)
Z_9 = UnitZ(Factor=1)
Z_10 = UnitZ(Factor=-1)
Z_11 = UnitZ(Factor=-1)
Y_6 = UnitY(Factor=1)
Z_12 = UnitZ(Factor=-1)
X_5 = UnitX(Factor=-1)
Z_13 = UnitZ(Factor=-1)
Z_14 = UnitZ(Factor=-1)
X_6 = UnitX(Factor=1)
X_7 = UnitX(Factor=1)
subtraction = Subtraction(A=addition, B=Z_2)
subtraction_2 = Subtraction(A=addition_2, B=addition)
Y_7 = UnitY(Factor=1)
Z_15 = UnitZ(Factor=-1)
addition_4 = Addition(A=Y, B=X_3, C=Z_4)
addition_5 = Addition(A=Y, B=X_3)
move = Move(Geometry=pt_2, Motion=Z_5)  # -> Geometry, Transform
Y_8 = UnitY(Factor=addition_3)
pl = ConstructPlane(Origin=Point(0, 0, 0), XAxis=X_4, YAxis=Z_6)
addition_6 = Addition(A=Y, B=Z_4)
pl_2 = ConstructPlane(Origin=Point(0, 0, 0), XAxis=Y_2, YAxis=Z_7)
addition_7 = Addition(A=X_3, B=Z_4)
pl_3 = ConstructPlane(Origin=Point(0, 0, 0), XAxis=Y_3, YAxis=Z_8)
pl_4 = ConstructPlane(Origin=Point(0, 0, 0), XAxis=Z_9, YAxis=Y_4)
pl_5 = ConstructPlane(Origin=Point(0, 0, 0), XAxis=X_5, YAxis=Z_10)
pl_6 = ConstructPlane(Origin=Point(0, 0, 0), XAxis=Y_5, YAxis=Z_11)
pl_7 = ConstructPlane(Origin=Point(0, 0, 0), XAxis=Y_6, YAxis=Z_12)
pl_8 = ConstructPlane(Origin=Point(0, 0, 0), XAxis=X_6, YAxis=Z_13)
pl_9 = ConstructPlane(Origin=Point(0, 0, 0), XAxis=X_7, YAxis=Z_14)
pl_10 = ConstructPlane(Origin=Point(0, 0, 0), XAxis=Y_7, YAxis=Z_15)
Y_9 = UnitY(Factor=1)
Y_10 = UnitY(Factor=1)
unit = UnitVector(Vector=subtraction_2)
unit_2 = UnitVector(Vector=subtraction)
p_x_z = Plane(pl)
pyz = Plane(pl_2)
# F3 Lintel
move_2 = Move(Geometry=pyz, Motion=move.Geometry)  # -> Geometry, Transform
plane = Plane(pl_3)
pzy = Plane(pl_4)
move_3 = Move(Geometry=pzy, Motion=pt)  # -> Geometry, Transform
# F4 Wall Stud
move_4 = Move(Geometry=pzy, Motion=Y_8)  # -> Geometry, Transform
# F2 Jamb Stud
move_5 = Move(Geometry=pzy, Motion=pt_2)  # -> Geometry, Transform
plane_2 = Plane(pl_5)
pyz_2 = Plane(pl_7)
plane_3 = Plane(pl_8)
pxz = Plane(pl_9)
plane_4 = Plane(pl_10)
p_y_z = Plane(pl_6)
top_spread = Panel("100")
top_spread_2 = Panel("150")
pl_11 = ConstructPlane(Origin=Point(0, 0, 0), XAxis=unit, YAxis=Y_9)
pl_12 = ConstructPlane(Origin=Point(0, 0, 0), XAxis=unit_2, YAxis=Y_10)
bottom_spread = Panel("-60")
bottom_spread_2 = Panel("-110")
top_spread_3 = Panel("35")
X_8 = UnitX(Factor=1)
Z_16 = UnitZ(Factor=1)
X_9 = UnitX(Factor=-1)
Z_17 = UnitZ(Factor=1)
Y_11 = UnitY(Factor=-1)
Z_18 = UnitZ(Factor=1)
# F9 Top Plate
move_6 = Move(Geometry=pxz, Motion=addition_6)  # -> Geometry, Transform
Z_19 = UnitZ(Factor=expr("-x", top_spread_3))
# F8 Top Plate
move_7 = Move(Geometry=pyz_2, Motion=Z_5)  # -> Geometry, Transform
Z_20 = UnitZ(Factor=expr("2*x", unit_width_2))
# F10 Top Plate
move_8 = Move(Geometry=plane, Motion=addition_4)  # -> Geometry, Transform
# F11 Top Plate
move_9 = Move(Geometry=plane_2, Motion=addition_7)  # -> Geometry, Transform
# F16 Rafter A
move_10 = Move(Geometry=pl_12, Motion=Z_2)  # -> Geometry, Transform
Z_21 = UnitZ(Factor=expr("2*x", unit_width_2))
# F12 Bottom Plate
move_11 = Move(Geometry=plane_4, Motion=pt)  # -> Geometry, Transform
move_12 = Move(Geometry=pl_11, Motion=addition)  # -> Geometry, Transform
# F15 Bottom
move_13 = Move(Geometry=p_x_z, Motion=X_3)  # -> Geometry, Transform
pl_13 = ConstructPlane(Origin=Point(0, 0, 0), XAxis=Z_16, YAxis=X_8)
pl_14 = ConstructPlane(Origin=Point(0, 0, 0), XAxis=Z_17, YAxis=X_9)
pl_15 = ConstructPlane(Origin=Point(0, 0, 0), XAxis=Z_18, YAxis=Y_11)
# F14 Bottom
move_14 = Move(Geometry=p_y_z, Motion=addition_5)  # -> Geometry, Transform
# F13 Bottom Plate
move_15 = Move(Geometry=plane_3, Motion=Y)  # -> Geometry, Transform
X_10 = UnitX(Factor="-10")
move_16 = Move(Geometry=move_2.Geometry, Motion=Z_19)  # -> Geometry, Transform
Z_22 = UnitZ(Factor=top_spread)
Z_23 = UnitZ(Factor=top_spread)
Z_24 = UnitZ(Factor=top_spread)
Z_25 = UnitZ(Factor=top_spread)
pzx = Plane(pl_13)
# F5 Side Wall
move_17 = Move(Geometry=pzx, Motion=Y)  # -> Geometry, Transform
plane_5 = Plane(pl_14)
# F7 Side Wall 2
move_18 = Move(Geometry=plane_5, Motion=X_3)  # -> Geometry, Transform
move_19 = Move(Geometry=move_16.Geometry, Motion=X_10)  # -> Geometry, Transform
plane_6 = Plane(pl_15)
# F6 Back Wall
move_20 = Move(Geometry=plane_6, Motion=addition_5)  # -> Geometry, Transform
move_21 = Move(Geometry=move_10.Geometry, Motion=Z_20)  # -> Geometry, Transform
Z_26 = UnitZ(Factor=bottom_spread_2)
Z_27 = UnitZ(Factor=bottom_spread_2)
Z_28 = UnitZ(Factor=bottom_spread_2)
Z_29 = UnitZ(Factor=bottom_spread_2)
move_22 = Move(Geometry=move_12.Geometry, Motion=Z_21)  # -> Geometry, Transform
move_23 = Move(Geometry=move_6.Geometry, Motion=Z_22)  # -> Geometry, Transform
top_spread_4 = Panel("130")
move_24 = Move(Geometry=move_7.Geometry, Motion=Z_23)  # -> Geometry, Transform
move_25 = Move(Geometry=move_8.Geometry, Motion=Z_24)  # -> Geometry, Transform
move_26 = Move(Geometry=move_9.Geometry, Motion=Z_25)  # -> Geometry, Transform
move_27 = Move(Geometry=move_11.Geometry, Motion=Z_26)  # -> Geometry, Transform
move_28 = Move(Geometry=move_15.Geometry, Motion=Z_27)  # -> Geometry, Transform
move_29 = Move(Geometry=move_14.Geometry, Motion=Z_28)  # -> Geometry, Transform
move_30 = Move(Geometry=move_13.Geometry, Motion=Z_29)  # -> Geometry, Transform
merge = Merge(
    Data1=move_3.Geometry,
    Data2=move_5.Geometry,
    Data3=move_19.Geometry,
    Data4=move_4.Geometry,
    Data5=move_17.Geometry,
    Data6=move_20.Geometry,
    Data7=move_18.Geometry,
    Data8=move_24.Geometry,
    Data9=move_23.Geometry,
    Data10=move_25.Geometry,
    Data11=move_26.Geometry,
    Data12=move_27.Geometry,
    Data13=move_28.Geometry,
    Data14=move_29.Geometry,
    Data15=move_30.Geometry,
    Data16=move_21.Geometry,
    Data17=move_22.Geometry)
Z_30 = UnitZ(Factor=top_spread_4)
move_31 = Move(Geometry=merge, Motion=corner_pt_2)  # -> Geometry, Transform
move_32 = Move(Geometry=move_7.Geometry, Motion=Z_30)  # -> Geometry, Transform
G = ClusterOutput(move_31.Geometry)

# ==== cluster MemberLocs
target_plane = ClusterInput()
member_ordinates = ClusterInput()
lam_y = ClusterInput()
length = ClusterInput()
rotate_section = ClusterInput()
lam_y_2 = Number(lam_y)
length_2 = Number(length)
target_plane_2 = Plane(target_plane)
member_ordinates_2 = Vector(member_ordinates)
X = UnitX(Factor=length_2)
panel = Panel(member_ordinates_2)
rotate_section_2 = Boolean(rotate_section)
panel_2 = Panel(lam_y_2)
series = Series(Start=0, Step=Slider(34, range=0..100), Count=simplify(lam_y_2))  # -> simplify(Series)
ln = Line(StartPoint=Point(0, 0, 0), EndPoint=X)
# Draw Transverse Laminations
Y = UnitY(Factor=series)  # -> graft(UnitVector)
branch = TreeBranch(Tree=Y, Path="{4;1}", MaintainPaths=True)
branch_2 = TreeBranch(Tree=Y, Path="{4;1}", MaintainPaths=True)
move = Move(Geometry=simplify(graft(ln)), Motion=member_ordinates_2)  # -> simplify(Geometry), Transform
Y_2 = UnitY(Factor=branch)
data = Data(Y)
Y_3 = UnitY(Factor=branch_2)
path = ConstructPath(Indices=Slider(4, range=0..14))
move_2 = Move(Geometry=move.Geometry, Motion=Y)  # -> Geometry, Transform
branch_3 = TreeBranch(Tree=move.Geometry, Path=path, MaintainPaths=True)
move_3 = Move(Geometry=branch_3, Motion=Y_2)  # -> Geometry, Transform
branch_4 = TreeBranch(Tree=member_ordinates_2, Path=path, MaintainPaths=True)
path_mapper = PathMapper(move.Geometry, source="{A;B}", target="{A}")
panel_3 = Panel(branch_4)
xy = XYPlane(Origin=Point(0, 0, 0))
orient = Orient(Geometry=xy, Source=xy, Target=target_plane_2)  # -> Geometry, Transform
orient_2 = Orient(Geometry=move.Geometry, Source=PlaneXY(0, 0, 0), Target=target_plane_2)  # -> Geometry, Transform
data_2 = Data(path_mapper)
# Excluding Transverse Laminations
orient_3 = Orient(Geometry=move.Geometry, Source=PlaneXY(0, 0, 0), Target=target_plane_2)  # -> Geometry, Transform
data_3 = Data()
number_slider = Slider(11, range=0..16)
num = Number(rotate_section_2)
branch_5 = TreeBranch(Tree=orient_2.Geometry, Path=path, MaintainPaths=True)
data_4 = Data(branch_5)
member_locs = Line(orient_2.Geometry)
pln = Plane(orient.Geometry)
member_locs_2 = Line(orient_3.Geometry)
eval = EvaluateCurve(Curve=reparameterize(member_locs), Parameter=0)  # -> Member_loc_planes, Tangent, Angle
eval_2 = EvaluateCurve(Curve=reparameterize(member_locs_2), Parameter=0)  # -> Member_loc_planes, Tangent, Angle
item = ListItem(List=branch_5, Index=number_slider, Wrap=True)
item_2 = ListItem(Index=number_slider, Wrap=True)
sph = Sphere(Base=pln, Radius=Slider(30, range=0..100))
Z = UnitZ(Factor=1)
xy_2 = XYPlane(Origin=Point(0, 0, 0))
deplane = DeconstructPlane(Plane=pln)  # -> Origin, XAxis, YAxis, ZAxis
xy_3 = XYPlane(Origin=Point(0, 0, 0))
member_locs_3 = ClusterOutput(member_locs)
rotate = Rotate(Geometry=eval.Tangent, Angle=1.570796327, Plane=xy_2)  # -> Geometry, Transform
p_n_c = PickNChoose(Pattern=simplify(graft(num)), Stream0=deplane.YAxis, Stream1=deplane.ZAxis)
rotate_2 = Rotate(Geometry=eval_2.Tangent, Angle=1.570796327, Plane=xy_3)  # -> Geometry, Transform
pl = ConstructPlane(Origin=eval.Member_loc_planes, XAxis=eval.Tangent, YAxis=p_n_c)
pl_2 = ConstructPlane(Origin=eval_2.Member_loc_planes, XAxis=eval_2.Tangent, YAxis=p_n_c)
deplane_2 = DeconstructPlane(Plane=pl)  # -> Origin, XAxis, YAxis, ZAxis
member_loc_planes_excl_trans_lams = ClusterOutput(pl_2)
member_loc_planes = ClusterOutput(pl)
panel_4 = Panel(pl_2)

# ==== cluster Cuboid
width = ClusterInput()
thickness = ClusterInput()
length = ClusterInput()
thickness_2 = Number(thickness)
width_2 = Number(width)
length_2 = Number(length)
pt = ConstructPoint(XCoordinate=0, YCoordinate=width_2, ZCoordinate=thickness_2)
rec_2pt = Rectangle2Pt(Plane=PlaneYZ(0, 0, 0), PointA=Point(0, 0, 0), PointB=pt, Radius=0)  # -> Rectangle, Length
X = UnitX(Factor=length_2)
cross_section = Surface(rec_2pt.Rectangle)
extr = Extrude(Base=cross_section, Direction=X)
solid = ClusterOutput(extr)
cross_section_2 = ClusterOutput(cross_section)

# ==== cluster RequiredLengthBarChart
graph_attributes = ClusterInput()
graph_attributes_2 = Data(graph_attributes)
framing_group_ids = ClusterInput()
required_lengths = ClusterInput()
graphattributesdecon = Python3Script(graph_attributes=graph_attributes_2)  # -> out, graph_text, graph_spread, length_scale_factor, width_scale_factor, text_y_shift
# ---------- graphattributesdecon: Python ----------
"""Grasshopper Script"""

graph_text= graph_attributes.graph_text
graph_spread= graph_attributes.graph_spread
length_scale_factor= graph_attributes.length_scale_factor
width_scale_factor= graph_attributes.width_scale_factor
text_y_shift=graph_attributes.text_y_shift
# ---------- end graphattributesdecon ----------
framing_group_ids_2 = Text(simplify(graft(framing_group_ids)))
dejson = DeserializeJson(Required_lengths=required_lengths, OutputsLocked=False)
dejsonkv = DeserializeKeysAndValues(JSON=dejson, Keys=simplify(framing_group_ids_2))  # -> Key, simplify(Value)
spread_factor = Number(graphattributesdecon.graph_spread)
multiplication = Multiplication(Width_scale_factor=graphattributesdecon.width_scale_factor)
text_style = Data(graphattributesdecon.graph_text)
path_mapper = PathMapper(dejsonkv.Value, source="{A;:}", target="{A}")
# Bar Spread
multiplication_2 = Multiplication(A=multiplication, B=spread_factor)
num = Number(path_mapper)
cset = CreateSet(List=num)  # -> Set, Map
num_2 = Number(cset.Set)
multiplication_3 = Multiplication(A=num_2, Length_scale_factor=graphattributesdecon.length_scale_factor)
tstat = TreeStatistics(Tree=multiplication_3)  # -> Paths, Length, Count
lng = ListLength(List=tstat.Paths)
series = Series(Start=0, Step=multiplication_2, Count=lng)  # -> simplify(graft(Series))
spread = Number(series)
spread_2 = ClusterOutput(spread)
X = UnitX(Factor=series)  # -> simplify(UnitVector)
Y = UnitY(Factor=expr("-x", graphattributesdecon.text_y_shift))
X_2 = UnitX(Factor=expr("x/2", graphattributesdecon.width_scale_factor))
spread_3 = Vector(X)
# Text
expression = Expression(x=num_2, Expression="Format(\"{0:0}\", x/1000)")
# Bar Shapes
Y_2 = UnitY(Factor=multiplication_3)
move = Move(Geometry=spread_3, Motion=Y)  # -> Geometry, Transform
X_3 = UnitX(Factor=multiplication)
ln = Line(StartPoint=Point(0, 0, 0), EndPoint=Y_2)
addition = Addition(A=Y_2, B=spread_3)
move_2 = Move(Geometry=addition, Motion=Y)  # -> Geometry, Transform
ln_2 = Line(StartPoint=Point(0, 0, 0), EndPoint=X_3)
move_3 = Move(Geometry=move_2.Geometry, Motion=X_2)  # -> Geometry, Transform
move_4 = Move(Geometry=move.Geometry, Motion=X_2)  # -> Geometry, Transform
text = DefineTextObject(Text=framing_group_ids_2, Plane=simplify(graft(move_4.Geometry)), DimensionStyle=text_style)
text_2 = DefineTextObject(Text=expression, Plane=simplify(move_3.Geometry), DimensionStyle=text_style)
extrcrv = ExtrudeAlong(Base=ln, Curve=ln_2)
srf = Surface(extrcrv)
text_3 = ClusterOutput([text, text_2])
move_5 = Move(Geometry=srf, Motion=simplify(X))  # -> Geometry, Transform
G = ClusterOutput(move_5.Geometry)

# ==== cluster StockLengthBarChart
graph_attributes = ClusterInput()
section_group_ids = ClusterInput()
graph_attributes_2 = Data(graph_attributes)
section_group_ids_2 = Text(section_group_ids)
graphattributesdecon = Python3Script(graph_attributes=graph_attributes_2)  # -> out, graph_text, graph_spread, length_scale_factor, width_scale_factor, text_y_shift
# ---------- graphattributesdecon: Python ----------
"""Grasshopper Script"""

graph_text= graph_attributes.graph_text
graph_spread= graph_attributes.graph_spread
length_scale_factor= graph_attributes.length_scale_factor
width_scale_factor= graph_attributes.width_scale_factor
text_y_shift =graph_attributes.text_y_shift
# ---------- end graphattributesdecon ----------
framing_group_ids = ClusterInput()
stock_length = ClusterInput()
framing_group_ids_2 = Text(framing_group_ids)
number_slider = Slider(80, range=0..100)
stock_length_2 = Number(stock_length)
multiplication = Multiplication(A=stock_length_2, Length_scale_factor=graphattributesdecon.length_scale_factor)
multiplication_2 = Multiplication(Width_scale_factor=graphattributesdecon.width_scale_factor)
spread_factor = Number(graphattributesdecon.graph_spread)
expression = Expression(x=stock_length_2, Expression="Format(\"{0:0}\", x/1000)")
division = Division(A=stock_length_2, B=100)
multiplication_3 = Multiplication(A=graphattributesdecon.width_scale_factor, B=spread_factor)
Y = UnitY(Factor=multiplication)
_0_5_w = Number(expr("0.5*x", graphattributesdecon.width_scale_factor))
Y_2 = UnitY(Factor=expr("-x", graphattributesdecon.text_y_shift))
Y_3 = UnitY(Factor=expr("5*x", graphattributesdecon.text_y_shift))
lng = ListLength(List=framing_group_ids_2)
addition = Addition(A=graphattributesdecon.width_scale_factor)
lng_2 = ListLength(List=stock_length_2)
X = UnitX(Factor=graphattributesdecon.width_scale_factor)
X_2 = UnitX(Factor=_0_5_w)
sort = SortList(Keys=multiplication)  # -> Keys, ValuesA
xy = XYPlane(Origin=Point(0, 0, 0))
concat = Concatenate(FragmentA=expression, FragmentB=" ")
item = ListItem(List=sort.Keys, Index=-1, Wrap=True)
series = Series(Start=addition, Step=graphattributesdecon.width_scale_factor, Count=lng_2)  # -> simplify(Series)
ln = Line(StartPoint=Point(0, 0, 0), EndPoint=X)
series_2 = Series(Start=0, Step=multiplication_3, Count=lng)  # -> simplify(graft(Series))
ln_2 = Line(StartPoint=Point(0, 0, 0), EndPoint=Y)
X_3 = UnitX(Factor=series)
addition_2 = Addition(A=X_2, B=X_3)
move = Move(Geometry=xy, Motion=addition_2)  # -> Geometry, Transform
X_4 = UnitX(Factor=series_2)  # -> simplify(UnitVector)
addition_3 = Addition(A=Y_2, B=X_4)
width = Number(graphattributesdecon.width_scale_factor)
move_2 = Move(Geometry=move.Geometry, Motion=addition_3)  # -> Geometry, Transform
extrcrv = ExtrudeAlong(Base=ln_2, Curve=ln)
text = DefineTextObject(Text=section_group_ids_2, Plane=simplify(move_2.Geometry), DimensionStyle=graphattributesdecon.graph_text)
Y_4 = UnitY(Factor=item)
spread = Vector(X_4)
addition_4 = Addition(A=Y, B=spread)
move_3 = Move(Geometry=addition_4, Motion=Y_3)  # -> Geometry, Transform
move_4 = Move(Geometry=move_3.Geometry, Motion=addition_2)  # -> Geometry, Transform
text_2 = DefineTextObject(Text=concat, Plane=simplify(move_4.Geometry), DimensionStyle=graphattributesdecon.graph_text)
srf = Surface(extrcrv)
move_5 = Move(Geometry=srf, Motion=X_3)  # -> Geometry, Transform
V = ClusterOutput(Y_4)
text_3 = ClusterOutput([text_2, text])
move_6 = Move(Geometry=move_5.Geometry, Motion=simplify(X_4))  # -> Geometry, Transform
G = ClusterOutput(move_6.Geometry)

# ==== cluster StockLengthBarChart_2
graph_attributes = ClusterInput()
section_group_ids = ClusterInput()
graph_attributes_2 = Data(graph_attributes)
section_group_ids_2 = Text(section_group_ids)
graphattributesdecon = Python3Script(graph_attributes=graph_attributes_2)  # -> out, graph_text, graph_spread, length_scale_factor, width_scale_factor, text_y_shift; same code as graphattributesdecon
framing_group_ids = ClusterInput()
stock_length = ClusterInput()
framing_group_ids_2 = Text(framing_group_ids)
number_slider = Slider(80, range=0..100)
stock_length_2 = Number(stock_length)
multiplication = Multiplication(A=stock_length_2, Length_scale_factor=graphattributesdecon.length_scale_factor)
spread_factor = Number(graphattributesdecon.graph_spread)
expression = Expression(x=stock_length_2, Expression="Format(\"{0:0}\", x/1000)")
division = Division(A=stock_length_2, B=100)
multiplication_2 = Multiplication(A=graphattributesdecon.width_scale_factor, B=spread_factor)
Y = UnitY(Factor=expr("-x", graphattributesdecon.text_y_shift))
Y_2 = UnitY(Factor=expr("5*x", graphattributesdecon.text_y_shift))
Y_3 = UnitY(Factor=multiplication)
_0_5_w = Number(expr("0.5*x", graphattributesdecon.width_scale_factor))
lng = ListLength(List=framing_group_ids_2)
addition = Addition(A=graphattributesdecon.width_scale_factor)
lng_2 = ListLength(List=stock_length_2)
X = UnitX(Factor=graphattributesdecon.width_scale_factor)
X_2 = UnitX(Factor=_0_5_w)
sort = SortList(Keys=multiplication)  # -> Keys, ValuesA
concat = Concatenate(FragmentA=expression, FragmentB=" ")
xy = XYPlane(Origin=Point(0, 0, 0))
item = ListItem(List=sort.Keys, Index=-1, Wrap=True)
series = Series(Start=addition, Step=graphattributesdecon.width_scale_factor, Count=lng_2)  # -> simplify(Series)
ln = Line(StartPoint=Point(0, 0, 0), EndPoint=X)
series_2 = Series(Start=0, Step=multiplication_2, Count=lng)  # -> simplify(graft(Series))
ln_2 = Line(StartPoint=Point(0, 0, 0), EndPoint=Y_3)
panel = Panel(concat)
X_3 = UnitX(Factor=series)
addition_2 = Addition(A=X_2, B=X_3)
move = Move(Geometry=xy, Motion=addition_2)  # -> Geometry, Transform
X_4 = UnitX(Factor=series_2)  # -> simplify(UnitVector)
width = Number(graphattributesdecon.width_scale_factor)
addition_3 = Addition(A=Y, B=X_4)
extrcrv = ExtrudeAlong(Base=ln_2, Curve=ln)
move_2 = Move(Geometry=move.Geometry, Motion=addition_3)  # -> Geometry, Transform
Y_4 = UnitY(Factor=item)
spread = Vector(X_4)
addition_4 = Addition(A=Y_3, B=spread)
move_3 = Move(Geometry=addition_4, Motion=Y_2)  # -> Geometry, Transform
move_4 = Move(Geometry=move_3.Geometry, Motion=addition_2)  # -> Geometry, Transform
text = DefineTextObject(Text=concat, Plane=simplify(move_4.Geometry), DimensionStyle=graphattributesdecon.graph_text)
srf = Surface(extrcrv)
text_2 = DefineTextObject(Text=section_group_ids_2, Plane=simplify(move_2.Geometry), DimensionStyle=graphattributesdecon.graph_text)
move_5 = Move(Geometry=srf, Motion=X_3)  # -> Geometry, Transform
V = ClusterOutput(Y_4)
text_3 = ClusterOutput([text, text_2])
move_6 = Move(Geometry=move_5.Geometry, Motion=simplify(X_4))  # -> Geometry, Transform
G = ClusterOutput(move_6.Geometry)

# ==== cluster ShortLengthBarChart
graph_attributes = ClusterInput()
section_group_ids = ClusterInput()
graph_attributes_2 = Data(graph_attributes)
short_length = ClusterInput()
section_group_ids_2 = Text(section_group_ids)
short_length_2 = Data(short_length)
graphattributesdecon = Python3Script(graph_attributes=graph_attributes_2)  # -> out, graph_text, graph_spread, length_scale_factor, width_scale_factor, text_y_shift; same code as graphattributesdecon
num = Number(short_length_2)
framing_group_ids = ClusterInput()
stock_length = ClusterInput()
multiplication = Multiplication(A=num, Length_scale_factor=graphattributesdecon.length_scale_factor)
framing_group_ids_2 = Text(framing_group_ids)
number_slider = Slider(80, range=0..100)
stock_length_2 = Number(stock_length)
multiplication_2 = Multiplication(A=simplify(graft(stock_length_2)), Length_scale_factor=graphattributesdecon.length_scale_factor)
spread_factor = Number(graphattributesdecon.graph_spread)
subtraction = Subtraction(A=multiplication_2, B=multiplication)
expression = Expression(x=num, Expression="Format(\"{0:0}\", x/1000)")
division = Division(A=stock_length_2, B=100)
multiplication_3 = Multiplication(A=graphattributesdecon.width_scale_factor, B=spread_factor)
Y = UnitY(Factor=expr("-x", graphattributesdecon.text_y_shift))
Y_2 = UnitY(Factor=expr("5*x", graphattributesdecon.text_y_shift))
Y_3 = UnitY(Factor=subtraction)
lng = ListLength(List=Y_3)
Y_4 = UnitY(Factor=multiplication_2)
data = Data(simplify(graft(Y_4)))
_0_5_w = Number(expr("0.5*x", graphattributesdecon.width_scale_factor))
lng_2 = ListLength(List=framing_group_ids_2)
addition = Addition(A=graphattributesdecon.width_scale_factor)
lng_3 = ListLength(List=stock_length_2)
X = UnitX(Factor=graphattributesdecon.width_scale_factor)
sort = SortList(Keys=multiplication_2)  # -> Keys, ValuesA
X_2 = UnitX(Factor=_0_5_w)
repeat = RepeatData(Data=data, Length=lng)  # -> simplify(Data)
concat = Concatenate(FragmentA=expression)
xy = XYPlane(Origin=Point(0, 0, 0))
item = ListItem(List=sort.Keys, Index=-1, Wrap=True)
series = Series(Start=addition, Step=graphattributesdecon.width_scale_factor, Count=lng_3)  # -> simplify(Series)
series_2 = Series(Start=0, Step=multiplication_3, Count=lng_2)  # -> simplify(graft(Series))
txt = Text(" ")
equals = Equality(FirstNumber=expression, SecondNumber=0)  # -> Equality, Inequality
ln = Line(StartPoint=Y_3, EndPoint=Y_4)
ln_2 = Line(StartPoint=Point(0, 0, 0), EndPoint=X)
p_n_c = PickNChoose(Pattern=equals.Equality, Stream0=concat, Stream1=txt)
extrcrv = ExtrudeAlong(Base=ln, Curve=ln_2)
X_3 = UnitX(Factor=series_2)  # -> simplify(UnitVector)
rep = ReplaceText(Text=concat, Find="0", RecursiveReplace=False)
panel = Panel(rep)
width = Number(graphattributesdecon.width_scale_factor)
addition_2 = Addition(A=Y, B=X_3)
X_4 = UnitX(Factor=series)
addition_3 = Addition(A=X_2, B=X_4)
move = Move(Geometry=xy, Motion=addition_3)  # -> Geometry, Transform
move_2 = Move(Geometry=move.Geometry, Motion=addition_2)  # -> Geometry, Transform
Y_5 = UnitY(Factor=item)
spread = Vector(X_3)
addition_4 = Addition(A=Y_4, B=spread)
move_3 = Move(Geometry=addition_4, Motion=Y_2)  # -> Geometry, Transform
move_4 = Move(Geometry=move_3.Geometry, Motion=addition_3)  # -> Geometry, Transform
text = DefineTextObject(Text=p_n_c, Plane=simplify(move_4.Geometry), DimensionStyle=graphattributesdecon.graph_text)
text_2 = DefineTextObject(Text=section_group_ids_2, Plane=simplify(move_2.Geometry), DimensionStyle=graphattributesdecon.graph_text)
srf = Surface(extrcrv)
flip = FlipMatrix(Data=srf)
V = ClusterOutput(Y_5)
text_3 = ClusterOutput([text, text_2])
move_5 = Move(Geometry=flip, Motion=X_4)  # -> Geometry, Transform
move_6 = Move(Geometry=move_5.Geometry, Motion=simplify(X_3))  # -> Geometry, Transform
G = ClusterOutput(move_6.Geometry)
